# Grasshopper definition Pyramide Karamba 10_14_2026.gh (Grasshopper 1.0.8)
# plug-ins: Karamba3D, Rhino.Inside for Autodesk Revit, Bifocals

rib_w = Slider(150, range=0..1000)
rib_d = Slider(250, range=0..1000)
buttress_height = Slider(2500, range=0..10000)
buttress_length = Slider(1000, range=0..10000)
buttress_width = Slider(400, range=0..1000)
license = LicenseKaramba3D()
py3 = Python3Script(
    rib_d_eave=Slider(350, range=0..1000),
    rib_d_top=Slider(150, range=0..1000),
    rib_w=rib_w,
    rib_d=rib_d,
    n_cols=Slider(6, range=0..10),
    min_pitch=Slider(500, range=0..1000),
    walls=Toggle(False),
    ring=Toggle(True),
    ring_w=Slider(300, range=0..1000),
    base_h=Slider(300, range=0..1000),
    hring_z=[Slider(4800, range=0..10000), Slider(6578, range=0..10000)],
    hring_w=Slider(250, range=0..1000),
    skin_check=Toggle(False),
    ring_test=Toggle(False),
    but_on_ribs=Toggle(True),
    but_total=buttress_length,
    but_w=buttress_width,
    wall_h=buttress_height,
    no_corner="1,2,3,4",
    but_cap=Toggle(True),
    footing=Toggle(True),
    foot_w=Slider(600, range=0..1000),
    foot_ext=Slider(1000, range=0..2000),
    foot_h=Slider(300, range=0..2000),
    foot_in=Slider(400, range=0..1000),
    foot_strip=Toggle(True),
    qp=Slider(2.6, range=0..10))  # -> info, roof_meshes, wall_meshes, but_meshes, ring_lines, crown_lines, rib_lines, supports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; inputs hring_z: list of Double, ring_test: Boolean, no_corner: String
# ---------- py3: Python ----------
"""Karamba3D model of the buttressed pyramid roof: roof shell, walls, buttresses, ring beams, the cast rib grid
(grid A from the roof-grid sheet 08), supports and loads. Fully parametric: every dimension below is an
optional input, so sliders (and Galapagos / Octopus) can drive the shape, the thicknesses and the heights.

Paste into a Python 3 Script component (Rhino 8) or GhPython (Rhino 7). Add an input for each parameter you want to
change, named exactly as in PARAMETERS; inputs you leave out (or unconnected) use the default. The geometry core
(`build_model`) is pure Python: `python scripts/karamba_model.py` prints the model and checks that
everything shares nodes. Units: millimetres. Karamba does NOT follow the Rhino document units (its default is
metres): set Karamba3D menu > Physical Units > Geometry Input Units to mm in the .gh.

Roof grid A (the only option kept; grid B and the plain shell were dropped on 18 Oct 2026):
  ruled-surface columns: `n_cols` bays along the eave, columns converge to the crown; every other column stops on
  a horizontal rib (`hring_z`, or where the spacing reaches `min_pitch`); the middle column of each side and the
  hips run to the crown ring.
The roof mesh follows the ribs (rows at the rib levels, columns on the rib lines, the mesh halves where columns
stop), so every rib is a chain of beams on shell nodes.

Idealisation (state it in your report):
  - Everything is modelled on mid-surfaces / centrelines. The ring beam = the solid roof base (wall x base_h), at its
    CENTROID on the wall centreline; the roof shell, the walls and the ring beam meet there. Ribs start on the ring
    beam (on the drawings they rise out of the solid base) and end on a rib ring, a hip or the crown ring.
  - Roof = four planar shells from the ring beam to the crown ring; the crown ring sits on the shell surface at
    the crown.
  - Roof build-up, square to the slope, from the room side out (all printed layers are `bead` wide):
        inner bead | rib zone (rib_d, a cavity crossed by the cast ribs) | middle bead | lattice zone (`lattice`,
        wavy bead + insulation, `fill` = solid share) | `outer_beads` outer beads
    = 30 + 160 + 30 + 120 + 30 = 370 with the defaults, constant from eave to crown. No cladding load by default:
    the outer bead is the exposed face and the insulation sits in the lattice zone (add it with `clad`).
  - Structural layers (`all_layers` = False, the default): only the inner and middle beads carry load, as a sandwich
    whose webs are the ribs; the lattice zone and the outer beads are weight only. With `all_layers` = True every
    printed layer counts (the lattice bead at its `fill` share).
  - Karamba's shell is one isotropic layer, so the structural layers are replaced by an EQUIVALENT shell placed on
    their centroid: thickness `t_roof` = sqrt(12 I / A), modulus E x A / t_roof (`E_roof`), density so the whole
    build-up weighs right (`gamma_roof`), and strengths fc, ft x A / t_roof (`fc_roof`, `ft_roof`). Displacements
    are then exact; Karamba's utilisation is exact for in-plane (membrane) stress and on the safe side for bending.
    Karamba's raw stresses are NOT the real skin stresses (multiply by t_roof / A for the membrane part).
  - The ribs sit in the rib zone, centred on the shell surface (the centroid of the two skins), so the rib beams sit
    on the shell nodes without eccentricity. With `all_layers` = True the centroid moves outwards and that rib
    eccentricity is ignored.
  - Walls, from the room side out: inner bead | lattice zone (wall - (1 + outer_beads) x bead, `fill` share) |
    `outer_beads` outer beads. The inner and outer beads carry load as a sandwich tied by the lattice bead (all
    printed layers with `all_layers` = True), as an equivalent shell like the roof (`t_wall`, `E_wall`, ...),
    on the wall centreline (the offset of its centroid is ignored).
  - Walls = four vertical shells from the ground to the ring beam. Buttresses = one vertical shell per buttress on its
    axis (equal bays of about `but_spacing`, corners included), from the wall mid-plane to `but_total` from the inner
    face, ground to the ring beam. Wall and roof nodes meet only on the ring beam (it is split at every node of both).
  - Footing not modelled: supports are fixed (or pinned) at z = 0. Add the soil/footing as springs if you need it.

PARAMETERS (inputs, all optional; defaults = the drawing set). Lengths in mm.
  mesh         mesh_size    target element size                                        500
  plan         clear        clear inside dimension of the square plan                  10000
               wall         wall thickness (= ring beam width)                         400
  heights      wall_h       ground to top of wall (eave)                               2500
               base_h       solid roof base height (= ring beam depth)                 300
               ring_w       ring beam width (also the buttress caps)                   = wall
  foundation   footing      True: strip footing on the wall line at z = 0 joining all    False
                            buttress feet + a footing beam under every buttress; the
                            supports move under the footing (cast, Id "footing")
               foot_w       footing width                                              800
               foot_h       footing depth                                              500
               foot_ext     how far the buttress footing reaches beyond the buttress   300
               foot_in      how far the buttress footing reaches inward, from the      0
                            wall line (under the room)
               foot_strip   True: strip on the wall line joining the pads; False:      True
                            separate pads under the buttresses only
  checks       skin_check   True: the roof shell becomes ONE bead-thick skin with the real    False
                            printed E and the whole roof weight, for Buckling Modes:
                            BLFacs = local skin buckling between the ribs (safe side)
               rise         roof height above the eave                                 6000
               slope        roof angle in degrees; if given it replaces rise           (none)
               opening      clear crown opening                                        1000
  printed      bead         print width of every printed layer (roof and walls)        30
  layers       outer_beads  number of outer beads (roof and walls)                     1
               lattice      roof lattice + insulation zone depth                       120
               fill         solid share of the lattice zones (wavy bead), 0..1         0.25
               all_layers   False: only the skins carry load; True: every layer        False
  ribs         rib_w        rib width                                                  160
               rib_d        rib depth = depth of the rib zone in the roof              160
               rib_d_eave   tapered ribs: column and hip depth at the eave; it changes  = rib_d
                            linearly to rib_d_top at the crown (the rib protrudes into
                            the room). Output rib_h = one depth per rib line
               rib_d_top    column and hip depth at the crown                          = rib_d
                            (the horizontal ribs keep rib_d)
               hring_w      width of the horizontal (middle) ribs                      = rib_w
                            Output rib_b = one width per rib line
               n_cols       grid A: column bays along the eave (even)                  10
               min_pitch    grid A: column spacing where every other column stops      500
  shell        shell_structural  False: the printed roof shell is a casing that only     False
                            weighs: its stiffness is set near zero so the ribs, rings
                            and buttresses carry everything. True: the two printed
                            skins act as an equivalent sandwich shell (old behaviour)
  crown        crown_ring   add a crown compression ring                               True
               crown_b      crown ring width                                           200
               crown_h      crown ring depth                                           200
  buttresses   but_spacing  target buttress spacing along the wall                     1500
               but_total    buttress depth from the inner wall face                    1000
               but_w        buttress width (shell thickness)                           400
  walls        walls        False: no structural walls; the ring beam sits on the      True
                            buttresses only, supports under the buttresses
               ring         False: no ring beam (no solid roof base); the roof lands   True
                            on the walls / buttresses directly
               roof_only    True: only the roof, ribs and crown ring, supported on     False
                            every eave node; Reaction Forces = what the roof puts on
                            the ring (vertical + outward push)
               hring_z      grid A: heights (mm above the floor) of the horizontal    min_pitch
                            rib rings, one value or a list (input set to List Access);    levels
                            empty = the min_pitch levels, 0 = no rings at all (every
                            column then runs to the crown). info prints the face centroid
                            height for reference. The secondary (odd) columns run up
                            to the highest ring and stop there
               (grid A: the column in the middle of each side always runs to the crown)
               cols_full    grid A: True = every column runs from the eave to the crown   False
                            (none stops at a ring)
               ring_test    True: roof, ribs, crown ring and ring beam only, the ring   False
                            on sliding bearings at the buttress positions (support
                            points `supports`, Tz only) + one tangential pin at each
                            side's midpoint (`sup_x` Tx only, `sup_y` Ty only) so the
                            model can't spin or slide. The ring is free to grow
                            outward: ALL the roof's push goes into the ring, the
                            buttresses get vertical load only
               but_on_ribs  one buttress under every rib foot (n_cols bays) instead     False
                            of but_spacing
               no_corner    corners WITHOUT buttresses: 1 (+x+y), 2 (-x+y), 3 (-x-y),    none
                            4 (+x-y); a number, a list, or text "1,3" in a Panel
               but_cap      True: cast cap along each buttress top, tying it to the    True
                            ring; False: SEAT, the ring tied to the buttress top only
                            over its own width (ring_w), the contact of a notch
                            beam over its full depth (detail D1: the solid roof base
                            cast over the buttress, hooked bars into it)
  loads        wind_dir     direction the wind blows TOWARD, degrees from +X, ccw      0
               qp           peak wind pressure, kN/m2                                  0.9
               clad         anything on the roof besides the structure, kN/m2          0
                            (insulation, coating; 0 = bare structure)
               gamma        concrete density, kN/m3                                    24
               fck          characteristic strength, MPa                               30
               kf           printing / interface knock-down                            0.7
               fixed        True fixed supports, False pinned                          True

OUTPUTS - wire as in the README ("Karamba model" section)
    roof_meshes    list Mesh    4 roof faces      -> Mesh to Shell (roof section)
    wall_meshes    list Mesh    4 wall faces      -> Mesh to Shell (wall section)
    but_meshes     list Mesh    all buttresses    -> Mesh to Shell (buttress section)
    ring_lines     list Line    ring beam         -> Line to Beam (ring_b x ring_h, the solid roof base)
    crown_lines    list Line    crown ring        -> Line to Beam (crown_b x crown_h)
    cap_lines      list Line    buttress caps     -> Line to Beam, Id "cap", same section as the ring beam
    foot_lines     list Line    footing (footing = True) -> Line to Beam, Id "footing", foot_b x foot_h, cast
    foot_b, foot_h item float   footing section, mm
    rib_lines      list Line    rib grid -> Line to Beam, Id = rib_ids
    rib_ids        list str     "col" / "hring" / "hip", one per rib_lines item
    supports       list Point   base nodes        -> Support
    cladding       item Vector  kN/m2 on roof_meshes (Mesh Load, Z down)
    wind_vecs      list Vector  kN/m2 per roof face   (Mesh Load, one per roof_meshes item, same order)
    wind_walls     list Vector  kN/m2 per wall face   (Mesh Load, one per wall_meshes item, same order)
    t_roof         item float   EQUIVALENT roof shell thickness, mm (Shell Const height; not the 400 build-up)
    t_roof_elems   tree float   the same per element, one branch per roof mesh (for Shell Var)
    t_wall, t_but  item float   EQUIVALENT wall thickness / buttress thickness, mm
    ring_b, ring_h, crown_b, crown_h, rib_w, rib_d   beam sections, mm
    E_roof, G_roof, E_wall, G_wall  kN/cm2  equivalent moduli -> Material Properties E, G12, G13 (printed parts)
    fc_roof, ft_roof, fc_wall, ft_wall  kN/cm2  equivalent strengths -> Material Properties fc (negative), ft
    gamma_roof, gamma_wall  kN/m3 equivalent density for the printed hollow sections
    t_build        item float   real roof build-up thickness, mm
    rise, slope    item float   the roof height (mm) and angle (deg) actually built
    concrete       item float   total concrete volume, m3 (an objective for optimising)
    weight         item float   total self weight, kN, without cladding (cross-check Karamba's reactions)
    material       str          values for a custom Karamba Material
    info           str          counts, areas, rib lengths, weights and warnings
"""
import math

DEFAULTS = dict(
    mesh_size=500.0, clear=10000.0, wall=400.0, wall_h=2500.0, base_h=300.0, rise=6000.0, slope=None,
    opening=1000.0, bead=30.0, outer_beads=1, lattice=120.0, fill=0.25, all_layers=False,
    rib_w=160.0, rib_d=160.0, n_cols=10, min_pitch=500.0,
    crown_ring=True, crown_b=200.0, crown_h=200.0, but_spacing=1500.0, but_total=1000.0, but_w=400.0, walls=True,
    but_cap=True, no_corner=None, ring=True, but_on_ribs=False, roof_only=False, ring_test=False, hring_z=None, cols_full=False, ring_w=None, skin_check=False, shell_structural=False, rib_d_eave=None, rib_d_top=None, hring_w=None,
    footing=False, foot_w=800.0, foot_h=500.0, foot_ext=300.0, foot_in=0.0, foot_strip=True,
)


def _equiv(layers):
    """layers: (thickness, solid share, structural?) from the room side out. Returns the equivalent single-layer shell
    of the structural layers (same A and I per unit width): thickness, A / thickness (factor on E and the strengths),
    the centroid from the room-side face, and the solid thickness of ALL layers (for the weight)."""
    parts, z = [], 0.0
    for t, share, struct in layers:
        if struct and t > 0 and share > 0:
            parts.append((t * share, t, z + t / 2))
        z += t
    a = sum(pa for pa, _, _ in parts)
    zc = sum(pa * zm for pa, _, zm in parts) / a
    i = sum(pa * t * t / 12 + pa * (zm - zc) ** 2 for pa, t, zm in parts)
    t_eq = math.sqrt(12 * i / a)
    return dict(t=t_eq, ratio=a / t_eq, zc=zc, solid=sum(t * share for t, share, _ in layers), total=z)


def build_model(**kw):
    p = dict(DEFAULTS)
    p.update({k: v for k, v in kw.items() if v is not None})
    warn = []
    grid = "A"                                          # grid A only (B and the plain shell were dropped)
    ms = float(p["mesh_size"])
    half = p["clear"] / 2
    d_b = half + p["wall"] / 2                         # wall centreline = ring beam, half side
    z_b = p["wall_h"] + p["base_h"] / 2                # centroid of the solid roof base = base of the roof shell
    run = half - p["opening"] / 2
    if run <= 0:
        raise ValueError("opening must be smaller than the clear plan")
    if p["slope"]:
        if not 5 <= p["slope"] < 85:
            raise ValueError("slope must be between 5 and 85 degrees")
        rise = run * math.tan(math.radians(p["slope"]))
    else:
        rise = float(p["rise"])
    slope = math.degrees(math.atan2(rise, run))
    if rise <= p["base_h"]:
        raise ValueError("rise must be larger than base_h")
    z_c = p["wall_h"] + rise
    bead, n_out, fill, every = p["bead"], int(p["outer_beads"]), p["fill"], bool(p["all_layers"])
    if not p["ring_w"]:
        p["ring_w"] = p["wall"]                         # ring beam as wide as the wall unless set
    if p["ring_w"] <= 0 or p["base_h"] <= 0:
        raise ValueError("ring_w and base_h must be positive")
    roof_only = bool(p["roof_only"])                    # the roof alone, pinned along the eave: its reactions are
    ring_test = bool(p["ring_test"]) and not roof_only  # roof + ring only, the ring on sliding bearings
    walls = bool(p["walls"]) and not roof_only and not ring_test
    ring = (bool(p["ring"]) or ring_test) and not roof_only
    if bead <= 0 or n_out < 1 or min(p["lattice"], p["rib_d"]) < 0 or not 0 <= fill <= 1:
        raise ValueError("bead and outer_beads must be positive, lattice and rib_d not negative, fill between 0 and 1")
    wall_lat = p["wall"] - (1 + n_out) * bead
    if wall_lat < 0:
        raise ValueError("wall ({:.0f}) is thinner than its {} beads of {:.0f}".format(p["wall"], 1 + n_out, bead))
    roof_sec = _equiv([(bead, 1.0, True), (p["rib_d"], 0.0, False), (bead, 1.0, True),
                       (p["lattice"], fill, every), (n_out * bead, 1.0, every)])
    wall_sec = _equiv([(bead, 1.0, True), (wall_lat, fill, every), (n_out * bead, 1.0, True)])
    # shell surface = centroid of the structural layers; half width at the eave and at the crown (the room-side face
    # meets the inner wall face at the eave, as on the drawings)
    sh = 1.0 / math.sin(math.radians(slope))           # horizontal width per unit thickness square to the slope
    halfb = half + roof_sec["zc"] * sh
    d_c = p["opening"] / 2 + roof_sec["zc"] * sh
    if d_c >= d_b - ms / 2:
        raise ValueError("crown too wide for the plan - reduce opening or the roof thickness")
    kx = (halfb - d_c) / rise
    slant = math.hypot(d_b - d_c, z_c - z_b)

    def W(z):                                           # half width of the model roof face at height z
        return d_b + (d_c - d_b) * (z - z_b) / (z_c - z_b)

    def z_of(w):
        return z_b + (d_b - w) / (d_b - d_c) * (z_c - z_b)

    def band_rows(a, b, n_band, n_first):
        """row heights from a to b: each row about as tall (along the slope) as the elements are wide, at most mesh_size,
        so the elements stay near square as the face narrows towards the crown. The first row takes the width of the
        row below it (n_first), so the triangles where the mesh halves come out near 45/45/90."""
        h = lambda z, nn: min(ms, 2 * W(z) / nn) * (z_c - z_b) / slant
        z, c, nn = a, 0.0, n_first
        while z + h(z, nn) < b - 1e-9:
            z += h(z, nn); c += 1; nn = n_band
        c += (b - z) / h(z, nn)
        k = max(1, int(round(c)))
        zs, z, nn = [], a, n_first
        for _ in range(k - 1):
            z += h(z, nn) * c / k; nn = n_band
            if z >= b - 1e-6:
                break
            zs.append(z)
        return zs + [b]

    # ---- grid A: stop levels (drawings' terms: heights above the eave, roof_grid.H1 / H2) and roof rows
    levels_a, rib_levels, stops = [], [], (z_c, z_c)
    n_cols = int(p["n_cols"])
    if n_cols % 2 or n_cols < 2:
        n_cols = max(2, n_cols + n_cols % 2)
        warn.append("n_cols must be even: using {}".format(n_cols))
    col_pitch = 2 * halfb / n_cols
    if p["min_pitch"] >= col_pitch:
        raise ValueError("min_pitch ({:.0f}) must be smaller than the column spacing at the eave ({:.0f})".format(p["min_pitch"], col_pitch))
    h1 = (1 - p["min_pitch"] / col_pitch) * halfb / kx
    h2 = (1 - p["min_pitch"] / (2 * col_pitch)) * halfb / kx
    cand = [p["wall_h"] + h for h in (h1 / 2, h1, h2)]
    levels_a = [z for z in cand if z_b + ms / 4 < z < z_c - ms / 4]
    if len(levels_a) < 3 and p["hring_z"] is None:      # only matters when the min_pitch levels are used
        warn.append("grid A: {} of the 3 rib levels fall outside the roof; those columns run to the crown".format(3 - len(levels_a)))
    L1 = cand[1] if cand[1] in levels_a else None
    L2 = cand[2] if cand[2] in levels_a else None
    rib_levels = levels_a
    hz = p["hring_z"]
    hz = [] if hz is None else [hz] if isinstance(hz, (int, float)) else list(hz)
    no_rings = bool(hz) and all(z is not None and float(z) <= 0 for z in hz)
    hz = [float(z) for z in hz if z is not None and float(z) > 0]
    if no_rings:                                    # hring_z = 0: no horizontal rings, every column runs
        rib_levels, levels_a, L1, L2 = [], [], None, None   # eave to crown
    if hz:                                          # horizontal rib rings where the user puts them
        rib_levels = []
        for z in sorted(set(hz)):
            if z_b + ms / 4 < z < z_c - ms / 4:
                rib_levels.append(z)
            else:
                warn.append("hring_z {:.0f} is outside the roof (+{:.2f} to +{:.2f}): skipped".format(z, z_b / 1000, z_c / 1000))
        if not rib_levels:
            warn.append("no hring_z inside the roof: using the min_pitch levels")
            rib_levels = levels_a
        # the secondary (odd) columns run up to the HIGHEST ring and stop on it, so no rib end is loose;
        # the even columns and the hips run to the crown
        L1, L2 = max(rib_levels), None
        pitch = 2 * W(L1) / n_cols
        if pitch < p["min_pitch"]:
            warn.append("at the top ring (+{:.2f}) the columns are {:.0f} apart, closer than min_pitch {:.0f}".format(
                L1 / 1000, pitch, p["min_pitch"]))
        levels_a = rib_levels
    if p["cols_full"]:                              # every column runs eave to crown (the rings stay)
        L1, L2 = None, None
    stops = (L1 or z_c, L2 or z_c)                  # odd columns stop at L1, even ones at L2
    m_a = max(1, int(round(2 * d_b / n_cols / ms)))
    n0 = n_cols * m_a
    n1 = n0 // 2 if (L1 and (n0 // 2) % 2 == 0) else n0   # keep a mesh node on the centre column
    n2 = n1 // 2 if (L2 and n1 % 2 == 0 and (n1 // 2) % 2 == 0) else n1
    n_at = lambda z: n0 if (L1 is None or z <= L1 + 1e-6) else n1 if (L2 is None or z <= L2 + 1e-6) else n2
    breaks = [z_b] + levels_a + [z_c]
    rows = [(z_b, n0)]
    for a, b in zip(breaks, breaks[1:]):
        rows += [(z, n_at(z)) for z in band_rows(a, b, n_at((a + b) / 2), n_at(a))]

    # buttress axes along each side (as pyramid_drawings.but_pos): equal bays on the wall centreline, corners included.
    # but_on_ribs: one buttress under every rib foot (every column) instead
    nb = max(1, int(round(2 * d_b / p["but_spacing"])))
    if p["but_on_ribs"]:
        nb = n_cols
    but_x = [-d_b + 2 * d_b * k / nb for k in range(nb + 1)]
    q = max(1, int(round(2 * d_b / nb / ms)))
    wall_x = [-d_b + 2 * d_b * k / (nb * q) for k in range(nb * q + 1)]
    n_w = max(1, int(math.ceil(z_b / ms)))
    wall_z = [z_b * j / n_w for j in range(n_w + 1)]
    fin_len = half + p["but_total"] - d_b
    if fin_len <= 0:
        raise ValueError("but_total must be larger than half the wall thickness")
    n_f = max(1, int(math.ceil(fin_len / ms)))

    nc = p["no_corner"]                                 # corners without buttresses: 1 (+x+y), 2 (-x+y), 3 (-x-y),
    if nc is None:                                      # 4 (+x-y); an int, a list, or text like "1,3"
        nc = []
    elif isinstance(nc, str):
        nc = [c for c in nc.replace(";", ",").replace(" ", ",").split(",") if c.strip()]
    elif isinstance(nc, (int, float)):
        nc = [nc]
    no_corner = set(int(float(c)) for c in nc if str(c).strip() not in ("", "0"))
    if no_corner - {1, 2, 3, 4}:
        raise ValueError("no_corner takes corner numbers 1 to 4 (1 = +x+y, 2 = -x+y, 3 = -x-y, 4 = +x-y)")

    def corner_of(pt):                                  # 1-4 if pt is a plan corner of the wall line, else 0
        if abs(abs(pt[0]) - d_b) > 1.0 or abs(abs(pt[1]) - d_b) > 1.0:
            return 0
        return {(1, 1): 1, (-1, 1): 2, (-1, -1): 3, (1, -1): 4}[(1 if pt[0] > 0 else -1, 1 if pt[1] > 0 else -1)]
    n_but_real = 0

    out = {"grid": grid, "roof": [], "t_elems": [], "wall": [], "but": [], "ring": [], "crown": [], "ribs": [], "cap": [], "foot": [],
           "supports": [], "sup_x": [], "sup_y": [], "warn": warn}
    for k in range(4):
        th = math.radians(90 * k)
        n = (math.cos(th), math.sin(th)); t = (-math.sin(th), math.cos(th))

        def P(dist, x, z):                              # dist out from the centre along n, x along the side, z up
            return (_r(dist * n[0] + x * t[0]), _r(dist * n[1] + x * t[1]), _r(z))
        out_roof = (n[0], n[1], (d_b - d_c) / (z_c - z_b))      # outward normal direction of this roof face
        V, F, idx, ribs = [], [], {}, []

        def vid(key, pt):
            if key not in idx:
                idx[key] = len(V); V.append(pt)
            return idx[key]

        def chain(keys, rid):
            ribs.extend((V[idx[a]], V[idx[b]], rid) for a, b in zip(keys, keys[1:]))

        for r, (z, nr) in enumerate(rows):
            for i in range(nr + 1):
                vid((r, i), P(W(z), (-1 + 2.0 * i / nr) * W(z), z))
        for r in range(len(rows) - 1):
            na, nb_ = rows[r][1], rows[r + 1][1]
            if na == nb_:
                F += [(idx[r, i], idx[r, i + 1], idx[r + 1, i + 1], idx[r + 1, i]) for i in range(na)]
            else:                                   # the mesh halves above a rib level: 3 triangles per upper element
                for i in range(nb_):
                    b0, b1, b2 = idx[r, 2 * i], idx[r, 2 * i + 1], idx[r, 2 * i + 2]
                    t0, t1 = idx[r + 1, i], idx[r + 1, i + 1]
                    F += [(b0, b1, t0), (b1, b2, t1), (b1, t1, t0)]
        base = [V[idx[0, i]] for i in range(rows[0][1] + 1)]
        top = [V[idx[len(rows) - 1, i]] for i in range(rows[-1][1] + 1)]
        for c in range(n_cols):                     # column c (0 = left hip); the right hip is the next face's left hip
            stop = z_c if c == 0 else stops[0] if c % 2 else stops[1]
            if 2 * c == n_cols:                     # the column in the middle of the side always reaches the crown
                stop = z_c
            elif c > 0 and stop >= z_c - 1.0 and stops[0] < z_c and                         min(abs(1.0 - 2.0 * c / n_cols), 2.0 * c / n_cols) * d_c < p["min_pitch"]:
                stop = stops[0]                     # it would reach the crown closer than min_pitch to the centre
                                                    # column or the hip: it stops at the top ring instead
            xi = -1 + 2.0 * c / n_cols
            keys = []
            for r, (z, nr) in enumerate(rows):
                if z > stop + 1e-6:
                    break
                keys.append((r, int(round((xi + 1) / 2 * nr))))
            chain(keys, "hip" if c == 0 else "col")
        for zl in rib_levels:                       # horizontal ribs
            r = min(range(len(rows)), key=lambda rr: abs(rows[rr][0] - zl))
            chain([(r, i) for i in range(rows[r][1] + 1)], "hring")
        F = _orient(V, F, out_roof)
        out["roof"].append((V, F))
        out["t_elems"].append([roof_sec["t"]] * len(F))
        out["ribs"] += ribs

        # every wall-top node and every roof-eave node along this side
        eave_x = [round(pt[0] * t[0] + pt[1] * t[1], 3) for pt in base]
        xs = sorted(set([round(x, 3) for x in wall_x] + eave_x + ([0.0] if ring_test else [])))
        xs = [x for i, x in enumerate(xs) if i == 0 or x - xs[i - 1] > 1.0]
        if not roof_only and not ring and not walls and any(min(abs(x - xb) for x in eave_x) > 1.0 for xb in but_x):
            raise ValueError("without ring and walls each buttress must sit under a rib foot: set but_on_ribs = True")
        # wall: columns on the buttress bays; without a ring beam also on every roof-eave node, so the roof sits on it
        wxs = wall_x if ring else xs
        wv = [P(d_b, x, z) for z in wall_z for x in wxs]
        nx = len(wxs)
        wf = [(j * nx + i, j * nx + i + 1, (j + 1) * nx + i + 1, (j + 1) * nx + i) for j in range(n_w) for i in range(nx - 1)]
        if walls:
            out["wall"].append((wv, _orient(wv, wf, (n[0], n[1], 0.0))))
            out["supports"] += wv[:nx]
        # ring beam: split at every wall-top node and every roof-eave node
        if ring:
            out["ring"] += [(P(d_b, a, z_b), P(d_b, b, z_b)) for a, b in zip(xs, xs[1:])]
        if p["crown_ring"]:
            out["crown"] += list(zip(top, top[1:]))
        if roof_only:                                   # supports on every eave node instead of walls / buttresses
            out["supports"] += base
            continue
        bx_k = [xb for xb in but_x if corner_of(P(d_b, xb, 0.0)) not in no_corner]   # this face's buttresses
        n_but_real += len(bx_k)
        if ring_test:                                   # sliding bearings under the ring at the buttress positions
            out["supports"] += [P(d_b, xb, z_b) for xb in bx_k if abs(xb) > 1.0]   # a bearing at mid-side is
            out["sup_y" if k % 2 == 0 else "sup_x"].append(P(d_b, 0.0, z_b))   # in the pin (Tz ticked there too)
            continue
        # buttresses. Stations along the fin: the mesh columns plus the end of the seat (the ring's width), so the
        # seat can be connected over exactly its contact length
        seat = min(fin_len, float(p["ring_w"]))
        fst = sorted(set([round(fin_len * i / n_f, 3) for i in range(n_f + 1)] + [round(seat, 3)]))
        fst = [x for i, x in enumerate(fst) if i == 0 or x - fst[i - 1] > 1.0]
        nfs = len(fst)
        for xb in bx_k:
            bv = [P(d_b + u, xb, z) for z in wall_z for u in fst]
            bf = [(j * nfs + i, j * nfs + i + 1, (j + 1) * nfs + i + 1, (j + 1) * nfs + i)
                  for j in range(n_w) for i in range(nfs - 1)]
            out["but"].append((bv, bf))
            out["supports"] += bv[0 if not walls else 1:nfs]
            top_row = bv[n_w * nfs:]
            if p["but_cap"]:                            # the solid roof base cast over the whole buttress top (D1)
                out["cap"] += list(zip(top_row, top_row[1:]))
            else:                                       # SEAT: the ring rests on the buttress top over its own width
                on = [v for v, u in zip(top_row, fst) if u <= seat + 1.0]   # only, cast separately
                out["cap"] += list(zip(on, on[1:]))
        if p["footing"]:                                # strip footing on the wall line + a footing beam under every
            if p["foot_strip"]:                         # buttress, reaching foot_in inward from the wall line and
                fx = [P(d_b, x, 0.0) for x in wxs]      # foot_ext beyond the buttress; supported at every node.
                out["foot"] += list(zip(fx, fx[1:]))    # foot_strip = False: pads under the buttresses only
                out["supports"] += fx
            ext, fin_in = max(0.0, float(p["foot_ext"])), max(0.0, float(p["foot_in"]))
            n_ext, n_in = int(math.ceil(ext / ms)), int(math.ceil(fin_in / ms))

            for xb in bx_k:
                fp = [P(d_b - fin_in * (1 - i / n_in), xb, 0.0) for i in range(n_in)] if fin_in > 1.0 else []
                fp += [P(d_b + u, xb, 0.0) for u in fst]
                if ext > 1.0:
                    fp += [P(d_b + fin_len + ext * i / n_ext, xb, 0.0) for i in range(1, n_ext + 1)]
                out["foot"] += list(zip(fp, fp[1:]))
                out["supports"] += fp
    out["supports"] = sorted(set(out["supports"]))

    # ---- quantities (m3): printed parts at their solid share, cast parts full
    areas = [[_area(V, [f]) for f in F] for V, F in out["roof"]]
    roof_area = sum(sum(a) for a in areas)
    rib_len = sum(_dist(a, b) for a, b, _ in out["ribs"])
    # tapered columns and hips: depth rib_d_eave at the eave, changing linearly with height to rib_d at the crown
    d_top, d_eave = float(p["rib_d_top"] or p["rib_d"]), float(p["rib_d_eave"] or p["rib_d"])
    def rib_depth(a, b, rid):
        if rid not in ("col", "hip"):
            return float(p["rib_d"])
        t = min(1.0, max(0.0, ((a[2] + b[2]) / 2 - z_b) / (z_c - z_b)))
        return d_eave + (d_top - d_eave) * t
    out["rib_h"] = [rib_depth(a, b, rid) for a, b, rid in out["ribs"]]
    out["rib_b"] = [float(p["hring_w"] or p["rib_w"]) if rid == "hring" else float(p["rib_w"]) for _, _, rid in out["ribs"]]
    rib_area = sum(_dist(a, b) * h * w / p["rib_w"] for (a, b, _), h, w in zip(out["ribs"], out["rib_h"], out["rib_b"]))
    wall_area = 4 * 2 * d_b * z_b if walls else 0.0
    vol = dict(shell=roof_area * roof_sec["solid"] / 1e9, ribs=rib_area * p["rib_w"] / 1e9,
               ring=8 * d_b * p["ring_w"] * p["base_h"] / 1e9 if ring else 0.0,
               crown=sum(_dist(a, b) for a, b in out["crown"]) * p["crown_b"] * p["crown_h"] / 1e9,
               walls=wall_area * wall_sec["solid"] / 1e9,
               buttresses=0.0 if roof_only or ring_test else n_but_real * fin_len * z_b * p["but_w"] / 1e9,
               caps=sum(_dist(a, b) for a, b in out["cap"]) * p["ring_w"] * p["base_h"] / 1e9,
               footing=sum(_dist(a, b) for a, b in out["foot"]) * p["foot_w"] * p["foot_h"] / 1e9)
    out["p"] = p
    out["geom"] = dict(d_b=d_b, d_c=d_c, z_b=z_b, z_c=z_c, rise=rise, slope=slope, slant=slant, fin_len=fin_len,
                       n_but=n_but_real if not roof_only else 4 * len(but_x), no_corner=sorted(no_corner), nb=nb, mid_but=any(abs(xb) < 1.0 for xb in but_x), but_bay=2 * d_b / nb, roof_area=roof_area,
                       wall_area=wall_area, rib_len=rib_len, levels_a=rib_levels, z_g=z_b + (z_c - z_b) * (d_b + 2 * d_c) / (3 * (d_b + d_c)), roof_sec=roof_sec, wall_sec=wall_sec,
                       vol=vol, gamma_ratio_roof=roof_sec["solid"] / roof_sec["t"],
                       gamma_ratio_wall=wall_sec["solid"] / wall_sec["t"])
    lean = 90 - slope
    if lean > 30:
        warn.append("roof faces lean {:.0f} deg from vertical: check printability (beads shift {:.1f} mm per 10 mm layer)".format(
            lean, 10 / math.tan(math.radians(slope))))
    return out


def _r(v):
    v = round(v, 3)
    return 0.0 if v == 0 else v


def _dist(a, b):
    return math.sqrt(sum((p - q) ** 2 for p, q in zip(a, b)))


def _normal(V, f):
    a, b, c = V[f[0]], V[f[1]], V[f[2]]
    u = [b[i] - a[i] for i in range(3)]; v = [c[i] - a[i] for i in range(3)]
    return (u[1] * v[2] - u[2] * v[1], u[2] * v[0] - u[0] * v[2], u[0] * v[1] - u[1] * v[0])


def _orient(V, F, ref):
    """turn every face counter-clockwise seen from the `ref` side (outside)"""
    return [f if sum(a * b for a, b in zip(_normal(V, f), ref)) >= 0 else tuple(reversed(f)) for f in F]


def _area(V, F):
    tot = 0.0
    for f in F:
        for k in range(1, len(f) - 1):
            nrm = _normal(V, (f[0], f[k], f[k + 1]))
            tot += 0.5 * math.sqrt(sum(c * c for c in nrm))
    return tot


def loads(wind_dir_deg, qp, cpe_roof=(0.7, -0.6, -0.7), cpe_wall=(0.8, -0.5, -0.7)):
    """pressure coefficient per face (windward, leeward, two sides) as the faces face the wind; EN 1991-1-4 order of magnitude only"""
    res_roof, res_wall = [], []
    for k in range(4):
        th = math.radians(90 * k)
        n = (math.cos(th), math.sin(th))
        a = math.radians(wind_dir_deg)
        c = n[0] * math.cos(a) + n[1] * math.sin(a)      # wind blows TOWARD wind_dir: c = -1 windward face, +1 leeward, 0 side face
        idx = 0 if c < -0.7 else 1 if c > 0.7 else 2
        res_roof.append(cpe_roof[idx]); res_wall.append(cpe_wall[idx])
    return res_roof, res_wall


def summary(m, gamma=24.0, clad=0.0):
    g, p = m["geom"], m["p"]
    vol, rs, ws = g["vol"], g["roof_sec"], g["wall_sec"]
    n_roof = sum(len(F) for _, F in m["roof"])
    lines = ["grid {}: plan {:.0f} clear, eave +{:.2f}, rise {:.0f}, slope {:.1f} deg, crown opening {:.0f}".format(
                 m["grid"], p["clear"], p["wall_h"] / 1000, g["rise"], g["slope"], p["opening"]),
             "roof {:.0f} thick ({:.0f} bead, rib zone {:.0f}, lattice {:.0f}, {} outer beads), {} elements, {:.0f} m2; "
             "{} buttresses ({}, bays {:.0f})".format(
                 rs["total"], p["bead"], p["rib_d"], p["lattice"], int(p["outer_beads"]), n_roof, g["roof_area"] / 1e6,
                 g["n_but"], "some corners removed" if g["no_corner"] else "{} per side".format(g["n_but"] // 4), g["but_bay"]),
             "Karamba equivalent shells ({}): roof t {:.0f}, E x {:.3f}; wall t {:.0f}, E x {:.3f}".format(
                 "all printed layers" if p["all_layers"] else "skins only", rs["t"], rs["ratio"], ws["t"], ws["ratio"]),
             "ROOF SHELL = STRUCTURAL sandwich (shell_structural True)" if p["shell_structural"] else
             "ROOF SHELL = CASING ONLY: weight kept, stiffness / 1000, so ribs + rings + buttresses carry everything"]
    if not p["shell_structural"]:
        lines.append("note: with a casing-only shell, ignore the shell's own deflection and buckling modes; read the "
                     "ribs, rings, buttresses and reactions")
    if p["skin_check"]:
        lines.append("SKIN CHECK: roof shell = one {:.0f} mm skin, real printed E, full roof weight. Use only with "
                     "Buckling Modes (BLFacs = local skin buckling between ribs, on the safe side)".format(p["bead"]))
    if p["ring_test"] and not p["roof_only"]:
        z = " + Tz" if g["mid_but"] else " only"
        lines.append("RING TEST: roof + ring only, the ring on {} sliding bearings under the buttress positions (Support "
                     "on `supports`: Tz only) + mid-side pins (`sup_x`: Tx{z}, `sup_y`: Ty{z}). Horizontal reactions "
                     "should be ~0: the ring carries the whole push. Read the ring's N (tension) and bending, and the "
                     "eave Disp (how much the ring grows)".format(len(m["supports"]) + (4 if g["mid_but"] else 0), z=z))
    if p["roof_only"]:
        lines.append("ROOF ONLY: supported on every eave node (set Support to pinned: Tx Ty Tz only). The reactions are "
                     "what the roof puts on the ring: Z = down, horizontal = outward push")
    elif not m["ring"]:
        lines.append("NO ring beam: the roof lands on the {} directly".format("wall top" if m["wall"] else "buttresses at the rib feet"))
    if p["but_on_ribs"]:
        lines.append("buttresses under the rib feet: {} bays per side ({} buttresses with both corners), {:.0f} apart".format(
            g["nb"], g["nb"] + 1, g["but_bay"]))
    if not m["wall"] and not p["roof_only"] and not p["ring_test"]:
        lines.append("NO structural walls: the ring beam sits on the {} buttresses only (wall_meshes and wind_walls are "
                     "empty, supports under the buttresses)".format(g["n_but"]))
    if m["foot"]:
        lines.append("footing {:.0f} x {:.0f}: {}under each buttress from {:.0f} inside the wall "
                     "line to {:.0f} beyond the buttress (footing length {:.0f}), {} beams, supports under the footing "
                     "(foot_lines)".format(p["foot_w"], p["foot_h"],
                                           "strip on the wall line + " if p["foot_strip"] else "PADS ONLY, ",
                                           p["foot_in"], p["foot_ext"],
                                           p["foot_in"] + g["fin_len"] + p["foot_ext"], len(m["foot"])))
    if g["no_corner"]:
        lines.append("NO corner buttresses at corner(s) {} (1 = +x+y, 2 = -x+y, 3 = -x-y, 4 = +x-y)".format(
            ", ".join(str(c) for c in g["no_corner"])))
    if m["cap"]:
        lines.append("buttress {}: {} beams, ring section {:.0f} x {:.0f} (cap_lines)".format(
            "caps over the whole top (cast solid)" if p["but_cap"] else
            "SEAT: ring tied to the buttress top over {:.0f} only (its width; cast separately)".format(
                min(g["fin_len"], p["ring_w"])), len(m["cap"]), p["ring_w"], p["base_h"]))
    if m["ribs"]:
        lines.append("ribs {:.0f} x {:.0f}: {:.0f} m ({} beams)".format(p["rib_w"], p["rib_d"], g["rib_len"] / 1000, len(m["ribs"])))
        d_e, d_t = float(p["rib_d_eave"] or p["rib_d"]), float(p["rib_d_top"] or p["rib_d"])
        if abs(d_e - p["rib_d"]) > 1.0 or abs(d_t - p["rib_d"]) > 1.0:
            lines.append("TAPERED columns and hips: {:.0f} deep at the eave -> {:.0f} at the top, width {:.0f}; horizontal ribs "
                         "{:.0f} x {:.0f} (wire rib_h / 10 into the rib Cross Sections Height, rib_b / 10 into both "
                         "widths)".format(d_e, d_t, p["rib_w"], p["hring_w"] or p["rib_w"], p["rib_d"]))
    if True:
        lines.append("horizontal ribs at " + (", ".join("+{:.2f}".format(z / 1000) for z in g["levels_a"]) or "none") +
                     " (face centroid at +{:.2f})".format(g["z_g"] / 1000))
    lines.append("concrete m3: " + ", ".join("{} {:.1f}".format(k, v) for k, v in vol.items()) +
                 "; total {:.1f} m3 = {:.0f} kN (+ cladding {:.0f} kN)".format(sum(vol.values()), sum(vol.values()) * gamma,
                                                                             g["roof_area"] / 1e6 * clad))
    lines += ["WARNING: " + w for w in m["warn"]]
    return "\n".join(lines)


def check(m, tol=1.0):
    """every beam end is a shell node, the faces meet on the hips, the walls and roof meet on the ring beam"""
    key = lambda p: tuple(int(round(c / tol)) for c in p)
    roof = set(key(p) for V, _ in m["roof"] for p in V)
    wall = set(key(p) for V, _ in m["wall"] for p in V)
    ring = set(key(p) for a, b in m["ring"] for p in (a, b))
    errs = []
    errs += ["rib end off the roof mesh {}".format(p) for a, b, _ in m["ribs"] for p in (a, b) if key(p) not in roof]
    errs += ["crown ring end off the roof mesh {}".format(p) for a, b in m["crown"] for p in (a, b) if key(p) not in roof]
    but_nodes = set(key(p) for V, _ in m["but"] for p in V)
    errs += ["buttress cap end off the buttress {}".format(p) for a, b in m["cap"] for p in (a, b) if key(p) not in but_nodes]
    z_b = m["geom"]["z_b"]
    # what the roof eave and the buttress tops land on: the ring beam, else the wall top, else (no ring, no walls) the
    # roof itself at the rib feet
    land = ring if m["ring"] else wall if m["wall"] else roof
    what = "ring beam" if m["ring"] else "wall top" if m["wall"] else "roof (rib foot)"
    if m["ring"] or m["wall"]:
        errs += ["roof eave node not on the {} {}".format(what, p) for V, _ in m["roof"] for p in V
                 if abs(p[2] - z_b) < tol and key(p) not in land]
    if m["ring"]:
        errs += ["wall top node not on the ring beam {}".format(p) for V, _ in m["wall"] for p in V
                 if abs(p[2] - z_b) < tol and key(p) not in ring]
    if m["foot"]:
        foot = set(key(p) for a, b in m["foot"] for p in (a, b))
        errs += ["buttress foot not on the footing {}".format(V[0]) for V, _ in m["but"] if key(V[0]) not in foot]
    if m["wall"]:
        errs += ["buttress not attached to the wall {}".format(V[0]) for V, _ in m["but"] if key(V[0]) not in wall]
    else:                                               # no walls: each buttress top must reach the ring / the roof
        errs += ["buttress not attached to the {} {}".format(what, V[0]) for V, _ in m["but"]
                 if not any(abs(pt[2] - z_b) < tol and key(pt) in land for pt in V)]
    caps_on = sum(1 for a, b in m["cap"] if key(a) in land)
    if m["cap"] and caps_on < len(m["but"]):
        errs.append("only {} of {} buttress caps start on the {}".format(caps_on, len(m["but"]), what))
    for k in range(4):                                  # right hip of face k = left hip of face k+1
        on_hip = lambda V: set(key(p) for p in V if abs(abs(p[0]) - abs(p[1])) < tol and p[2] > z_b + tol)
        shared = on_hip(m["roof"][k][0]) & on_hip(m["roof"][(k + 1) % 4][0])
        if len(shared) < 3:
            errs.append("faces {} and {} share only {} hip nodes".format(k, (k + 1) % 4, len(shared)))
    return errs


# =============== Grasshopper glue (runs only inside Rhino) ===============
def _gh_main():
    import Rhino.Geometry as rg
    from Grasshopper import DataTree
    from Grasshopper.Kernel.Data import GH_Path
    G = globals()
    get = lambda k, d: G[k] if G.get(k) is not None else d
    wd, qp, clad = get("wind_dir", 0.0), get("qp", 0.9), get("clad", 0.0)
    gam, fck, kf, fixed = get("gamma", 24.0), get("fck", 30.0), get("kf", 0.7), get("fixed", True)
    out = dict(roof_meshes=[], wall_meshes=[], but_meshes=[], ring_lines=[], crown_lines=[], cap_lines=[], foot_lines=[], rib_lines=[], rib_ids=[], rib_h=[], rib_b=[],
               supports=[], sup_x=[], sup_y=[], wind_vecs=[], wind_walls=[], t_roof_elems=DataTree[object]())
    try:
        m = build_model(**{k: G.get(k) for k in DEFAULTS})
    except ValueError as e:                             # bad slider combination: empty model + the reason, no crash
        out["info"] = "ERROR: {}".format(e)
        G.update(out)
        return
    p, g = m["p"], m["geom"]

    def to_mesh(vf):
        V, F = vf
        me = rg.Mesh()
        for pt in V:
            me.Vertices.Add(*pt)
        for f in F:
            me.Faces.AddFace(*f)
        me.Normals.ComputeNormals(); me.Compact()
        return me
    line = lambda a, b: rg.Line(rg.Point3d(*a), rg.Point3d(*b))
    out["roof_meshes"] = [to_mesh(x) for x in m["roof"]]
    out["wall_meshes"] = [to_mesh(x) for x in m["wall"]]
    out["but_meshes"] = [to_mesh(x) for x in m["but"]]
    out["ring_lines"] = [line(a, b) for a, b in m["ring"]]
    out["crown_lines"] = [line(a, b) for a, b in m["crown"]]
    out["cap_lines"] = [line(a, b) for a, b in m["cap"]]
    out["foot_lines"] = [line(a, b) for a, b in m["foot"]]
    out["foot_b"], out["foot_h"] = p["foot_w"], p["foot_h"]
    out["rib_lines"] = [line(a, b) for a, b, _ in m["ribs"]]
    out["rib_ids"] = [rid for _, _, rid in m["ribs"]]
    out["rib_h"] = list(m["rib_h"])                    # one depth (mm) per rib line, same order
    out["rib_b"] = list(m["rib_b"])                    # one width (mm) per rib line, same order
    out["supports"] = [rg.Point3d(*pt) for pt in m["supports"]]
    out["sup_x"] = [rg.Point3d(*pt) for pt in m["sup_x"]]
    out["sup_y"] = [rg.Point3d(*pt) for pt in m["sup_y"]]
    for i, ts in enumerate(m["t_elems"]):
        out["t_roof_elems"].AddRange(ts, GH_Path(i))
    out["cladding"] = rg.Vector3d(0, 0, -clad)
    # wind acts normal to the surface: pressure (+) pushes onto the face (against the outward normal)
    cr_, cw_ = loads(wd, qp)
    for meshes, cps, key in ((out["roof_meshes"], cr_, "wind_vecs"), (out["wall_meshes"], cw_, "wind_walls")):
        for me, cp in zip(meshes, cps):
            v = rg.Vector3d(me.FaceNormals[0]); v.Unitize(); v *= -cp * qp
            out[key].append(v)
    rs, ws = g["roof_sec"], g["wall_sec"]
    out["t_roof"], out["t_wall"], out["t_but"], out["t_build"] = rs["t"], ws["t"], p["but_w"], rs["total"]
    out["ring_b"], out["ring_h"] = p["ring_w"], p["base_h"]
    out["crown_b"], out["crown_h"] = p["crown_b"], p["crown_h"]
    out["rib_w"], out["rib_d"] = p["rib_w"], p["rib_d"]
    out["gamma_roof"] = gam * g["gamma_ratio_roof"]
    out["gamma_wall"] = gam * g["gamma_ratio_wall"]
    out["rise"], out["slope"] = g["rise"], g["slope"]
    out["concrete"] = sum(g["vol"].values())
    out["weight"] = out["concrete"] * gam
    E = 22 * ((fck + 8) / 10) ** 0.3 * kf * 100                   # kN/cm2, EC2 Ecm, knocked down
    fc = fck / 1.5 * kf / 10                                      # kN/cm2, printed
    for key, sec in (("roof", rs), ("wall", ws)):                 # equivalent shells: E and strengths x A / t
        out["E_" + key] = E * sec["ratio"]
        out["G_" + key] = E * sec["ratio"] / 2.4
        out["fc_" + key] = -fc * sec["ratio"]                     # Karamba wants fc negative
        out["ft_" + key] = 0.0                                    # printed layers: take no tension
    if not p["shell_structural"] and not p["skin_check"]:          # casing only: keeps its weight, gives no strength
        out["E_roof"], out["G_roof"] = E * rs["ratio"] / 1000.0, E * rs["ratio"] / 2400.0
    if p["skin_check"]:                                           # buckling check: the roof shell = ONE real skin
        out["t_roof"] = p["bead"]                                 # (full printed E), carrying the whole roof weight
        out["E_roof"], out["G_roof"], out["fc_roof"] = E, E / 2.4, -fc
        out["gamma_roof"] = gam * rs["solid"] / p["bead"]
        out["t_roof_elems"] = DataTree[object]()
        for i, ts in enumerate(m["t_elems"]):
            out["t_roof_elems"].AddRange([p["bead"]] * len(ts), GH_Path(i))
    out["material"] = ("printed (Ecm x kf = {:.0f} kN/cm2, fc {:.2f} kN/cm2) as equivalent shells: roof E {:.0f}, G {:.0f}, "
                       "fc {:.3f}, gamma {:.2f}; wall E {:.0f}, G {:.0f}, fc {:.3f}, gamma {:.2f} (kN/cm2, kN/m3), ft 0. "
                       "Ribs, ring beam, crown ring and buttresses are cast: full gamma {:g} kN/m3".format(
                           E, fc, out["E_roof"], out["G_roof"], out["fc_roof"], out["gamma_roof"],
                           out["E_wall"], out["G_wall"], out["fc_wall"], out["gamma_wall"], gam))
    errs = check(m)
    out["info"] = summary(m, gam, clad) + "\nfixed supports: {}, wind {} deg, qp {} kN/m2".format(fixed, wd, qp) + (
        "\nWARNING: " + "; ".join(errs[:5]) if errs else "")
    G.update(out)


try:
    import Rhino                      # inside Grasshopper (__name__ is "__main__" there too, so test for Rhino instead)
    _gh_main()
except ImportError:
    if __name__ == "__main__":
        for gname in ("A",):
            mm = build_model()
            print(summary(mm))
            errs = check(mm)
            print("connectivity: " + ("OK" if not errs else "{} problems, e.g. {}".format(len(errs), errs[:3])))
            print()
# ---------- end py3 ----------
number_slider = Slider(10, range=0..10)
panel = Panel(py3.info)
division = Division(A=py3.t_roof, B=number_slider)
division_2 = Division(A=py3.t_wall, B=number_slider)
division_3 = Division(A=py3.t_but, B=number_slider)
division_4 = Division(A=py3.ring_b, B=number_slider)
division_5 = Division(A=py3.ring_h, B=number_slider)
division_6 = Division(A=py3.rib_b, B=number_slider)
division_7 = Division(A=py3.crown_h, B=number_slider)
division_8 = Division(A=py3.crown_b, B=number_slider)
division_9 = Division(A=py3.rib_h, B=number_slider)
division_10 = Division(A=py3.foot_b, B=number_slider)
division_11 = Division(A=py3.foot_h, B=number_slider)
panel_2 = Panel(division_6)
line = Line()
types = QueryTypes(Kind=3, FamilyName="M_Concrete-Rectangular Beam")
graphical_element = GraphicalElement(<familyinstance referenced from the Revit model>)
item = ListItem(Index="0", Wrap=True)
location = ElementLocation(Element=graphical_element)  # -> Element, Location, Hand, Facing, WorkPlane
duplicate = DuplicateType(TypeName="Ring beam - GH", Type=item, TrackingMode=2)
orient = Orient(Geometry=py3.ring_lines, Source=PlaneXY(0, 0, 0), Target=PlaneXY(0, 0, 0))  # -> Geometry, Transform
isotrop = MaterialPropertiesKaramba3D(
    FamilyOfMaterial="Concrete",
    Name="printed-roof",
    YoungsModulus_kN_cm²=py3.E_roof,
    InPlaneShearModulus_kN_cm²=py3.G_roof,
    TransverseShearModulus_kN_cm²=py3.G_roof,
    SpecificWeight_kN_m³=py3.gamma_roof,
    CoefficientOfThermalExpansion_1=1.2e-05,
    TensileStrength_kN_cm²=py3.ft_roof,
    CompressiveStrength_kN_cm²=py3.fc_roof,
    StrengthHypothesis=Slider(2, range=0..10),
    mode="Isotrop")
isotrop_2 = MaterialPropertiesKaramba3D(
    FamilyOfMaterial="Concrete",
    Name="cast",
    YoungsModulus_kN_cm²=Slider(3280, range=0..10000),
    InPlaneShearModulus_kN_cm²=Slider(1367, range=0..20000),
    TransverseShearModulus_kN_cm²=Slider(1367, range=0..20000),
    SpecificWeight_kN_m³=Slider(24, range=0..100),
    CoefficientOfThermalExpansion_1=1.2e-05,
    TensileStrength_kN_cm²=Slider(0.29, range=0..100),
    CompressiveStrength_kN_cm²=Slider(-2, range=-10..10),
    StrengthHypothesis=Slider(2, range=0..10),
    mode="Isotrop")
isotrop_3 = MaterialPropertiesKaramba3D(
    FamilyOfMaterial="Concrete",
    Name="printed-wall",
    YoungsModulus_kN_cm²=py3.E_wall,
    InPlaneShearModulus_kN_cm²=py3.G_wall,
    TransverseShearModulus_kN_cm²=py3.G_wall,
    SpecificWeight_kN_m³=py3.gamma_wall,
    CoefficientOfThermalExpansion_1=1.2e-05,
    TensileStrength_kN_cm²=py3.ft_wall,
    CompressiveStrength_kN_cm²=py3.fc_wall,
    StrengthHypothesis=Slider(2, range=0..10),
    mode="Isotrop")
s_beam = AddStructuralBeam(Curve=orient.Geometry, Type=duplicate, TrackingMode=2)
param = ElementParameter(Element=duplicate, Parameter="h", Value=[py3.ring_b, py3.ring_h])  # -> Element, Value
param_2 = ElementParameter(Element=duplicate, Parameter="b", Value=py3.ring_b)  # -> Element, Value
trapezoid = CrossSectionKaramba3D(
    FamilyNameOfCrossSection="DefaultCroSec",
    NameOfCrossSection="crown",
    Material=isotrop_2,
    Height_cm=division_7,
    UpperFlangeWidth_cm=division_8,
    LowerFlangeWidth_cm=division_8,
    mode="Trapezoid")
shell_const = CrossSectionKaramba3D(
    FamilyNameOfCrossSection="DefaultCroSec",
    NameOfCrossSection="wall",
    Material=isotrop_3,
    Height_cm=division_2,
    mode="Shell - Const")
trapezoid_2 = CrossSectionKaramba3D(
    FamilyNameOfCrossSection="DefaultCroSec",
    NameOfCrossSection="ring",
    Material=isotrop_2,
    Height_cm=division_5,
    UpperFlangeWidth_cm=division_4,
    LowerFlangeWidth_cm=division_4,
    mode="Trapezoid")
trapezoid_3 = CrossSectionKaramba3D(
    FamilyNameOfCrossSection="DefaultCroSec",
    NameOfCrossSection="footing",
    Material=isotrop_2,
    Height_cm=division_11,
    UpperFlangeWidth_cm=division_10,
    LowerFlangeWidth_cm=division_10,
    mode="Trapezoid")
shell_const_2 = CrossSectionKaramba3D(
    FamilyNameOfCrossSection="DefaultCroSec",
    NameOfCrossSection="roof",
    Material=isotrop,
    Height_cm=division,
    mode="Shell - Const")
shell_const_3 = CrossSectionKaramba3D(
    FamilyNameOfCrossSection="DefaultCroSec",
    NameOfCrossSection="but",
    Material=isotrop_2,
    Height_cm=division_3,
    mode="Shell - Const")
trapezoid_4 = CrossSectionKaramba3D(
    FamilyNameOfCrossSection="DefaultCroSec",
    NameOfCrossSection="rib",
    Material=isotrop_2,
    Height_cm=division_9,
    UpperFlangeWidth_cm=division_6,
    LowerFlangeWidth_cm=division_6,
    mode="Trapezoid")
linetobeam = CreateLinearElementKaramba3D(
    Line=py3.cap_lines,
    Identifier="cap",
    CrossSection=trapezoid_2,
    LimitDistance_m=0.005,
    BucklingLengthY_m=-1,
    BucklingLengthZ_m=-1,
    BucklingLengthLT_m=-1,
    Bending=True,
    ToPolylineMaxAngle=0.25,
    ToPolylineTolerance=0.1,
    ToPolylineMaxEdgeLength=0.25,
    New=True,
    Remove=True,
    mode="LineToBeam",
    GuidGeneratorSeed=470140330)  # -> Element, Points, Info
mtoshell = CreateSurfaceElementKaramba3D(
    Mesh=py3.roof_meshes,
    Identifier="roof",
    CrossSection=shell_const_2,
    LimitDistance_m=0.005,
    Bending=True,
    mode="MeshToShell",
    GuidGeneratorSeed=-853798406)  # -> Element, Points, Info
mtoshell_2 = CreateSurfaceElementKaramba3D(
    Mesh=py3.but_meshes,
    Identifier="but",
    CrossSection=shell_const_3,
    LimitDistance_m=0.005,
    Bending=True,
    mode="MeshToShell",
    GuidGeneratorSeed=-1696814906)  # -> Element, Points, Info
linetobeam_2 = CreateLinearElementKaramba3D(
    Line=py3.ring_lines,
    Identifier="ring",
    CrossSection=trapezoid_2,
    LimitDistance_m=0.005,
    BucklingLengthY_m=-1,
    BucklingLengthZ_m=-1,
    BucklingLengthLT_m=-1,
    Bending=True,
    ToPolylineMaxAngle=0.25,
    ToPolylineTolerance=0.1,
    ToPolylineMaxEdgeLength=0.25,
    New=True,
    Remove=True,
    mode="LineToBeam",
    GuidGeneratorSeed=1782050581)  # -> Element, Points, Info
linetobeam_3 = CreateLinearElementKaramba3D(
    Line=py3.crown_lines,
    Identifier="crown",
    CrossSection=trapezoid,
    LimitDistance_m=0.005,
    BucklingLengthY_m=-1,
    BucklingLengthZ_m=-1,
    BucklingLengthLT_m=-1,
    Bending=True,
    ToPolylineMaxAngle=0.25,
    ToPolylineTolerance=0.1,
    ToPolylineMaxEdgeLength=0.25,
    New=True,
    Remove=True,
    mode="LineToBeam",
    GuidGeneratorSeed=-1366808206)  # -> Element, Points, Info
mtoshell_3 = CreateSurfaceElementKaramba3D(
    Mesh=py3.wall_meshes,
    Identifier="wall",
    CrossSection=shell_const,
    LimitDistance_m=0.005,
    Bending=True,
    mode="MeshToShell",
    GuidGeneratorSeed=463544955)  # -> Element, Points, Info
linetobeam_4 = CreateLinearElementKaramba3D(
    Line=py3.rib_lines,
    Identifier=py3.rib_ids,
    CrossSection=trapezoid_4,
    LimitDistance_m=0.005,
    BucklingLengthY_m=-1,
    BucklingLengthZ_m=-1,
    BucklingLengthLT_m=-1,
    Bending=True,
    ToPolylineMaxAngle=0.25,
    ToPolylineTolerance=0.1,
    ToPolylineMaxEdgeLength=0.25,
    New=True,
    Remove=True,
    mode="LineToBeam",
    GuidGeneratorSeed=-1850475895)  # -> Element, Points, Info
linetobeam_5 = CreateLinearElementKaramba3D(
    Line=py3.foot_lines,
    Identifier="footing",
    CrossSection=trapezoid_3,
    LimitDistance_m=0.005,
    BucklingLengthY_m=-1,
    BucklingLengthZ_m=-1,
    BucklingLengthLT_m=-1,
    Bending=True,
    ToPolylineMaxAngle=0.25,
    ToPolylineTolerance=0.1,
    ToPolylineMaxEdgeLength=0.25,
    New=True,
    Remove=True,
    mode="LineToBeam",
    GuidGeneratorSeed=802408449)  # -> Element, Points, Info

supp = SupportKaramba3D(PosInd=py3.sup_x, Ct_kN_m=Vector(0, 0, 0), Cr_kNm_rad=Vector(0, 0, 0), menu=[buttons(on, off, on, off, off, off)])
supp_2 = SupportKaramba3D(PosInd=py3.supports, Ct_kN_m=Vector(0, 0, 0), Cr_kNm_rad=Vector(0, 0, 0), menu=[buttons(on, on, on, off, off, off)])
supp_3 = SupportKaramba3D(PosInd=py3.sup_y, Ct_kN_m=Vector(0, 0, 0), Cr_kNm_rad=Vector(0, 0, 0), menu=[buttons(off, on, on, off, off, off)])

# ---- group: Loads (Karamba3D)
meshload_const = LoadsKaramba3D(
    Vector=py3.wind_walls,
    Mesh=py3.wall_meshes,
    LCase="W",
    MinimumLineLoadLength_m=0.5,
    mode="MeshLoad -Const.",
    menu=[buttons(off, on, off), buttons(on, off)])

gravity = LoadsKaramba3D(Vector=Vector(0, 0, -1), LCase="G", mode="Gravity")

meshload_const_2 = LoadsKaramba3D(
    Vector=py3.wind_vecs,
    Mesh=py3.roof_meshes,
    LCase="W",
    MinimumLineLoadLength_m=0.5,
    mode="MeshLoad -Const.",
    menu=[buttons(off, on, off), buttons(on, off)])

meshload_const_3 = LoadsKaramba3D(
    Vector=py3.cladding,
    Mesh=py3.roof_meshes,
    LCase="G",
    MinimumLineLoadLength_m=0.5,
    mode="MeshLoad -Const.",
    menu=[buttons(off, on, off), buttons(on, off)])

# ----
panel_3 = Panel("""LONG = 1.0 * G
SHORT = 1.0 * G + 1.0 * W""")
lccombinator = LoadCaseCombinatorKaramba3D(LoadCaseCombinationRulesKaramba3D=panel_3)  # -> LoadCaseCombinations, NamesOfLoadCases, NumberOfLoadCases

# ---- group: Assemble Model (Karamba3D)
assemble = AssembleModelKaramba3D(
    Elem=flatten([mtoshell.Element, mtoshell_3.Element, mtoshell_2.Element, linetobeam_2.Element, linetobeam_3.Element, linetobeam_4.Element, linetobeam_5.Element, linetobeam.Element]),
    Support=flatten([supp_2, supp, supp_3]),
    Load=flatten([gravity, meshload_const_3, meshload_const_2, meshload_const, lccombinator.LoadCaseCombinations]),
    LimitDistance_mm=0.005)  # -> Model, Info, Mass_kg, CentreOfGravity, LoadCaseNames

# ----
panel_4 = Panel(assemble.Mass_kg)
panel_5 = Panel(assemble.LoadCaseNames)

# ---- group: Analyse (Karamba3D)
analyse = AnalyseKaramba3D(Model=assemble.Model)  # -> AnalysedModel, MaximumDisplacement_cm, ResultingForce_kN, ChangeOfElasticEnergy_kNm

# ----
react = ReactionForcesKaramba3D(AnalysedModel=analyse.AnalysedModel, LoadCase="SHORT")  # -> Model, ReactionForces_kN, ReactionMoments_kNm, SupportPosition, SumOfReactionForces_kN, SumOfReactionMoments_kNm, GoverningLoadCaseIndex
panel_6 = Panel("""ring
hring
crown
col
hip
cap
footing""")
b_forces = BeamForcesKaramba3D(AnalysedModel=analyse.AnalysedModel, BeamsIdentifiers=graft(panel_6), LoadCase="SHORT", Ts=[0, 1])  # -> Model, NormalForce_kN, ShearForceVz_kN, ShearForceVy_kN, TorsionalMomentMt_kNm, BendingMomentMy_kNm, BendingMomentMz_kNm, LoadCaseIndex
panel_7 = Panel(react.SumOfReactionForces_kN)
devec = DeconstructVector(Vector=react.ReactionForces_kN)  # -> XComponent, YComponent, ZComponent
trim = TrimTree(Tree=b_forces.NormalForce_kN, Depth=1)
trim_2 = TrimTree(Tree=b_forces.TorsionalMomentMt_kNm, Depth=1)
trim_3 = TrimTree(Tree=b_forces.ShearForceVz_kN, Depth=1)
trim_4 = TrimTree(Tree=b_forces.ShearForceVy_kN, Depth=1)
trim_5 = TrimTree(Tree=b_forces.BendingMomentMy_kNm, Depth=1)
trim_6 = TrimTree(Tree=b_forces.BendingMomentMz_kNm, Depth=1)
bnd = Bounds(Numbers=flatten(devec.XComponent))
bnd_2 = Bounds(Numbers=flatten(devec.YComponent))
bnd_3 = Bounds(Numbers=flatten(devec.ZComponent))
bnd_4 = Bounds(Numbers=trim_5)
bnd_5 = Bounds(Numbers=trim_6)
bnd_6 = Bounds(Numbers=trim)
bnd_7 = Bounds(Numbers=trim_3)
bnd_8 = Bounds(Numbers=trim_4)
bnd_9 = Bounds(Numbers=trim_2)
panel_8 = Panel(bnd)
panel_9 = Panel(bnd_2)
panel_10 = Panel(bnd_3)
entwine = Entwine(Branch01=bnd_6, Branch02=bnd_7, Branch03=bnd_8, Branch04=bnd_9, Branch05=bnd_4, Branch06=bnd_5, FlattenInputs=True)
panel_11 = Panel(entwine)

panel_12 = Panel("roof")
panel_13 = Panel("footing")
panel_14 = Panel("cap")
panel_15 = Panel("hring")
panel_16 = Panel("crown")
panel_17 = Panel("col")
panel_18 = Panel("hip")
panel_19 = Panel("ring")

# ---- group: Model View (Karamba3D)
modelview = ModelViewKaramba3D(Model=analyse.AnalysedModel, LoadCase="SHORT", ViewSelection="but")  # -> Model, DeformedMesh, DeformedAxes, DeformedModel, MaximumDeformation

modelview_2 = ModelViewKaramba3D(Model=analyse.AnalysedModel, LoadCase="SHORT")  # -> Model, DeformedMesh, DeformedAxes, DeformedModel, MaximumDeformation

modelview_3 = ModelViewKaramba3D(Model=analyse.AnalysedModel, LoadCase="LONG", ViewSelection="hring")  # -> Model, DeformedMesh, DeformedAxes, DeformedModel, MaximumDeformation

# ---- group: Shell View (Karamba3D)
shellview = ShellViewKaramba3D(Model=modelview.Model, IndexOfLayer=0)  # -> Model, MeshesOfRenderedShells, LegendColours, LegendTags

# ---- group: Beam View (Karamba3D)
beamview = BeamViewKaramba3D(Model=modelview_3.Model)  # -> Model, MeshesOfRenderedBeams, DeformedBeamAxes, LegendColours, LegendTags

# ---- group: Shell View (Karamba3D)
shellview_2 = ShellViewKaramba3D(Model=modelview_2.Model, IndexOfLayer=0)  # -> Model, MeshesOfRenderedShells, LegendColours, LegendTags

# ----
legend = LegendKaramba3D(
    Colors=shellview.LegendColours,
    Tags=shellview.LegendTags,
    Scale=0.8,
    Textsize=30,
    Legend_HasHeader=False,
    Legend_Justification=2,
    Legend_Position=2)
legend_2 = LegendKaramba3D(
    Colors=beamview.LegendColours,
    Tags=beamview.LegendTags,
    Scale=0.8,
    Textsize=30,
    Legend_HasHeader=False,
    Legend_Justification=2,
    Legend_Position=2)
legend_3 = LegendKaramba3D(
    Colors=shellview_2.LegendColours,
    Tags=shellview_2.LegendTags,
    Scale=0.8,
    Textsize=30,
    Legend_HasHeader=False,
    Legend_Justification=2,
    Legend_Position=2)

# ---- group: Beam View (Karamba3D)
beamview_2 = BeamViewKaramba3D(Model=shellview_2.Model)  # -> Model, MeshesOfRenderedBeams, DeformedBeamAxes, LegendColours, LegendTags

# ---- group: AnalyseThII (Karamba3D)
analysethii = AnalyseThIIKaramba3D(
    Model=assemble.Model,
    LoadCases="SHORT",
    UseInitialNII=True,
    NIIFromCombination=True,
    NoTensionalNII=False,
    NoCompressiveNII=False,
    RTolerance=1e-07,
    MaxIterations=50)  # -> AnalysedModel, MaximumDisplacement_cm, ResultingForce_kN, ChangeOfElasticEnergy_kNm

# ----
buckling_modes = BucklingModesKaramba3D(
    Model=analysethii.AnalysedModel,
    FromIndex=1,
    NumberOfModes=Slider(3, range=0..10),
    MaximumNumberOfIterations=300,
    Epsilon=1e-07)  # -> ModelWithBucklingModes, BucklingLoadFactors
panel_20 = Panel(buckling_modes.BucklingLoadFactors)
