# Grasshopper definition fig1-hourglass.gh (Grasshopper 1.0.8)
# plug-ins: PolyFrame 2

# ---- group: Fig.1(a) Akbari et al. IASS 2019: force = hex prism + inner bipyramid (left), form = hourglass (right)
force_cells_hex_prism_30_tets = Brep([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])
pfbuild = PFBuild(Brep=flatten(force_cells_hex_prism_30_tets), AbsoluteTolerance=0.1, PlanarityTolerance=0.1)  # -> ForcePFoam, FormPFoam
scale = Slider(25, range=1..50)
algebraic_dual = AlgebraicDual(ForcePFoam=pfbuild.ForcePFoam, Scale=scale, Flip=False, displayIndex=False, rcond=9.999999747e-06)  # -> AlgebraicForm, AlgebraicForce, FormPFoam
form_offset_x = Slider(160, range=0..300)
X = UnitX(Factor=form_offset_x)
form_a = PFMove(PFoam=algebraic_dual.FormPFoam, Vector=X)
force_offset_x = Slider(0, range=-300..0)
X_2 = UnitX(Factor=force_offset_x)
force_a = PFMove(PFoam=pfbuild.ForcePFoam, Vector=X_2)
