# Grasshopper definition friend-12-feet-2m-corners-opentop.gh (Grasshopper 1.0.8)
# plug-ins: PolyFrame 2

# ---- group: 1 Play here
# GUESS - read me: GUESSED force diagram (not the friend's file). 12 FEET: 2 m from each corner + mid-side, CORNERS FREE (about 1.4 m overhang on the diagonal), OPEN TOP, re-found for an EVEN casing load (6 rounds). Irregular 12-gon cap whose edge normals aim at the feet; crown = fan -> one horizontal crown ring (to be cast); 4 rings on circles; diamond cells, outer band mirrored about each foot; one point below = cone depth (Scale Z). Stage A pins the 4 mid-side feet (exact). Stage B pulls all 12 feet onto their target points and runs PFPerp. The roof edge between the two near-corner feet curves in; it does NOT reach the plan corner (net reaches 5.64 m of 7.07 m on the diagonal).
branching_preset_guess = ValueList({"12 feet 2 m from corners + mid-side, corners free, open top, even casing load (Scale Z 0.365)": 0}, selected="12 feet 2 m from corners + mid-side, corners free, open top, even casing load (Scale Z 0.365)")
force_depth_scale_z = Slider(0.365, range=0.2..1.5)
plan_side_mm = Slider(10000, range=4000..16000)
ref_apex_mm = Slider(6670, range=1000..12000)

# ---- group: 2 Force diagram - GUESS diagrid, mirror-symmetric (PolyFrame build)
force_diagram_presets_guess = ForceDiagramPresetsGUESS(P=branching_preset_guess, Z=force_depth_scale_z)  # -> G, G_2
plan_wall_reference = PlanWallReference(A=plan_side_mm, Z=ref_apex_mm)  # -> L, L_2, R, V, E
pfbuild = PFBuild(Brep=flatten(force_diagram_presets_guess.G), AbsoluteTolerance=0.1, PlanarityTolerance=0.1)  # -> ForcePFoam, FormPFoam
support_ids = SupportIDs(pfoam=pfbuild.ForcePFoam, P=force_diagram_presets_guess.G_2)

# ---- group: 3 Stage A - exact algebraic, 4 mid-side feet pinned (shown left)
algebraic_dual = AlgebraicDual(ForcePFoam=pfbuild.ForcePFoam, Scale=1, Flip=False, displayIndex=False, rcond=9.999999747e-06)  # -> AlgebraicForm, AlgebraicForce, FormPFoam
cull = CullPattern(List=flatten(support_ids), CullPattern=[False, True, False])
algebraic_vertex_constraints = AlgebraicVertexConstraints(
    AlgebraicForm=algebraic_dual.AlgebraicForm,
    PFVertexIDs=cull,
    Constraints=plan_wall_reference.L,
    Scale=1,
    rcond=9.999999747e-06)  # -> AlgebraicForm, PFoam
pfpipe = PFPipe(PFoam=algebraic_vertex_constraints.PFoam, MinR=40, MaxR=120)  # -> Axes, Radius, Color, Pipe, Force
colour_by_force = ColourByForce(N=pfpipe.Force)
move = Move(Geometry=pfpipe.Pipe, Motion=plan_wall_reference.V)  # -> Geometry, Transform
preview = CustomPreview(Geometry=move.Geometry, Material=colour_by_force)
check = Check(pfoam=algebraic_vertex_constraints.PFoam, M=support_ids, C=plan_wall_reference.R)  # -> I, I_2, am, I_3, am_2
stage_a_forces_dev_range_mean_dev_feet_t = Panel([check.I, check.I_2, check.am, check.I_3, check.am_2])  # "Stage A: forces | dev range | mean dev | feet-to-wall range | mean"

# ---- group: 4 Stage B - pull all 12 feet onto their target points, PFPerp
pfperp_iterations = Slider(300, range=0..3000)
pull_strength = Slider(10, range=0..100)
pfvertex_constraints = PFVertexConstraints(
    PFoam=algebraic_vertex_constraints.PFoam,
    PFVertexID=support_ids,
    Constraint=plan_wall_reference.L_2,
    Coefficient=pull_strength,
    On=True)
pfperp = PFPerp(PFoam=pfvertex_constraints, MaxIteration=pfperp_iterations, Deviation=0.1, MinimumEdgeLength=10)  # -> PFoam, Deviation
pfpipe_2 = PFPipe(PFoam=pfperp.PFoam, MinR=40, MaxR=120)  # -> Axes, Radius, Color, Pipe, Force
colour_by_force_2 = ColourByForce(N=pfpipe_2.Force)
preview_2 = CustomPreview(Geometry=pfpipe_2.Pipe, Material=colour_by_force_2)
check_2 = Check(pfoam=pfperp.PFoam, M=support_ids, C=plan_wall_reference.R)  # -> I, I_2, am, I_3, am_2
preview_3 = CustomPreview(Geometry=plan_wall_reference.E, Material=ColourSwatch(SwatchColor=RGBA(150, 150, 150, 70)))
stage_b_forces_dev_range_mean_dev_feet_t = Panel([check_2.I, check_2.I_2, check_2.am, check_2.I_3, check_2.am_2])  # "Stage B: forces | dev range | mean dev | feet-to-wall range | mean"

# ==== cluster ForceDiagramPresetsGUESS: GUESSED force diagram (not the friend's): irregular 12-gon cap whose edge normals point at the 12 feet (2 m from each corner and mid-side), diamond (diagrid) cells between half-offset circular rings, crown = fan -> horizontal crown ring (open top), outer band mirrored about each foot, joined to one point below; ring radii re-found for an even casing load. Scale Z = cone depth.
cells_presets = Brep([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])
reaction_cell_centroids = Point([Point(-331.8915038, -570.4580643, -250), Point(0, -659.9205245, -250), Point(331.8915038, -570.4580643, -250), Point(570.4580643, -331.8915038, -250), Point(659.9205245, 0, -250), Point(570.4580643, 331.8915038, -250), Point(331.8915038, 570.4580643, -250), Point(0, 659.9205245, -250), Point(-331.8915038, 570.4580643, -250), Point(-570.4580643, 331.8915038, -250), Point(-659.9205245, 0, -250), Point(-570.4580643, -331.8915038, -250)])
P = ClusterInput()
Z = ClusterInput()
branch = TreeBranch(Tree=cells_presets, Path=P, MaintainPaths=True)
branch_2 = TreeBranch(Tree=reaction_cell_centroids, Path=P, MaintainPaths=True)
scale_nu = ScaleNU(Geometry=branch, Plane=PlaneXY(0, 0, 0), ScaleX=1, ScaleY=1, ScaleZ=Z)  # -> Geometry, Transform
scale_nu_2 = ScaleNU(Geometry=branch_2, Plane=PlaneXY(0, 0, 0), ScaleX=1, ScaleY=1, ScaleZ=Z)  # -> Geometry, Transform
G = ClusterOutput(scale_nu.Geometry)
G_2 = ClusterOutput(scale_nu_2.Geometry)

# ==== cluster PlanWallReference: Square plan: 12 foot targets (side/5 from each corner + mid-side), 4 mid-side points, wall line, grey reference pyramid
A = ClusterInput()
Z = ClusterInput()
division = Division(A=A, B=-2)
pt = ConstructPoint(XCoordinate=division, YCoordinate=division, ZCoordinate=0)
rectangle = Rectangle(Plane=pt, XSize=A, YSize=A, Radius=0)  # -> Rectangle, Length
divide = DivideCurve(Curve=rectangle.Rectangle, Count=40, Kinks=False)  # -> Points, Tangents, Parameters
cull = CullPattern(List=divide.Points, CullPattern=[True, False, False, False, False, False, False, False, False, False])
cull_2 = CullPattern(List=divide.Points, CullPattern=[False, False, True, False, False, True, False, False, True, False])
cull_3 = CullPattern(List=cull_2, CullPattern=[False, True, False])
dup = DuplicateData(Data=rectangle.Rectangle, Number=16, Order=True)
multiplication = Multiplication(A=A, B=-1.4)
X = UnitX(Factor=multiplication)
pline = PolyLine(Vertices=cull, Closed=True)
boundary = BoundarySurfaces(Edges=pline)
pt_2 = ConstructPoint(XCoordinate=0, YCoordinate=0, ZCoordinate=Z)
extr = ExtrudePoint(Base=boundary, Point=pt_2)
L = ClusterOutput(cull_3)
L_2 = ClusterOutput(cull_2)
R = ClusterOutput(rectangle.Rectangle)
V = ClusterOutput(X)
E = ClusterOutput(extr)

# ==== cluster SupportIDs: Form vertices (= force cells) carrying the 12 reactions, in wall order: near-corner, mid, near-corner, ...
pfoam = ClusterInput()
P = ClusterInput()
explode_pfoam = ExplodePFoam(PFoam=pfoam)  # -> PFVertices, PFEdges, PFFaces, PFCells
inspect_pfcell = InspectPFCell(PFCell=explode_pfoam.PFCells)  # -> ID, Mesh, Centroid, External, PFVertices, PFEdges, PFFaces, Dual
cps = ClosestPoints(Point=P, Cloud=inspect_pfcell.Centroid, Count=1)  # -> ClosestPoint, CPIndex, Distance
item = ListItem(List=inspect_pfcell.ID, Index=flatten(cps.CPIndex), Wrap=True)
i = ClusterOutput(item)

# ==== cluster ColourByForce: Blue = low compression, red = high (PFPipe force magnitude)
N = ClusterInput()
bnd = Bounds(Numbers=N)
remap = RemapNumbers(Value=N, Source=bnd, Target=Domain(0, 1))  # -> Mapped, Clipped
gradient = Gradient(
    LowerLimit=0,
    UpperLimit=1,
    Parameter=remap.Mapped,
    stops=[0: RGB(40, 90, 220), 0.5: RGB(150, 90, 200), 1: RGB(220, 40, 40)])
C = ClusterOutput(gradient)

# ==== cluster Check: Bar force range (+ = compression), deviation of bars from their force faces, distance of the 12 feet to the wall line
pfoam = ClusterInput()
M = ClusterInput()
C = ClusterInput()
explode_pfoam = ExplodePFoam(PFoam=pfoam)  # -> PFVertices, PFEdges, PFFaces, PFCells
separate_pfedges_by_type = SeparatePFEdgesByType(PFEdge=explode_pfoam.PFEdges)  # -> Internal, Force, External
inspect_pfedge = InspectPFEdge(PFEdge=separate_pfedges_by_type.Internal)  # -> ID, Line, External, Force, PFVertices, PPFFaces, Dual, Pair
bnd = Bounds(Numbers=inspect_pfedge.Force)
end = EndPoints(Curve=inspect_pfedge.Line)  # -> Start, End
vec2pt = Vector2Pt(PointA=end.Start, PointB=end.End, Unitize=False)  # -> Vector, Length
inspect_pfface = InspectPFFace(PFFace=inspect_pfedge.Dual)  # -> ID, Mesh, External, Area, Plane, PFVertices, PFEdges, PFCell, Dual, Pair
deplane = DeconstructPlane(Plane=inspect_pfface.Plane)  # -> Origin, XAxis, YAxis, ZAxis
angle = Angle(VectorA=vec2pt.Vector, VectorB=deplane.ZAxis)  # -> Angle, Reflex
deg = Degrees(Radians=angle.Angle)
subtraction = Subtraction(A=deg, B=90)
abs = Absolute(Value=subtraction)
subtraction_2 = Subtraction(A=90, B=abs)
bnd_2 = Bounds(Numbers=subtraction_2)
avr = Average(Input=subtraction_2)
inspect_pfvertex = InspectPFVertex(PFVertex=explode_pfoam.PFVertices)  # -> ID, Point, External, PFEdges, PFFaces, Dual
mindex = MemberIndex(Set=inspect_pfvertex.ID, Member=M)  # -> Index, Count
item = ListItem(List=inspect_pfvertex.Point, Index=flatten(mindex.Index), Wrap=True)
crv_cp = CurveClosestPoint(Point=item, Curve=C)  # -> Point, Parameter, Distance
bnd_3 = Bounds(Numbers=crv_cp.Distance)
avr_2 = Average(Input=crv_cp.Distance)
I = ClusterOutput(bnd)
I_2 = ClusterOutput(bnd_2)
am = ClusterOutput(avr)
I_3 = ClusterOutput(bnd_3)
am_2 = ClusterOutput(avr_2)
