# Grasshopper definition friend-15-pyramid-branches-atbase-finalforce.gh (Grasshopper 1.0.8)
# plug-ins: PolyFrame 2

# ---- group: 1 Play here
branching_preset_guess = ValueList({"12 feet 2 m from corners + mid-side, corners free, open top, even casing load (Scale Z 0.365)": 0}, selected="12 feet 2 m from corners + mid-side, corners free, open top, even casing load (Scale Z 0.365)")
force_depth_scale_z = Slider(0.365, range=0.2..1.5)
plan_side_mm = Slider(10000, range=4000..16000)
# GUESS - read me: GUESSED force diagram (not the friend's file). 12 FEET: 2 m from each corner + mid-side, CORNERS FREE (about 1.4 m overhang on the diagonal), OPEN TOP, re-found for an EVEN casing load (6 rounds). Irregular 12-gon cap whose edge normals aim at the feet; crown = fan -> one horizontal crown ring (to be cast); 4 rings on circles; diamond cells, outer band mirrored about each foot; one point below = cone depth (Scale Z). Stage A pins the 4 mid-side feet (exact). Stage B pulls all 12 feet onto their target points and runs PFPerp. The roof edge between the two near-corner feet curves in; it does NOT reach the plan corner (net reaches 5.64 m of 7.07 m on the diagonal).
ref_apex_mm = Slider(6670, range=1000..12000)

# ---- group: 2 Force diagram - GUESS diagrid, mirror-symmetric (PolyFrame build)
force_diagram_presets_guess = ForceDiagramPresetsGUESS(P=branching_preset_guess, Z=force_depth_scale_z)  # -> G, G_2
plan_wall_reference = PlanWallReference(A=plan_side_mm, Z=ref_apex_mm)  # -> L, L_2, R, V, E
pfbuild = PFBuild(Brep=flatten(force_diagram_presets_guess.G), AbsoluteTolerance=0.1, PlanarityTolerance=0.1)  # -> ForcePFoam, FormPFoam
support_ids = SupportIDs(pfoam=pfbuild.ForcePFoam, P=force_diagram_presets_guess.G_2)

# ---- group: 3 Stage A - exact algebraic, 4 mid-side feet pinned (shown left)
algebraic_dual = AlgebraicDual(ForcePFoam=pfbuild.ForcePFoam, Scale=1, Flip=False, displayIndex=False, rcond=9.999999747e-06)  # -> AlgebraicForm, AlgebraicForce, FormPFoam
cull = CullPattern(List=flatten(support_ids), CullPattern=[False, True, False])
algebraic_vertex_constraints = AlgebraicVertexConstraints(
    AlgebraicForm=algebraic_dual.AlgebraicForm,
    PFVertexIDs=cull,
    Constraints=plan_wall_reference.L,
    Scale=1,
    rcond=9.999999747e-06)  # -> AlgebraicForm, PFoam
check = Check(pfoam=algebraic_vertex_constraints.PFoam, M=support_ids, C=plan_wall_reference.R)  # -> I, I_2, am, I_3, am_2
pfpipe = PFPipe(PFoam=algebraic_vertex_constraints.PFoam, MinR=40, MaxR=120)  # -> Axes, Radius, Color, Pipe, Force
colour_by_force = ColourByForce(N=pfpipe.Force)
move = Move(Geometry=pfpipe.Pipe, Motion=plan_wall_reference.V)  # -> Geometry, Transform
stage_a_forces_dev_range_mean_dev_feet_t = Panel([check.I, check.I_2, check.am, check.I_3, check.am_2])  # "Stage A: forces | dev range | mean dev | feet-to-wall range | mean"
preview = CustomPreview(Geometry=move.Geometry, Material=colour_by_force)

# ---- group: 4 Stage B - pull all 12 feet onto their target points, PFPerp
pfperp_iterations = Slider(300, range=0..3000)
pull_strength = Slider(10, range=0..100)
pfvertex_constraints = PFVertexConstraints(
    PFoam=algebraic_vertex_constraints.PFoam,
    PFVertexID=support_ids,
    Constraint=plan_wall_reference.L_2,
    Coefficient=pull_strength,
    On=True)
pfperp = PFPerp(PFoam=pfvertex_constraints, MaxIteration=pfperp_iterations, Deviation=0.1, MinimumEdgeLength=10)  # -> PFoam, Deviation
check_2 = Check(pfoam=pfperp.PFoam, M=support_ids, C=plan_wall_reference.R)  # -> I, I_2, am, I_3, am_2
pfpipe_2 = PFPipe(PFoam=pfperp.PFoam, MinR=40, MaxR=120)  # -> Axes, Radius, Color, Pipe, Force
colour_by_force_2 = ColourByForce(N=pfpipe_2.Force)
stage_b_forces_dev_range_mean_dev_feet_t = Panel([check_2.I, check_2.I_2, check_2.am, check_2.I_3, check_2.am_2])  # "Stage B: forces | dev range | mean dev | feet-to-wall range | mean"
preview_2 = CustomPreview(Geometry=pfpipe_2.Pipe, Material=colour_by_force_2)
preview_3 = CustomPreview(Geometry=plan_wall_reference.E, Material=ColourSwatch(SwatchColor=RGBA(150, 150, 150, 70)))

# ---- group: 5 FINAL force diagram: PolyFrame Switch Form Force on the solved form (PFPerp), external cell removed, scaled 4x, shown green at y = +14 m
switch_form_force = SwitchFormForce(PFoam=pfperp.PFoam)
explode_pfoam = ExplodePFoam(PFoam=switch_form_force)  # -> PFVertices, PFEdges, PFFaces, PFCells
inspect_pfcell = InspectPFCell(PFCell=explode_pfoam.PFCells)  # -> ID, Mesh, Centroid, External, PFVertices, PFEdges, PFFaces, Dual
not = GateNot(A=inspect_pfcell.External)
cull_2 = CullPattern(List=explode_pfoam.PFCells, CullPattern=not)
pfcell_to_brep = PFCellToBrep(PFCell=cull_2)
bbox = BoundingBox(Content=pfcell_to_brep, Plane=PlaneXY(0, 0, 0))  # -> Box, Box_2
boxprop = BoxProperties(Box=bbox.Box)  # -> Center, Diagonal, Area, Volume, Degeneracy
scale = Scale(Geometry=pfcell_to_brep, Center=boxprop.Center, Factor=4)  # -> Geometry, Transform
pt = ConstructPoint(XCoordinate=0, YCoordinate=14000, ZCoordinate=0)
vec2pt = Vector2Pt(PointA=boxprop.Center, PointB=pt, Unitize=False)  # -> Vector, Length
move_2 = Move(Geometry=scale.Geometry, Motion=vec2pt.Vector)  # -> Geometry, Transform
preview_4 = CustomPreview(Geometry=move_2.Geometry, Material=ColourSwatch(SwatchColor=RGBA(120, 190, 120, 150)))

# ---- group: 6 Outer pyramid as branches (projected dome pattern) + vertical posts
# Outer branch skin - read me: OUTER PYRAMID AS A BRANCH SYSTEM (printed formwork, NOT structural). Orange = the dome branches projected straight up (Z) onto the pyramid faces, so every outer branch sits directly above an inner one (same pattern, split at the hips), plus the 4 hips and the eave edge. Grey = vertical posts from each dome node up to the skin: they hand the formwork weight down to the nodes as VERTICAL loads only, which keeps the dome compression-only. Pyramid size comes from the skin sliders (group 5). Default 13.90 m base, apex 9.27 m (53.1 deg, same as the original pyramid).
explode_pfoam_2 = ExplodePFoam(PFoam=pfperp.PFoam)  # -> PFVertices, PFEdges, PFFaces, PFCells
separate_pfedges_by_type = SeparatePFEdgesByType(PFEdge=explode_pfoam_2.PFEdges)  # -> Internal, Force, External
inspect_pfedge = InspectPFEdge(PFEdge=separate_pfedges_by_type.Internal)  # -> ID, Line, External, Force, PFVertices, PPFFaces, Dual, Pair
Z = UnitZ(Factor=1)
end = EndPoints(Curve=inspect_pfedge.Line)  # -> Start, End
merge = Merge(Data1=end.Start, Data2=end.End)
flatten = FlattenTree(Tree=merge, Path="{0}")
cullpt = CullDuplicates(Points=flatten, Tolerance=5, CullMode=3)  # -> Points, Indices, Valence
branch_display_radius_mm = Slider(50, range=10..200)
swatch = ColourSwatch(SwatchColor=RGB(235, 140, 40))

# ---- group: 8 Eave + corner branches (feet down to the eave rim)
# Eave branches - read me: Fills the bare eave strip and the 4 corners. Each foot (its point on the skin, directly above the dome foot) gets two branches running down to the eave rim: to the points halfway (along the rim) to its neighbouring feet. Between the two feet next to a corner that halfway point IS the plan corner, so every corner closes as a V. Result: the diamond rhythm of the dome continues down to the eave. Follows all sliders.
pdecon = Deconstruct(Point=cullpt.Points)  # -> XComponent, YComponent, ZComponent
smaller = SmallerThan(FirstNumber=pdecon.ZComponent, SecondNumber=100)  # -> SmallerThan, OrEqualTo

# ---- group: 5 Outer pyramid skin (not structural) + fit check
# Outer pyramid skin - read me: NON-STRUCTURAL OUTER PYRAMID SKIN around the unchanged compression dome. Default: same 53.1 deg slope as the original 10x10 / 6.67 m pyramid, scaled up until every bar centreline is at least 200 mm inside the skin (perpendicular). Result: base 13.90 x 13.90 m, apex 9.27 m, eaves 1.95 m past the walls, gap dome-to-skin up to ~1.6 m. The skin's base is at the top of the walls (z=0), so it overhangs the walls as eaves. Its weight must reach the dome only as VERTICAL loads at nodes (posts), which keeps the dome compression-only; Karamba already assumed 7 kN/m2 over a 10x10 pyramid surface, so a bigger skin is MORE load - re-check. Slide base/apex to test other sizes; 'Dome nodes inside the skin' must equal 'Dome nodes (total)' (test points are lifted 60 mm so feet sitting on the base plane count as inside).
skin_base_side_mm = Slider(13900, range=10000..20000)
skin_apex_height_mm = Slider(9270, range=6670..14000)
explode_pfoam_3 = ExplodePFoam(PFoam=pfperp.PFoam)  # -> PFVertices, PFEdges, PFFaces, PFCells
division = Division(A=skin_base_side_mm, B=-2)
inspect_pfvertex = InspectPFVertex(PFVertex=explode_pfoam_3.PFVertices)  # -> ID, Point, External, PFEdges, PFFaces, Dual
pt_2 = ConstructPoint(XCoordinate=division, YCoordinate=division, ZCoordinate=0)
rectangle = Rectangle(Plane=pt_2, XSize=skin_base_side_mm, YSize=skin_base_side_mm, Radius=0)  # -> Rectangle, Length
pt_3 = ConstructPoint(XCoordinate=0, YCoordinate=0, ZCoordinate=skin_apex_height_mm)
not_2 = GateNot(A=inspect_pfvertex.External)
boundary = BoundarySurfaces(Edges=rectangle.Rectangle)
cull_3 = CullPattern(List=inspect_pfvertex.Point, CullPattern=not_2)
extr = ExtrudePoint(Base=rectangle.Rectangle, Point=pt_3)
extr_2 = ExtrudePoint(Base=boundary, Point=pt_3)
Z_2 = UnitZ(Factor=60)
move_3 = Move(Geometry=cull_3, Motion=Z_2)  # -> Geometry, Transform
cap = CapHoles(Brep=extr_2)
area = Area(Geometry=extr)  # -> Area, Centroid
brepinc = PointInBrep(Brep=cap, Point=move_3.Geometry, Strict=False)
brep_cp = BrepClosestPoint(Point=cull_3, Brep=extr)  # -> Point, Normal, Distance
bnd = Bounds(Numbers=brep_cp.Distance)
lng = ListLength(List=cull_3)
ma = MassAddition(Input=brepinc)  # -> Result, PartialResults
dome_nodes_total = Panel(lng)
dome_nodes_inside_the_skin_must_equal_to = Panel(ma.Result)  # "Dome nodes inside the skin (must equal total)"
node_to_skin_distance_range_mm_to_the_sl = Panel(bnd)  # "Node-to-skin distance range (mm, to the sloped faces; feet are far from them)"
skin_area_4_sloped_faces_mm2 = Panel(area.Area)

# ---- group: 7 Cut the pyramid flat at the top of the branches
# Cut pyramid - read me: The outer pyramid is CUT FLAT at the top (truncated), not pointed. Default cut = the highest point of the outer branches (where the projected crown-ring branches cross the hips), so no branch is cut; the slider raises/lowers it. If you lower it below 0, branches above the cut still show - they would have to be trimmed. The square top opening sits above the dome's open crown ring. Hips and the eave + top rims are drawn as branches; the solid skin preview (group 5) now shows the truncated surface (preview off by default). The fit check in group 5 still uses the full pyramid, which is the same below the cut.
cut_height_above_top_of_branches_mm = Slider(0, range=-1000..2000)

# ---- group: 9 Sloped struts from the feet to the corners and eave (raised eave edge)
# Sloped struts - read me: Eaves and corners are back, now carried by SLOPED STRUTS from the dome feet. Each foot sends two struts up and out to the eave points beside it (halfway along the eave to the next foot); between the two feet next to a corner that point is the corner, so each corner sits on a V of struts. The eave edge is raised (slider, default 1.5 m above the wall top) so the struts can slope: with the edge at wall-top level they would be flat and could only work in bending. Higher eave edge = steeper struts but a shorter overhang. The struts land on the feet, i.e. directly on the supports, so their outward push goes into the wall/footing, not into the dome.
eave_edge_height_above_wall_top_mm = Slider(0, range=0..2500)
division_2 = Division(A=eave_edge_height_above_wall_top_mm, B=skin_apex_height_mm)
subtraction = Subtraction(A=1, B=division_2)
multiplication = Multiplication(A=skin_base_side_mm, B=subtraction)
division_3 = Division(A=multiplication, B=-2)
pt_4 = ConstructPoint(XCoordinate=division_3, YCoordinate=division_3, ZCoordinate=eave_edge_height_above_wall_top_mm)
rectangle_2 = Rectangle(Plane=pt_4, XSize=multiplication, YSize=multiplication, Radius=0)  # -> Rectangle, Length
subtraction_2 = Subtraction(A=division_3, B=-5000)
multiplication_2 = Multiplication(A=subtraction_2, B=-1)
eave_overhang_past_the_wall_line_mm = Panel(multiplication_2)

# ---- group: 10 Corner struts flat (horizontal at eave height)
# Flat corners - read me: Eave edge set to the BASE OF THE SHELL (wall-top level, slider = 0): the skin now comes all the way down to where the dome feet sit, and each corner ends at the plan corner of the eave at that same level. All struts then run horizontally at base level from the feet: side struts to the eave points, corner struts (V) to the corner. NOTE: horizontal struts carry the eave/corner weight by bending (cantilevers off the feet), not by compression - check in Karamba once the skin weight is known; slide the eave height up to make them sloped again.
disc = Discontinuity(Curve=rectangle_2.Rectangle, Level=1)  # -> Points, Parameters

# ---- group: 6 Outer pyramid as branches (projected dome pattern) + vertical posts (continued)
project = ProjectCurve(Curve=inspect_pfedge.Line, Brep=extr, Direction=Z)
edges = BrepEdges(Brep=extr)  # -> Naked, Interior, NonManifold
project_2 = ProjectPoint(Point=cullpt.Points, Direction=Z, Geometry=extr)  # -> Point, Index
ln = Line(StartPoint=cullpt.Points, EndPoint=project_2.Point)
pipe = Pipe(Curve=project, Radius=branch_display_radius_mm, Caps=0, FitRail=False)
pipe_2 = Pipe(Curve=ln, Radius=branch_display_radius_mm, Caps=0, FitRail=False)
preview_5 = CustomPreview(Geometry=pipe, Material=swatch)
preview_6 = CustomPreview(Geometry=pipe_2, Material=ColourSwatch(SwatchColor=RGB(150, 150, 150)))

# ---- group: 7 Cut the pyramid flat at the top of the branches (continued)
disc_2 = Discontinuity(Curve=project, Level=1)  # -> Points, Parameters
merge_2 = Merge(Data1=project_2.Point, Data2=disc_2.Points)
flatten_2 = FlattenTree(Tree=merge_2, Path="{0}")
pdecon_2 = Deconstruct(Point=flatten_2)  # -> XComponent, YComponent, ZComponent
bnd_2 = Bounds(Numbers=pdecon_2.ZComponent)
dedomain = DeconstructDomain(Domain=bnd_2)  # -> Start, End
addition = Addition(A=dedomain.End, B=cut_height_above_top_of_branches_mm)
division_4 = Division(A=addition, B=skin_apex_height_mm)
cut_height_mm = Panel(addition)
subtraction_3 = Subtraction(A=1, B=division_4)
multiplication_3 = Multiplication(A=skin_base_side_mm, B=subtraction_3)
top_opening_side_mm = Panel(multiplication_3)
division_5 = Division(A=multiplication_3, B=-2)
pt_5 = ConstructPoint(XCoordinate=division_5, YCoordinate=division_5, ZCoordinate=addition)
rectangle_3 = Rectangle(Plane=pt_5, XSize=multiplication_3, YSize=multiplication_3, Radius=0)  # -> Rectangle, Length
disc_3 = Discontinuity(Curve=rectangle_2.Rectangle, Level=1)  # -> Points, Parameters
disc_4 = Discontinuity(Curve=rectangle_3.Rectangle, Level=1)  # -> Points, Parameters
merge_3 = Merge(Data1=rectangle_2.Rectangle, Data2=rectangle_3.Rectangle)
rulesrf = RuledSurface(CurveA=rectangle_2.Rectangle, CurveB=rectangle_3.Rectangle)
ln_2 = Line(StartPoint=disc_3.Points, EndPoint=disc_4.Points)

# ---- group: 8 Eave + corner branches (feet down to the eave rim) (continued)
cull_4 = CullPattern(List=project_2.Point, CullPattern=smaller.SmallerThan)
crv_cp = CurveClosestPoint(Point=cull_4, Curve=rectangle_2.Rectangle)  # -> Point, Parameter, Distance
lenp = LengthParameter(Curve=rectangle_2.Rectangle, Parameter=crv_cp.Parameter)  # -> Length, Length_2
len = Length(Curve=rectangle_2.Rectangle)
sort = SortList(Keys=lenp.Length, ValuesA=cull_4)  # -> Keys, ValuesA
shift = ShiftList(List=sort.Keys, Shift=1, Wrap=True)
shift_2 = ShiftList(List=sort.ValuesA, Shift=1, Wrap=True)
subtraction_4 = Subtraction(A=shift, B=sort.Keys)
addition_2 = Addition(A=subtraction_4, B=len)
mod = Modulus(A=addition_2, B=len)
division_6 = Division(A=mod, B=2)
addition_3 = Addition(A=sort.Keys, B=division_6)
mod_2 = Modulus(A=addition_3, B=len)
eval = EvaluateLength(Curve=rectangle_2.Rectangle, Length=mod_2, Normalized=False)  # -> Point, Tangent, Parameter
ln_3 = Line(StartPoint=sort.ValuesA, EndPoint=eval.Point)
ln_4 = Line(StartPoint=shift_2, EndPoint=eval.Point)
merge_4 = Merge(Data1=ln_3, Data2=ln_4)
pipe_3 = Pipe(Curve=merge_4, Radius=branch_display_radius_mm, Caps=0, FitRail=False)
preview_7 = CustomPreview(Geometry=pipe_3, Material=swatch)

# ---- group: 10 Corner struts flat (horizontal at eave height) (continued)
cp = ClosestPoint(Point=eval.Point, Cloud=disc.Points)  # -> ClosestPoint, CPIndex, Distance
smaller_2 = SmallerThan(FirstNumber=cp.Distance, SecondNumber=1)  # -> SmallerThan, OrEqualTo
multiplication_4 = Multiplication(A=smaller_2.SmallerThan, B=eave_edge_height_above_wall_top_mm)

# ---- group: 9 Sloped struts from the feet to the corners and eave (raised eave edge) (continued)
pdecon_3 = Deconstruct(Point=sort.ValuesA)  # -> XComponent, YComponent, ZComponent
pdecon_4 = Deconstruct(Point=shift_2)  # -> XComponent, YComponent, ZComponent
pt_6 = ConstructPoint(XCoordinate=pdecon_3.XComponent, YCoordinate=pdecon_3.YComponent, ZCoordinate=multiplication_4)
pt_7 = ConstructPoint(XCoordinate=pdecon_4.XComponent, YCoordinate=pdecon_4.YComponent, ZCoordinate=multiplication_4)
ln_5 = Line(StartPoint=pt_6, EndPoint=eval.Point)
ln_6 = Line(StartPoint=pt_7, EndPoint=eval.Point)
merge_5 = Merge(Data1=ln_5, Data2=ln_6)
pipe_4 = Pipe(Curve=merge_5, Radius=branch_display_radius_mm, Caps=0, FitRail=False)
preview_8 = CustomPreview(Geometry=pipe_4, Material=ColourSwatch(SwatchColor=RGB(90, 170, 190)))
len_2 = Length(Curve=merge_5)
bnd_3 = Bounds(Numbers=len_2)
strut_length_range_mm = Panel(bnd_3)

# ---- group: 5 Outer pyramid skin (not structural) + fit check (continued)
preview_9 = CustomPreview(Geometry=rulesrf, Material=ColourSwatch(SwatchColor=RGBA(230, 170, 90, 90)))

# ---- group: 6 Outer pyramid as branches (projected dome pattern) + vertical posts (continued)
pipe_5 = Pipe(Curve=merge_3, Radius=branch_display_radius_mm, Caps=0, FitRail=False)
pipe_6 = Pipe(Curve=ln_2, Radius=branch_display_radius_mm, Caps=0, FitRail=False)
preview_10 = CustomPreview(Geometry=pipe_5, Material=swatch)
preview_11 = CustomPreview(Geometry=pipe_6, Material=swatch)

# ==== cluster ForceDiagramPresetsGUESS: GUESSED force diagram (not the friend's): irregular 12-gon cap whose edge normals point at the 12 feet (2 m from each corner and mid-side), diamond (diagrid) cells between half-offset circular rings, crown = fan -> horizontal crown ring (open top), outer band mirrored about each foot, joined to one point below; ring radii re-found for an even casing load. Scale Z = cone depth.
P = ClusterInput()
Z = ClusterInput()
reaction_cell_centroids = Point([Point(-331.8915038, -570.4580643, -250), Point(0, -659.9205245, -250), Point(331.8915038, -570.4580643, -250), Point(570.4580643, -331.8915038, -250), Point(659.9205245, 0, -250), Point(570.4580643, 331.8915038, -250), Point(331.8915038, 570.4580643, -250), Point(0, 659.9205245, -250), Point(-331.8915038, 570.4580643, -250), Point(-570.4580643, 331.8915038, -250), Point(-659.9205245, 0, -250), Point(-570.4580643, -331.8915038, -250)])
cells_presets = Brep([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])
branch = TreeBranch(Tree=cells_presets, Path=P, MaintainPaths=True)
branch_2 = TreeBranch(Tree=reaction_cell_centroids, Path=P, MaintainPaths=True)
scale_nu = ScaleNU(Geometry=branch, Plane=PlaneXY(0, 0, 0), ScaleX=1, ScaleY=1, ScaleZ=Z)  # -> Geometry, Transform
scale_nu_2 = ScaleNU(Geometry=branch_2, Plane=PlaneXY(0, 0, 0), ScaleX=1, ScaleY=1, ScaleZ=Z)  # -> Geometry, Transform
G = ClusterOutput(scale_nu.Geometry)
G_2 = ClusterOutput(scale_nu_2.Geometry)

# ==== cluster PlanWallReference: Square plan: 12 foot targets (side/5 from each corner + mid-side), 4 mid-side points, wall line, grey reference pyramid
A = ClusterInput()
Z = ClusterInput()
division = Division(A=A, B=-2)
pt = ConstructPoint(XCoordinate=division, YCoordinate=division, ZCoordinate=0)
multiplication = Multiplication(A=A, B=-1.4)
rectangle = Rectangle(Plane=pt, XSize=A, YSize=A, Radius=0)  # -> Rectangle, Length
X = UnitX(Factor=multiplication)
divide = DivideCurve(Curve=rectangle.Rectangle, Count=40, Kinks=False)  # -> Points, Tangents, Parameters
dup = DuplicateData(Data=rectangle.Rectangle, Number=16, Order=True)
pt_2 = ConstructPoint(XCoordinate=0, YCoordinate=0, ZCoordinate=Z)
cull = CullPattern(List=divide.Points, CullPattern=[False, False, True, False, False, True, False, False, True, False])
cull_2 = CullPattern(List=divide.Points, CullPattern=[True, False, False, False, False, False, False, False, False, False])
pline = PolyLine(Vertices=cull_2, Closed=True)
boundary = BoundarySurfaces(Edges=pline)
cull_3 = CullPattern(List=cull, CullPattern=[False, True, False])
extr = ExtrudePoint(Base=boundary, Point=pt_2)
L = ClusterOutput(cull_3)
L_2 = ClusterOutput(cull)
R = ClusterOutput(rectangle.Rectangle)
V = ClusterOutput(X)
E = ClusterOutput(extr)

# ==== cluster SupportIDs: Form vertices (= force cells) carrying the 12 reactions, in wall order: near-corner, mid, near-corner, ...
pfoam = ClusterInput()
P = ClusterInput()
explode_pfoam = ExplodePFoam(PFoam=pfoam)  # -> PFVertices, PFEdges, PFFaces, PFCells
inspect_pfcell = InspectPFCell(PFCell=explode_pfoam.PFCells)  # -> ID, Mesh, Centroid, External, PFVertices, PFEdges, PFFaces, Dual
cps = ClosestPoints(Point=P, Cloud=inspect_pfcell.Centroid, Count=1)  # -> ClosestPoint, CPIndex, Distance
item = ListItem(List=inspect_pfcell.ID, Index=flatten(cps.CPIndex), Wrap=True)
i = ClusterOutput(item)

# ==== cluster ColourByForce: Blue = low compression, red = high (PFPipe force magnitude)
N = ClusterInput()
bnd = Bounds(Numbers=N)
remap = RemapNumbers(Value=N, Source=bnd, Target=Domain(0, 1))  # -> Mapped, Clipped
gradient = Gradient(
    LowerLimit=0,
    UpperLimit=1,
    Parameter=remap.Mapped,
    stops=[0: RGB(40, 90, 220), 0.5: RGB(150, 90, 200), 1: RGB(220, 40, 40)])
C = ClusterOutput(gradient)

# ==== cluster Check: Bar force range (+ = compression), deviation of bars from their force faces, distance of the 12 feet to the wall line
pfoam = ClusterInput()
M = ClusterInput()
C = ClusterInput()
explode_pfoam = ExplodePFoam(PFoam=pfoam)  # -> PFVertices, PFEdges, PFFaces, PFCells
inspect_pfvertex = InspectPFVertex(PFVertex=explode_pfoam.PFVertices)  # -> ID, Point, External, PFEdges, PFFaces, Dual
separate_pfedges_by_type = SeparatePFEdgesByType(PFEdge=explode_pfoam.PFEdges)  # -> Internal, Force, External
inspect_pfedge = InspectPFEdge(PFEdge=separate_pfedges_by_type.Internal)  # -> ID, Line, External, Force, PFVertices, PPFFaces, Dual, Pair
mindex = MemberIndex(Set=inspect_pfvertex.ID, Member=M)  # -> Index, Count
inspect_pfface = InspectPFFace(PFFace=inspect_pfedge.Dual)  # -> ID, Mesh, External, Area, Plane, PFVertices, PFEdges, PFCell, Dual, Pair
item = ListItem(List=inspect_pfvertex.Point, Index=flatten(mindex.Index), Wrap=True)
bnd = Bounds(Numbers=inspect_pfedge.Force)
end = EndPoints(Curve=inspect_pfedge.Line)  # -> Start, End
vec2pt = Vector2Pt(PointA=end.Start, PointB=end.End, Unitize=False)  # -> Vector, Length
crv_cp = CurveClosestPoint(Point=item, Curve=C)  # -> Point, Parameter, Distance
deplane = DeconstructPlane(Plane=inspect_pfface.Plane)  # -> Origin, XAxis, YAxis, ZAxis
bnd_2 = Bounds(Numbers=crv_cp.Distance)
angle = Angle(VectorA=vec2pt.Vector, VectorB=deplane.ZAxis)  # -> Angle, Reflex
avr = Average(Input=crv_cp.Distance)
deg = Degrees(Radians=angle.Angle)
subtraction = Subtraction(A=deg, B=90)
abs = Absolute(Value=subtraction)
subtraction_2 = Subtraction(A=90, B=abs)
bnd_3 = Bounds(Numbers=subtraction_2)
avr_2 = Average(Input=subtraction_2)
I = ClusterOutput(bnd)
I_2 = ClusterOutput(bnd_3)
am = ClusterOutput(avr_2)
I_3 = ClusterOutput(bnd_2)
am_2 = ClusterOutput(avr)
