# Grasshopper definition friend-16-diagrid.gh (Grasshopper 1.0.8)
# plug-ins: PolyFrame 2

# ---- group: 1 Play here
branching_preset_guess = ValueList({"4 rings": 0, "5 rings": 1, "6 rings": 2, "7 rings": 3}, selected="5 rings")
force_depth_scale_z = Slider(0.76, range=0.3..1.5)
plan_side_mm = Slider(10000, range=4000..16000)
# GUESS - read me: GUESSED force diagram (not the friend's file). Diagrid: regular 16-gon cap (5 supports per side incl. corners) made of diamond cells between half-offset circular rings (every bar diagonal, no rings), crown = one polygon cell (a hub node), outer band built by hand mirrored about each foot; one point below = cone depth (Scale Z). Stored as internalized Breps like PF example 3(7). Stage A pins the 4 corners only (exact) ; the other 12 feet land where the algebra puts them. Stage B pulls all 8 feet onto the wall line and runs PFPerp.
ref_apex_mm = Slider(6670, range=1000..12000)

# ---- group: 2 Force diagram - GUESS diagrid, mirror-symmetric (PolyFrame build)
force_diagram_presets_guess = ForceDiagramPresetsGUESS(P=branching_preset_guess, Z=force_depth_scale_z)  # -> G, G_2
plan_wall_reference = PlanWallReference(A=plan_side_mm, Z=ref_apex_mm)  # -> L, D, R, V, E
pfbuild = PFBuild(Brep=flatten(force_diagram_presets_guess.G), AbsoluteTolerance=0.1, PlanarityTolerance=0.1)  # -> ForcePFoam, FormPFoam
support_ids = SupportIDs(pfoam=pfbuild.ForcePFoam, P=force_diagram_presets_guess.G_2)

# ---- group: 3 Stage A - exact algebraic, 4 corners pinned (shown left)
algebraic_dual = AlgebraicDual(ForcePFoam=pfbuild.ForcePFoam, Scale=1, Flip=False, displayIndex=False, rcond=9.999999747e-06)  # -> AlgebraicForm, AlgebraicForce, FormPFoam
cull = CullPattern(List=flatten(support_ids), CullPattern=[True, False, False, False])
algebraic_vertex_constraints = AlgebraicVertexConstraints(
    AlgebraicForm=algebraic_dual.AlgebraicForm,
    PFVertexIDs=cull,
    Constraints=plan_wall_reference.L,
    Scale=1,
    rcond=9.999999747e-06)  # -> AlgebraicForm, PFoam
check = Check(pfoam=algebraic_vertex_constraints.PFoam, M=support_ids, C=plan_wall_reference.R)  # -> I, I_2, am, I_3, am_2
pfpipe = PFPipe(PFoam=algebraic_vertex_constraints.PFoam, MinR=40, MaxR=120)  # -> Axes, Radius, Color, Pipe, Force
colour_by_force = ColourByForce(N=pfpipe.Force)
move = Move(Geometry=pfpipe.Pipe, Motion=plan_wall_reference.V)  # -> Geometry, Transform
stage_a_forces_dev_range_mean_dev_feet_t = Panel([check.I, check.I_2, check.am, check.I_3, check.am_2])  # "Stage A: forces | dev range | mean dev | feet-to-wall range | mean"
preview = CustomPreview(Geometry=move.Geometry, Material=colour_by_force)

# ---- group: 4 Stage B - pull 16 feet onto wall line, PFPerp
pfperp_iterations = Slider(100, range=0..3000)
pull_strength = Slider(10, range=0..100)
pfvertex_constraints = PFVertexConstraints(
    PFoam=algebraic_vertex_constraints.PFoam,
    PFVertexID=support_ids,
    Constraint=plan_wall_reference.D,
    Coefficient=pull_strength,
    On=True)
pfperp = PFPerp(PFoam=pfvertex_constraints, MaxIteration=pfperp_iterations, Deviation=0.1, MinimumEdgeLength=10)  # -> PFoam, Deviation
check_2 = Check(pfoam=pfperp.PFoam, M=support_ids, C=plan_wall_reference.R)  # -> I, I_2, am, I_3, am_2
pfpipe_2 = PFPipe(PFoam=pfperp.PFoam, MinR=40, MaxR=120)  # -> Axes, Radius, Color, Pipe, Force
colour_by_force_2 = ColourByForce(N=pfpipe_2.Force)
stage_b_forces_dev_range_mean_dev_feet_t = Panel([check_2.I, check_2.I_2, check_2.am, check_2.I_3, check_2.am_2])  # "Stage B: forces | dev range | mean dev | feet-to-wall range | mean"
preview_2 = CustomPreview(Geometry=pfpipe_2.Pipe, Material=colour_by_force_2)
preview_3 = CustomPreview(Geometry=plan_wall_reference.E, Material=ColourSwatch(SwatchColor=RGBA(150, 150, 150, 70)))

# ---- group: 5 Stage B bars by angle from true vertical (green <=35, yellow 35-60, red >60)
angle_from_vertical = AngleFromVertical(C=pfpipe_2.Axes, L=pfpipe_2.Pipe)  # -> A, A_2, B, L_2, L_3, L_4, L_5
stage_b_bars_35_35_60_60_80_horizontal = Panel([angle_from_vertical.L_2, angle_from_vertical.L_3, angle_from_vertical.L_4, angle_from_vertical.L_5])
preview_4 = CustomPreview(Geometry=angle_from_vertical.A, Material=ColourSwatch(SwatchColor=RGB(40, 170, 60)))
preview_5 = CustomPreview(Geometry=angle_from_vertical.A_2, Material=ColourSwatch(SwatchColor=RGB(240, 200, 30)))
preview_6 = CustomPreview(Geometry=angle_from_vertical.B, Material=ColourSwatch(SwatchColor=RGB(220, 50, 40)))

# ==== cluster ForceDiagramPresetsGUESS: GUESSED force diagrams (not the friend's): regular 16-gon cap (5 supports per side incl. corners, 2.5 m spacing), diamond (diagrid) cells between half-offset circular rings, crown = one polygon cell (hub node), outer band built by hand mirrored about each foot, joined to one point below; internalized like PF example 3(7). Scale Z = cone depth.
cells_presets = Brep(Tree({0}: [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], {1}: [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], {2}: [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], {3}: [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]))
reaction_cell_centroids = Point(Tree({0}: [Point(-498.4674444, -498.4674444, -250), Point(-269.768637, -651.2791021, -250), Point(0, -704.9394203, -250), Point(269.768637, -651.2791021, -250), Point(498.4674444, -498.4674444, -250), Point(651.2791021, -269.768637, -250), Point(704.9394203, 0, -250), Point(651.2791021, 269.768637, -250), Point(498.4674444, 498.4674444, -250), Point(269.768637, 651.2791021, -250), Point(0, 704.9394203, -250), Point(-269.768637, 651.2791021, -250), Point(-498.4674444, 498.4674444, -250), Point(-651.2791021, 269.768637, -250), Point(-704.9394203, 0, -250), Point(-651.2791021, -269.768637, -250)], {1}: [Point(-502.8019439, -502.8019439, -250), Point(-272.1144512, -656.9423986, -250), Point(0, -711.0693283, -250), Point(272.1144512, -656.9423986, -250), Point(502.8019439, -502.8019439, -250), Point(656.9423986, -272.1144512, -250), Point(711.0693283, 0, -250), Point(656.9423986, 272.1144512, -250), Point(502.8019439, 502.8019439, -250), Point(272.1144512, 656.9423986, -250), Point(0, 711.0693283, -250), Point(-272.1144512, 656.9423986, -250), Point(-502.8019439, 502.8019439, -250), Point(-656.9423986, 272.1144512, -250), Point(-711.0693283, 0, -250), Point(-656.9423986, -272.1144512, -250)], {2}: [Point(-505.6916103, -505.6916103, -250), Point(-273.6783274, -660.7179296, -250), Point(0, -715.1559336, -250), Point(273.6783274, -660.7179296, -250), Point(505.6916103, -505.6916103, -250), Point(660.7179296, -273.6783274, -250), Point(715.1559336, 0, -250), Point(660.7179296, 273.6783274, -250), Point(505.6916103, 505.6916103, -250), Point(273.6783274, 660.7179296, -250), Point(0, 715.1559336, -250), Point(-273.6783274, 660.7179296, -250), Point(-505.6916103, 505.6916103, -250), Point(-660.7179296, 273.6783274, -250), Point(-715.1559336, 0, -250), Point(-660.7179296, -273.6783274, -250)], {3}: [Point(-507.7556577, -507.7556577, -250), Point(-274.7953818, -663.4147375, -250), Point(0, -718.0749374, -250), Point(274.7953818, -663.4147375, -250), Point(507.7556577, -507.7556577, -250), Point(663.4147375, -274.7953818, -250), Point(718.0749374, 0, -250), Point(663.4147375, 274.7953818, -250), Point(507.7556577, 507.7556577, -250), Point(274.7953818, 663.4147375, -250), Point(0, 718.0749374, -250), Point(-274.7953818, 663.4147375, -250), Point(-507.7556577, 507.7556577, -250), Point(-663.4147375, 274.7953818, -250), Point(-718.0749374, 0, -250), Point(-663.4147375, -274.7953818, -250)]))
P = ClusterInput()
Z = ClusterInput()
branch = TreeBranch(Tree=cells_presets, Path=P, MaintainPaths=True)
branch_2 = TreeBranch(Tree=reaction_cell_centroids, Path=P, MaintainPaths=True)
scale_nu = ScaleNU(Geometry=branch, Plane=PlaneXY(0, 0, 0), ScaleX=1, ScaleY=1, ScaleZ=Z)  # -> Geometry, Transform
scale_nu_2 = ScaleNU(Geometry=branch_2, Plane=PlaneXY(0, 0, 0), ScaleX=1, ScaleY=1, ScaleZ=Z)  # -> Geometry, Transform
G = ClusterOutput(scale_nu.Geometry)
G_2 = ClusterOutput(scale_nu_2.Geometry)

# ==== cluster PlanWallReference: Wall points/line of the square plan, 4 corner points, grey 53.1 deg reference pyramid
A = ClusterInput()
Z = ClusterInput()
division = Division(A=A, B=-2)
pt = ConstructPoint(XCoordinate=division, YCoordinate=division, ZCoordinate=0)
rectangle = Rectangle(Plane=pt, XSize=A, YSize=A, Radius=0)  # -> Rectangle, Length
divide = DivideCurve(Curve=rectangle.Rectangle, Count=16, Kinks=False)  # -> Points, Tangents, Parameters
cull = CullPattern(List=divide.Points, CullPattern=[True, False, False, False])
dup = DuplicateData(Data=rectangle.Rectangle, Number=16, Order=True)
multiplication = Multiplication(A=A, B=-1.4)
X = UnitX(Factor=multiplication)
pline = PolyLine(Vertices=cull, Closed=True)
boundary = BoundarySurfaces(Edges=pline)
pt_2 = ConstructPoint(XCoordinate=0, YCoordinate=0, ZCoordinate=Z)
extr = ExtrudePoint(Base=boundary, Point=pt_2)
L = ClusterOutput(cull)
D = ClusterOutput(dup)
R = ClusterOutput(rectangle.Rectangle)
V = ClusterOutput(X)
E = ClusterOutput(extr)

# ==== cluster SupportIDs: Form vertices (= force cells) carrying the 16 reactions, in wall order: corner, quarter, mid, quarter, corner, ...
pfoam = ClusterInput()
P = ClusterInput()
explode_pfoam = ExplodePFoam(PFoam=pfoam)  # -> PFVertices, PFEdges, PFFaces, PFCells
inspect_pfcell = InspectPFCell(PFCell=explode_pfoam.PFCells)  # -> ID, Mesh, Centroid, External, PFVertices, PFEdges, PFFaces, Dual
cps = ClosestPoints(Point=P, Cloud=inspect_pfcell.Centroid, Count=1)  # -> ClosestPoint, CPIndex, Distance
item = ListItem(List=inspect_pfcell.ID, Index=flatten(cps.CPIndex), Wrap=True)
i = ClusterOutput(item)

# ==== cluster ColourByForce: Blue = low compression, red = high (PFPipe force magnitude)
N = ClusterInput()
bnd = Bounds(Numbers=N)
remap = RemapNumbers(Value=N, Source=bnd, Target=Domain(0, 1))  # -> Mapped, Clipped
gradient = Gradient(
    LowerLimit=0,
    UpperLimit=1,
    Parameter=remap.Mapped,
    stops=[0: RGB(40, 90, 220), 0.5: RGB(150, 90, 200), 1: RGB(220, 40, 40)])
C = ClusterOutput(gradient)

# ==== cluster Check: Bar force range (+ = compression), deviation of bars from their force faces, distance of the 16 feet to the wall line
pfoam = ClusterInput()
M = ClusterInput()
C = ClusterInput()
explode_pfoam = ExplodePFoam(PFoam=pfoam)  # -> PFVertices, PFEdges, PFFaces, PFCells
separate_pfedges_by_type = SeparatePFEdgesByType(PFEdge=explode_pfoam.PFEdges)  # -> Internal, Force, External
inspect_pfedge = InspectPFEdge(PFEdge=separate_pfedges_by_type.Internal)  # -> ID, Line, External, Force, PFVertices, PPFFaces, Dual, Pair
bnd = Bounds(Numbers=inspect_pfedge.Force)
end = EndPoints(Curve=inspect_pfedge.Line)  # -> Start, End
vec2pt = Vector2Pt(PointA=end.Start, PointB=end.End, Unitize=False)  # -> Vector, Length
inspect_pfface = InspectPFFace(PFFace=inspect_pfedge.Dual)  # -> ID, Mesh, External, Area, Plane, PFVertices, PFEdges, PFCell, Dual, Pair
deplane = DeconstructPlane(Plane=inspect_pfface.Plane)  # -> Origin, XAxis, YAxis, ZAxis
angle = Angle(VectorA=vec2pt.Vector, VectorB=deplane.ZAxis)  # -> Angle, Reflex
deg = Degrees(Radians=angle.Angle)
subtraction = Subtraction(A=deg, B=90)
abs = Absolute(Value=subtraction)
subtraction_2 = Subtraction(A=90, B=abs)
bnd_2 = Bounds(Numbers=subtraction_2)
avr = Average(Input=subtraction_2)
inspect_pfvertex = InspectPFVertex(PFVertex=explode_pfoam.PFVertices)  # -> ID, Point, External, PFEdges, PFFaces, Dual
mindex = MemberIndex(Set=inspect_pfvertex.ID, Member=M)  # -> Index, Count
item = ListItem(List=inspect_pfvertex.Point, Index=flatten(mindex.Index), Wrap=True)
crv_cp = CurveClosestPoint(Point=item, Curve=C)  # -> Point, Parameter, Distance
bnd_3 = Bounds(Numbers=crv_cp.Distance)
avr_2 = Average(Input=crv_cp.Distance)
I = ClusterOutput(bnd)
I_2 = ClusterOutput(bnd_2)
am = ClusterOutput(avr)
I_3 = ClusterOutput(bnd_3)
am_2 = ClusterOutput(avr_2)

# ==== cluster AngleFromVertical: Bars by angle from true vertical: green <=35, yellow 35-60, red >60; counts incl. near-horizontal (>80)
C = ClusterInput()
L = ClusterInput()
end = EndPoints(Curve=C)  # -> Start, End
vec2pt = Vector2Pt(PointA=end.Start, PointB=end.End, Unitize=False)  # -> Vector, Length
Z = UnitZ(Factor=1)
angle = Angle(VectorA=vec2pt.Vector, VectorB=Z)  # -> Angle, Reflex
deg = Degrees(Radians=angle.Angle)
subtraction = Subtraction(A=deg, B=90)
abs = Absolute(Value=subtraction)
subtraction_2 = Subtraction(A=90, B=abs)
smaller = SmallerThan(FirstNumber=subtraction_2, SecondNumber=35)  # -> SmallerThan, OrEqualTo
larger = LargerThan(FirstNumber=subtraction_2, SecondNumber=80)  # -> LargerThan, OrEqualTo
dispatch = Dispatch(List=L, DispatchPattern=smaller.OrEqualTo)  # -> ListA, ListB
dispatch_2 = Dispatch(List=subtraction_2, DispatchPattern=smaller.OrEqualTo)  # -> ListA, ListB
smaller_2 = SmallerThan(FirstNumber=dispatch_2.ListB, SecondNumber=60)  # -> SmallerThan, OrEqualTo
dispatch_3 = Dispatch(List=dispatch.ListB, DispatchPattern=smaller_2.OrEqualTo)  # -> ListA, ListB
cull = CullPattern(List=subtraction_2, CullPattern=larger.LargerThan)
lng = ListLength(List=cull)
lng_2 = ListLength(List=dispatch_3.ListA)
lng_3 = ListLength(List=dispatch_3.ListB)
dispatch_4 = Dispatch(List=C, DispatchPattern=smaller.OrEqualTo)  # -> ListA, ListB
lng_4 = ListLength(List=dispatch_4.ListA)
lng_5 = ListLength(List=dispatch_4.ListB)
len = Length(Curve=dispatch_4.ListB)
ma = MassAddition(Input=len)  # -> Result, PartialResults
division = Division(A=ma.Result, B=1000)
A = ClusterOutput(dispatch.ListA)
A_2 = ClusterOutput(dispatch_3.ListA)
B = ClusterOutput(dispatch_3.ListB)
L_2 = ClusterOutput(lng_4)
L_3 = ClusterOutput(lng_2)
L_4 = ClusterOutput(lng_3)
L_5 = ClusterOutput(lng)
