# Grasshopper definition friend-16-pyramid-skin.gh (Grasshopper 1.0.8)
# plug-ins: PolyFrame 2

# ---- group: 1 Play here
branching_preset_guess = ValueList({"20 feet (5 per side, 1.5 m apart, outer 2 m from corners), corners free, open top, even casing load (Scale Z 0.324)": 0}, selected="20 feet (5 per side, 1.5 m apart, outer 2 m from corners), corners free, open top, even casing load (Scale Z 0.324)")
force_depth_scale_z = Slider(0.324, range=0.2..1.5)
plan_side_mm = Slider(10000, range=4000..16000)
# GUESS - read me: GUESSED force diagram (not the friend's file). 20 FEET: 5 per side at -3, -1.5, 0, +1.5, +3 m (outer ones 2 m from each corner), CORNERS FREE, OPEN TOP, re-found for an EVEN casing load (7 rounds). Irregular 20-gon cap whose edge normals aim at the feet; crown = fan -> one horizontal crown ring (to be cast); 5 rings on circles; diamond cells, outer band mirrored about each foot; one point below = cone depth (Scale Z). Stage A pins the 4 mid-side feet (exact). Stage B pulls all 20 feet onto their target points and runs PFPerp. The net does NOT reach the plan corner (5.64 m of 7.07 m on the diagonal). 16 node pairs are closer than 200 mm (closest 54 mm): merge them when detailing.
ref_apex_mm = Slider(6670, range=1000..12000)

# ---- group: 2 Force diagram - GUESS diagrid, mirror-symmetric (PolyFrame build)
force_diagram_presets_guess = ForceDiagramPresetsGUESS(P=branching_preset_guess, Z=force_depth_scale_z)  # -> G, G_2
plan_wall_reference = PlanWallReference(A=plan_side_mm, Z=ref_apex_mm)  # -> L, L_2, R, V, E
pfbuild = PFBuild(Brep=flatten(force_diagram_presets_guess.G), AbsoluteTolerance=0.1, PlanarityTolerance=0.1)  # -> ForcePFoam, FormPFoam
support_ids = SupportIDs(pfoam=pfbuild.ForcePFoam, P=force_diagram_presets_guess.G_2)

# ---- group: 3 Stage A - exact algebraic, 4 mid-side feet pinned (shown left)
algebraic_dual = AlgebraicDual(ForcePFoam=pfbuild.ForcePFoam, Scale=1, Flip=False, displayIndex=False, rcond=9.999999747e-06)  # -> AlgebraicForm, AlgebraicForce, FormPFoam
cull = CullPattern(List=flatten(support_ids), CullPattern=[False, False, True, False, False])
algebraic_vertex_constraints = AlgebraicVertexConstraints(
    AlgebraicForm=algebraic_dual.AlgebraicForm,
    PFVertexIDs=cull,
    Constraints=plan_wall_reference.L,
    Scale=1,
    rcond=9.999999747e-06)  # -> AlgebraicForm, PFoam
check = Check(pfoam=algebraic_vertex_constraints.PFoam, M=support_ids, C=plan_wall_reference.R)  # -> I, I_2, am, I_3, am_2
pfpipe = PFPipe(PFoam=algebraic_vertex_constraints.PFoam, MinR=40, MaxR=120)  # -> Axes, Radius, Color, Pipe, Force
colour_by_force = ColourByForce(N=pfpipe.Force)
move = Move(Geometry=pfpipe.Pipe, Motion=plan_wall_reference.V)  # -> Geometry, Transform
stage_a_forces_dev_range_mean_dev_feet_t = Panel([check.I, check.I_2, check.am, check.I_3, check.am_2])  # "Stage A: forces | dev range | mean dev | feet-to-wall range | mean"
preview = CustomPreview(Geometry=move.Geometry, Material=colour_by_force)

# ---- group: 4 Stage B - pull all 20 feet onto their target points, PFPerp
pfperp_iterations = Slider(300, range=0..3000)
pull_strength = Slider(10, range=0..100)
pfvertex_constraints = PFVertexConstraints(
    PFoam=algebraic_vertex_constraints.PFoam,
    PFVertexID=support_ids,
    Constraint=plan_wall_reference.L_2,
    Coefficient=pull_strength,
    On=True)
pfperp = PFPerp(PFoam=pfvertex_constraints, MaxIteration=pfperp_iterations, Deviation=0.1, MinimumEdgeLength=10)  # -> PFoam, Deviation
check_2 = Check(pfoam=pfperp.PFoam, M=support_ids, C=plan_wall_reference.R)  # -> I, I_2, am, I_3, am_2
pfpipe_2 = PFPipe(PFoam=pfperp.PFoam, MinR=40, MaxR=120)  # -> Axes, Radius, Color, Pipe, Force
colour_by_force_2 = ColourByForce(N=pfpipe_2.Force)
stage_b_forces_dev_range_mean_dev_feet_t = Panel([check_2.I, check_2.I_2, check_2.am, check_2.I_3, check_2.am_2])  # "Stage B: forces | dev range | mean dev | feet-to-wall range | mean"
preview_2 = CustomPreview(Geometry=pfpipe_2.Pipe, Material=colour_by_force_2)
preview_3 = CustomPreview(Geometry=plan_wall_reference.E, Material=ColourSwatch(SwatchColor=RGBA(150, 150, 150, 70)))

# ---- group: 5 Outer pyramid skin (not structural) + fit check
# Outer pyramid skin - read me: NON-STRUCTURAL OUTER PYRAMID SKIN around the unchanged compression dome. Default: same 53.1 deg slope as the original 10x10 / 6.67 m pyramid, scaled up until every bar centreline is at least 200 mm inside the skin (perpendicular). Result: base 14.73 x 14.73 m, apex 9.82 m, eaves 2.36 m past the walls. The skin's base is at the top of the walls (z=0), so it overhangs the walls as eaves. Its weight must reach the dome only as VERTICAL loads at nodes (posts), which keeps the dome compression-only; Karamba already assumed 7 kN/m2 over a 10x10 pyramid surface, so a bigger skin is MORE load - re-check. Slide base/apex to test other sizes; 'Dome nodes inside the skin' must equal 'Dome nodes (total)' (test points are lifted 60 mm so feet sitting on the base plane count as inside).
skin_base_side_mm = Slider(14730, range=10000..20000)
skin_apex_height_mm = Slider(9820, range=6670..14000)
division = Division(A=skin_base_side_mm, B=-2)
pt = ConstructPoint(XCoordinate=division, YCoordinate=division, ZCoordinate=0)
rectangle = Rectangle(Plane=pt, XSize=skin_base_side_mm, YSize=skin_base_side_mm, Radius=0)  # -> Rectangle, Length
boundary = BoundarySurfaces(Edges=rectangle.Rectangle)
pt_2 = ConstructPoint(XCoordinate=0, YCoordinate=0, ZCoordinate=skin_apex_height_mm)
extr = ExtrudePoint(Base=boundary, Point=pt_2)
extr_2 = ExtrudePoint(Base=rectangle.Rectangle, Point=pt_2)
preview_4 = CustomPreview(Geometry=extr_2, Material=ColourSwatch(SwatchColor=RGBA(230, 170, 90, 90)))
explode_pfoam = ExplodePFoam(PFoam=pfperp.PFoam)  # -> PFVertices, PFEdges, PFFaces, PFCells
inspect_pfvertex = InspectPFVertex(PFVertex=explode_pfoam.PFVertices)  # -> ID, Point, External, PFEdges, PFFaces, Dual
not = GateNot(A=inspect_pfvertex.External)
cull_2 = CullPattern(List=inspect_pfvertex.Point, CullPattern=not)
cap = CapHoles(Brep=extr)
Z = UnitZ(Factor=60)
move_2 = Move(Geometry=cull_2, Motion=Z)  # -> Geometry, Transform
brepinc = PointInBrep(Brep=cap, Point=move_2.Geometry, Strict=False)
brep_cp = BrepClosestPoint(Point=cull_2, Brep=extr_2)  # -> Point, Normal, Distance
bnd = Bounds(Numbers=brep_cp.Distance)
ma = MassAddition(Input=brepinc)  # -> Result, PartialResults
lng = ListLength(List=cull_2)
area = Area(Geometry=extr_2)  # -> Area, Centroid
dome_nodes_total = Panel(lng)
dome_nodes_inside_the_skin_must_equal_to = Panel(ma.Result)  # "Dome nodes inside the skin (must equal total)"
node_to_skin_distance_range_mm_to_the_sl = Panel(bnd)  # "Node-to-skin distance range (mm, to the sloped faces; feet are far from them)"
skin_area_4_sloped_faces_mm2 = Panel(area.Area)

# ==== cluster ForceDiagramPresetsGUESS: GUESSED force diagram (not the friend's): irregular 20-gon cap whose edge normals point at the 20 feet (5 per side at -3, -1.5, 0, 1.5, 3 m), 5 rings, diamond (diagrid) cells between half-offset circular rings, crown = fan -> horizontal crown ring (open top), outer band mirrored about each foot, joined to one point below; ring radii re-found for an even casing load. Scale Z = cone depth.
P = ClusterInput()
Z = ClusterInput()
reaction_cell_centroids = Point([Point(-392.1814044, -569.8509687, -250), Point(-191.2349484, -663.4479488, -250), Point(0, -690.4188423, -250), Point(191.2349484, -663.4479488, -250), Point(392.1814044, -569.8509687, -250), Point(569.8509687, -392.1814044, -250)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])
cells_presets = Brep([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])
branch = TreeBranch(Tree=cells_presets, Path=P, MaintainPaths=True)
branch_2 = TreeBranch(Tree=reaction_cell_centroids, Path=P, MaintainPaths=True)
scale_nu = ScaleNU(Geometry=branch, Plane=PlaneXY(0, 0, 0), ScaleX=1, ScaleY=1, ScaleZ=Z)  # -> Geometry, Transform
scale_nu_2 = ScaleNU(Geometry=branch_2, Plane=PlaneXY(0, 0, 0), ScaleX=1, ScaleY=1, ScaleZ=Z)  # -> Geometry, Transform
G = ClusterOutput(scale_nu.Geometry)
G_2 = ClusterOutput(scale_nu_2.Geometry)

# ==== cluster PlanWallReference: Square plan: 20 foot targets (5 per side, side/5 from each corner, 0.15 x side apart), 4 mid-side points, wall line, grey reference pyramid
A = ClusterInput()
Z = ClusterInput()
division = Division(A=A, B=-2)
pt = ConstructPoint(XCoordinate=division, YCoordinate=division, ZCoordinate=0)
multiplication = Multiplication(A=A, B=-1.4)
rectangle = Rectangle(Plane=pt, XSize=A, YSize=A, Radius=0)  # -> Rectangle, Length
X = UnitX(Factor=multiplication)
divide = DivideCurve(Curve=rectangle.Rectangle, Count=80, Kinks=False)  # -> Points, Tangents, Parameters
dup = DuplicateData(Data=rectangle.Rectangle, Number=16, Order=True)
pt_2 = ConstructPoint(XCoordinate=0, YCoordinate=0, ZCoordinate=Z)
cull = CullPattern(
    List=divide.Points,
    CullPattern=[False, False, False, False, True, False, False, True, False, False, True, False, False, True, False, False, True, False, False, False])
cull_2 = CullPattern(
    List=divide.Points,
    CullPattern=[True, False, False, False, False, False, False, False, False, False, False, False, False, False, False, False, False, False, False, False])
pline = PolyLine(Vertices=cull_2, Closed=True)
boundary = BoundarySurfaces(Edges=pline)
cull_3 = CullPattern(List=cull, CullPattern=[False, False, True, False, False])
extr = ExtrudePoint(Base=boundary, Point=pt_2)
L = ClusterOutput(cull_3)
L_2 = ClusterOutput(cull)
R = ClusterOutput(rectangle.Rectangle)
V = ClusterOutput(X)
E = ClusterOutput(extr)

# ==== cluster SupportIDs: Form vertices (= force cells) carrying the 20 reactions, in wall order along each side
pfoam = ClusterInput()
P = ClusterInput()
explode_pfoam = ExplodePFoam(PFoam=pfoam)  # -> PFVertices, PFEdges, PFFaces, PFCells
inspect_pfcell = InspectPFCell(PFCell=explode_pfoam.PFCells)  # -> ID, Mesh, Centroid, External, PFVertices, PFEdges, PFFaces, Dual
cps = ClosestPoints(Point=P, Cloud=inspect_pfcell.Centroid, Count=1)  # -> ClosestPoint, CPIndex, Distance
item = ListItem(List=inspect_pfcell.ID, Index=flatten(cps.CPIndex), Wrap=True)
i = ClusterOutput(item)

# ==== cluster ColourByForce: Blue = low compression, red = high (PFPipe force magnitude)
N = ClusterInput()
bnd = Bounds(Numbers=N)
remap = RemapNumbers(Value=N, Source=bnd, Target=Domain(0, 1))  # -> Mapped, Clipped
gradient = Gradient(
    LowerLimit=0,
    UpperLimit=1,
    Parameter=remap.Mapped,
    stops=[0: RGB(40, 90, 220), 0.5: RGB(150, 90, 200), 1: RGB(220, 40, 40)])
C = ClusterOutput(gradient)

# ==== cluster Check: Bar force range (+ = compression), deviation of bars from their force faces, distance of the 20 feet to the wall line
pfoam = ClusterInput()
M = ClusterInput()
C = ClusterInput()
explode_pfoam = ExplodePFoam(PFoam=pfoam)  # -> PFVertices, PFEdges, PFFaces, PFCells
inspect_pfvertex = InspectPFVertex(PFVertex=explode_pfoam.PFVertices)  # -> ID, Point, External, PFEdges, PFFaces, Dual
separate_pfedges_by_type = SeparatePFEdgesByType(PFEdge=explode_pfoam.PFEdges)  # -> Internal, Force, External
inspect_pfedge = InspectPFEdge(PFEdge=separate_pfedges_by_type.Internal)  # -> ID, Line, External, Force, PFVertices, PPFFaces, Dual, Pair
mindex = MemberIndex(Set=inspect_pfvertex.ID, Member=M)  # -> Index, Count
inspect_pfface = InspectPFFace(PFFace=inspect_pfedge.Dual)  # -> ID, Mesh, External, Area, Plane, PFVertices, PFEdges, PFCell, Dual, Pair
item = ListItem(List=inspect_pfvertex.Point, Index=flatten(mindex.Index), Wrap=True)
bnd = Bounds(Numbers=inspect_pfedge.Force)
end = EndPoints(Curve=inspect_pfedge.Line)  # -> Start, End
vec2pt = Vector2Pt(PointA=end.Start, PointB=end.End, Unitize=False)  # -> Vector, Length
crv_cp = CurveClosestPoint(Point=item, Curve=C)  # -> Point, Parameter, Distance
deplane = DeconstructPlane(Plane=inspect_pfface.Plane)  # -> Origin, XAxis, YAxis, ZAxis
bnd_2 = Bounds(Numbers=crv_cp.Distance)
angle = Angle(VectorA=vec2pt.Vector, VectorB=deplane.ZAxis)  # -> Angle, Reflex
avr = Average(Input=crv_cp.Distance)
deg = Degrees(Radians=angle.Angle)
subtraction = Subtraction(A=deg, B=90)
abs = Absolute(Value=subtraction)
subtraction_2 = Subtraction(A=90, B=abs)
bnd_3 = Bounds(Numbers=subtraction_2)
avr_2 = Average(Input=subtraction_2)
I = ClusterOutput(bnd)
I_2 = ClusterOutput(bnd_3)
am = ClusterOutput(avr_2)
I_3 = ClusterOutput(bnd_2)
am_2 = ClusterOutput(avr)
