# Grasshopper definition friend-20-feet-oval-dome-ovalcrown-15x10-opentop-karamba.gh (Grasshopper 1.0.8)
# plug-ins: Karamba3D, PolyFrame 2

# ---- group: 1 Play here
branching_preset_guess = ValueList({"22 on 15 x 10 m: the round Nervi net (20 feet, 40 lines, 8 rings) STRETCHED 1.5x in x into an ellipse 15 x 10 m; force diagram squeezed 1/1.5 in x (affine rule); crown pulled onto a level OVAL 4.5 x 3 m, the 3 m circle stretched like the base (Scale Z 0.289)": 0}, selected="22 on 15 x 10 m: the round Nervi net (20 feet, 40 lines, 8 rings) STRETCHED 1.5x in x into an ellipse 15 x 10 m; force diagram squeezed 1/1.5 in x (affine rule); crown pulled onto a level OVAL 4.5 x 3 m, the 3 m circle stretched like the base (Scale Z 0.289)")
force_depth_scale_z = Slider(0.289, range=0.2..1.5)
plan_diameter_mm = Slider(10000, range=4000..16000)
ref_apex_mm = Slider(6670, range=1000..12000)

# ---- group: 2 Force diagram - GUESS diagrid, mirror-symmetric (PolyFrame build)
force_diagram_presets_guess = ForceDiagramPresetsGUESS(P=branching_preset_guess, Z=force_depth_scale_z)  # -> G, G_2
plan_wall_reference = PlanWallReference(A=plan_diameter_mm, Z=ref_apex_mm)  # -> G, G_2, G_3, V, G_4
pfbuild = PFBuild(Brep=flatten(force_diagram_presets_guess.G), AbsoluteTolerance=0.1, PlanarityTolerance=0.1)  # -> ForcePFoam, FormPFoam
support_ids = SupportIDs(pfoam=pfbuild.ForcePFoam, P=force_diagram_presets_guess.G_2)

# ---- group: 3 Stage A - exact algebraic, ALL 20 feet pinned (exact, 0 deg) (shown left)
algebraic_dual = AlgebraicDual(ForcePFoam=pfbuild.ForcePFoam, Scale=1, Flip=False, displayIndex=False, rcond=9.999999747e-06)  # -> AlgebraicForm, AlgebraicForce, FormPFoam
cull = CullPattern(List=flatten(support_ids), CullPattern=True)
algebraic_vertex_constraints = AlgebraicVertexConstraints(
    AlgebraicForm=algebraic_dual.AlgebraicForm,
    PFVertexIDs=cull,
    Constraints=plan_wall_reference.G_2,
    Scale=1,
    rcond=9.999999747e-06)  # -> AlgebraicForm, PFoam
check = Check(pfoam=algebraic_vertex_constraints.PFoam, M=support_ids, C=plan_wall_reference.G_3)  # -> I, I_2, am, I_3, am_2
pfpipe = PFPipe(PFoam=algebraic_vertex_constraints.PFoam, MinR=40, MaxR=120)  # -> Axes, Radius, Color, Pipe, Force
colour_by_force = ColourByForce(N=pfpipe.Force)
move = Move(Geometry=pfpipe.Pipe, Motion=plan_wall_reference.V)  # -> Geometry, Transform
stage_a_forces_dev_range_mean_dev_feet_t = Panel([check.I, check.I_2, check.am, check.I_3, check.am_2])  # "Stage A: forces | dev range | mean dev | feet-to-wall range | mean"
preview = CustomPreview(Geometry=move.Geometry, Material=colour_by_force)

# ---- group: 4 Stage B - pull the 20 feet onto their points AND the 40 crown nodes onto a level OVAL 4.5 x 3 m (crown stretched like the base), PFPerp
pfperp_iterations = Slider(300, range=0..3000)
pull_strength = Slider(10, range=0..100)
crown_half_length_x_mm = Slider(2250, range=500..5000)
crown_pull_strength = Slider(10, range=0..100)
crown_half_width_y_mm = Slider(1500, range=500..4000)
crown_node_ids = Integer([301, 302, 303, 304, 305, 306, 307, 308, 309, 310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])
pt = ConstructPoint(XCoordinate=0, YCoordinate=0, ZCoordinate=ref_apex_mm)
pfvertex_constraints = PFVertexConstraints(
    PFoam=algebraic_vertex_constraints.PFoam,
    PFVertexID=support_ids,
    Constraint=plan_wall_reference.G_2,
    Coefficient=pull_strength,
    On=True)
xy = XYPlane(Origin=pt)
ellipse = Ellipse(Plane=xy, Radius1=crown_half_length_x_mm, Radius2=crown_half_width_y_mm)  # -> Ellipse, Focus1, Focus2
dup = DuplicateData(Data=ellipse.Ellipse, Number=40, Order=True)
pfvertex_constraints_2 = PFVertexConstraints(PFoam=pfvertex_constraints, PFVertexID=crown_node_ids, Constraint=dup, Coefficient=crown_pull_strength, On=True)
pfperp = PFPerp(PFoam=pfvertex_constraints_2, MaxIteration=pfperp_iterations, Deviation=0.1, MinimumEdgeLength=10)  # -> PFoam, Deviation
check_2 = Check(pfoam=pfperp.PFoam, M=support_ids, C=plan_wall_reference.G_3)  # -> I, I_2, am, I_3, am_2
pfpipe_2 = PFPipe(PFoam=pfperp.PFoam, MinR=40, MaxR=120)  # -> Axes, Radius, Color, Pipe, Force
colour_by_force_2 = ColourByForce(N=pfpipe_2.Force)
stage_b_forces_dev_range_mean_dev_feet_t = Panel([check_2.I, check_2.I_2, check_2.am, check_2.I_3, check_2.am_2])  # "Stage B: forces | dev range | mean dev | feet-to-wall range | mean"
preview_2 = CustomPreview(Geometry=pfpipe_2.Pipe, Material=colour_by_force_2)
preview_3 = CustomPreview(Geometry=plan_wall_reference.G_4, Material=ColourSwatch(SwatchColor=RGBA(150, 150, 150, 70)))

# ---- group: 6 KARAMBA check: solved PolyFrame form -> beams (rib b x h), pinned feet, self-weight + casing load on the reference surface (LCase G); stresses vs 20 MPa compression and 2.9 MPa tension, as in the October model
debrep = DeconstructBrep(Brep=plan_wall_reference.G_4)  # -> Faces, Edges, Vertices
area = Area(Geometry=debrep.Faces)  # -> Area, Centroid
pdecon = Deconstruct(Point=area.Centroid)  # -> XComponent, YComponent, ZComponent
larger = LargerThan(FirstNumber=pdecon.ZComponent, SecondNumber=500)  # -> LargerThan, OrEqualTo
casing_faces_only = CullPattern(List=debrep.Faces, CullPattern=larger.LargerThan)
explode_pfoam = ExplodePFoam(PFoam=pfperp.PFoam)  # -> PFVertices, PFEdges, PFFaces, PFCells
rib_height_h_cm = Slider(25, range=10..60)
rib_width_b_cm = Slider(15, range=8..40)
casing_load_kn_m2_on_the_reference_surfa = Slider(7, range=0..15)  # "Casing load (kN/m2, on the reference surface)"
separate_half_edges = SeparateHalfEdges(PFEdge=explode_pfoam.PFEdges)  # -> Positive, Negative
separate_pfedges_by_type = SeparatePFEdgesByType(PFEdge=separate_half_edges.Positive)  # -> Internal, Force, External
inspect_pfedge = InspectPFEdge(PFEdge=separate_pfedges_by_type.Internal)  # -> ID, Line, External, Force, PFVertices, PPFFaces, Dual, Pair
isotrop = MaterialPropertiesKaramba3D(
    FamilyOfMaterial="Concrete",
    Name="C30/37 cast",
    YoungsModulus_kN_cm²=3280,
    InPlaneShearModulus_kN_cm²=1366.666667,
    TransverseShearModulus_kN_cm²=1366.666667,
    SpecificWeight_kN_m³=24,
    CoefficientOfThermalExpansion_1=1.2e-05,
    TensileStrength_kN_cm²=0.29,
    CompressiveStrength_kN_cm²=-2,
    StrengthHypothesis="MISES",
    mode="Isotrop")
end = EndPoints(Curve=inspect_pfedge.Line)  # -> Start, End
expr = Panel("-x")
trapezoid = CrossSectionKaramba3D(
    FamilyNameOfCrossSection="DefaultCroSec",
    NameOfCrossSection="rib",
    Material=isotrop,
    Height_cm=rib_height_h_cm,
    UpperFlangeWidth_cm=rib_width_b_cm,
    LowerFlangeWidth_cm=rib_width_b_cm,
    mode="Trapezoid")
cp = ClosestPoint(Point=plan_wall_reference.G_2, Cloud=flatten([end.Start, end.End]))  # -> ClosestPoint, CPIndex, Distance
mesh = MeshBrep(
    Brep=casing_faces_only,
    Settings={GridMaxCount=0, GridMinCount=16, JaggedSeams=False, MaxEdgeLength=0, MinEdgeLength=0.0001, MinTolerance=0, Refine=True, RefineAngle=0, RelativeTolerance=0.65, SimplePlanes=True, Tolerance=0})
eval = Evaluate(E=expr, x=casing_load_kn_m2_on_the_reference_surfa)
supp = SupportKaramba3D(PosInd=cp.ClosestPoint, Ct_kN_m=Vector(0, 0, 0), Cr_kNm_rad=Vector(0, 0, 0), menu=[buttons(on, on, on, off, off, off)])
gravity = LoadsKaramba3D(Vector=Vector(0, 0, -1), LCase="G", mode="Gravity")
linetobeam = CreateLinearElementKaramba3D(
    Line=inspect_pfedge.Line,
    Identifier="rib",
    CrossSection=trapezoid,
    LimitDistance_m=0.005,
    BucklingLengthY_m=-1,
    BucklingLengthZ_m=-1,
    BucklingLengthLT_m=-1,
    Bending=True,
    ToPolylineMaxAngle=0.25,
    ToPolylineTolerance=0.1,
    ToPolylineMaxEdgeLength=0.25,
    New=True,
    Remove=True,
    mode="LineToBeam",
    GuidGeneratorSeed=144241259)  # -> Element, Points, Info
vec = VectorXYZ(XComponent=0, YComponent=0, ZComponent=eval)  # -> Vector, Length
meshload_const = LoadsKaramba3D(
    Vector=vec.Vector,
    Mesh=mesh,
    LCase="G",
    MinimumLineLoadLength_m=0.5,
    mode="MeshLoad -Const.",
    menu=[buttons(off, on, off), buttons(on, off)])
assemble = AssembleModelKaramba3D(Elem=flatten(linetobeam.Element), Support=flatten(supp), Load=flatten([gravity, meshload_const]), LimitDistance_mm=0.005)  # -> Model, Info, Mass_kg, CentreOfGravity, LoadCaseNames
analysethii = AnalyseThIIKaramba3D(
    Model=assemble.Model,
    LoadCases="G",
    UseInitialNII=True,
    NIIFromCombination=True,
    NoTensionalNII=False,
    NoCompressiveNII=False,
    RTolerance=1e-07,
    MaxIterations=50)  # -> AnalysedModel, MaximumDisplacement_cm, ResultingForce_kN, ChangeOfElasticEnergy_kNm
analyse = AnalyseKaramba3D(Model=assemble.Model)  # -> AnalysedModel, MaximumDisplacement_cm, ResultingForce_kN, ChangeOfElasticEnergy_kNm
mass_kg = Panel(assemble.Mass_kg)
b_forces = BeamForcesKaramba3D(AnalysedModel=analyse.AnalysedModel, LoadCase="G", Ts=[0, 0.5, 1])  # -> Model, NormalForce_kN, ShearForceVz_kN, ShearForceVy_kN, TorsionalMomentMt_kNm, BendingMomentMy_kNm, BendingMomentMz_kNm, LoadCaseIndex
buckling_modes = BucklingModesKaramba3D(Model=analysethii.AnalysedModel, FromIndex=1, NumberOfModes=1, MaximumNumberOfIterations=300, Epsilon=1e-07)  # -> ModelWithBucklingModes, BucklingLoadFactors
react = ReactionForcesKaramba3D(AnalysedModel=analyse.AnalysedModel, LoadCase="G")  # -> Model, ReactionForces_kN, ReactionMoments_kNm, SupportPosition, SumOfReactionForces_kN, SumOfReactionMoments_kNm, GoverningLoadCaseIndex
max_displacement_cm = Panel(analyse.MaximumDisplacement_cm)
expr_2 = Panel("x*y")
expr_3 = Panel("x*y*y/6")
expr_4 = Panel("y*x*x/6")
modelview = ModelViewKaramba3D(Model=analyse.AnalysedModel)  # -> Model, DeformedMesh, DeformedAxes, DeformedModel, MaximumDeformation
bnd = Bounds(Numbers=b_forces.NormalForce_kN)
eval_2 = Evaluate(E=expr_2, x=rib_width_b_cm, y=rib_height_h_cm)
eval_3 = Evaluate(E=expr_3, x=rib_width_b_cm, y=rib_height_h_cm)
eval_4 = Evaluate(E=expr_4, x=rib_width_b_cm, y=rib_height_h_cm)
sum_of_reactions_kn = Panel(react.SumOfReactionForces_kN)
buckling_load_factor = Panel(buckling_modes.BucklingLoadFactors)
expr_5 = Panel("x/y")
expr_6 = Panel("abs(x)*100/y")
expr_7 = Panel("abs(x)*100/y")
beamview = BeamViewKaramba3D(Model=modelview.Model)  # -> Model, MeshesOfRenderedBeams, DeformedBeamAxes, LegendColours, LegendTags
eval_5 = Evaluate(E=expr_5, x=b_forces.NormalForce_kN, y=eval_2)
eval_6 = Evaluate(E=expr_6, x=b_forces.BendingMomentMy_kNm, y=eval_3)
eval_7 = Evaluate(E=expr_7, x=b_forces.BendingMomentMz_kNm, y=eval_4)
axial_force_n_range_kn_compression = Panel(bnd)
expr_8 = Panel("x-y")
expr_9 = Panel("x+y")
eval_8 = Evaluate(E=expr_8, x=eval_5, y=eval_6)
eval_9 = Evaluate(E=expr_9, x=eval_5, y=eval_6)
expr_10 = Panel("x-y")
expr_11 = Panel("x+y")
eval_10 = Evaluate(E=expr_10, x=eval_8, y=eval_7)
eval_11 = Evaluate(E=expr_11, x=eval_9, y=eval_7)
expr_12 = Panel("-x/2.0")
expr_13 = Panel("x/0.29")
eval_12 = Evaluate(E=expr_12, x=eval_10)
eval_13 = Evaluate(E=expr_13, x=eval_11)
bnd_2 = Bounds(Numbers=eval_12)
bnd_3 = Bounds(Numbers=eval_13)
compression_use_stress_20_mpa_min_max = Panel(bnd_2)
tension_stress_2_9_mpa_min_max = Panel(bnd_3)

# ---- group: 5 FINAL force diagram: PolyFrame Switch Form Force on the solved form (PFPerp), external cell removed, scaled 4x, shown green at y = +14 m
switch_form_force = SwitchFormForce(PFoam=pfperp.PFoam)
explode_pfoam_2 = ExplodePFoam(PFoam=switch_form_force)  # -> PFVertices, PFEdges, PFFaces, PFCells
inspect_pfcell = InspectPFCell(PFCell=explode_pfoam_2.PFCells)  # -> ID, Mesh, Centroid, External, PFVertices, PFEdges, PFFaces, Dual
not = GateNot(A=inspect_pfcell.External)
cull_2 = CullPattern(List=explode_pfoam_2.PFCells, CullPattern=not)
pfcell_to_brep = PFCellToBrep(PFCell=cull_2)
bbox = BoundingBox(Content=pfcell_to_brep, Plane=PlaneXY(0, 0, 0))  # -> Box, Box_2
pt_2 = ConstructPoint(XCoordinate=0, YCoordinate=16000, ZCoordinate=0)
boxprop = BoxProperties(Box=bbox.Box)  # -> Center, Diagonal, Area, Volume, Degeneracy
scale = Scale(Geometry=pfcell_to_brep, Center=boxprop.Center, Factor=4)  # -> Geometry, Transform
vec2pt = Vector2Pt(PointA=boxprop.Center, PointB=pt_2, Unitize=False)  # -> Vector, Length
move_2 = Move(Geometry=scale.Geometry, Motion=vec2pt.Vector)  # -> Geometry, Transform
preview_4 = CustomPreview(Geometry=move_2.Geometry, Material=ColourSwatch(SwatchColor=RGBA(120, 190, 120, 150)))

# ==== cluster ForceDiagramPresetsGUESS: Force diagram built as the plan dual of the graded #16c topology (ring counts 20,40 x8; cap ring radii in geometric progression 0.60 -> 0.94, ratio 1.066 per level): one cap cell per form node, cap points on 7 levels re-spaced for an even casing load, outer polygon edges aimed at the 20 feet, crown hole -> centre point; joined to one apex. Scale Z = cone depth.
P = ClusterInput()
Z = ClusterInput()
reaction_cell_centroids = Point([Point(0, -716.0740469, -250), Point(147.5193665, -681.0268885, -250), Point(280.5985096, -579.3160732, -250), Point(386.2107155, -420.8977643, -250), Point(454.0179257, -221.2790497, -250), Point(477.382698, 0, -250)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])
cells_presets = Brep([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])
branch = TreeBranch(Tree=cells_presets, Path=P, MaintainPaths=True)
branch_2 = TreeBranch(Tree=reaction_cell_centroids, Path=P, MaintainPaths=True)
scale_nu = ScaleNU(Geometry=branch, Plane=PlaneXY(0, 0, 0), ScaleX=1, ScaleY=1, ScaleZ=Z)  # -> Geometry, Transform
scale_nu_2 = ScaleNU(Geometry=branch_2, Plane=PlaneXY(0, 0, 0), ScaleX=1, ScaleY=1, ScaleZ=Z)  # -> Geometry, Transform
G = ClusterOutput(scale_nu.Geometry)
G_2 = ClusterOutput(scale_nu_2.Geometry)

# ==== cluster PlanWallReference: Circular plan: circle of diameter = Plan side, 20 foot targets every 18 deg starting at -Y, 4 of them (at -Y,+X,+Y,-X) pinned in stage A, grey reference cone
A = ClusterInput()
Z = ClusterInput()
division = Division(A=A, B=-2)
pt = ConstructPoint(XCoordinate=division, YCoordinate=division, ZCoordinate=0)
division_2 = Division(A=A, B=2)
multiplication = Multiplication(A=A, B=-1.9)
cir = Circle(Plane=Plane(origin=(0, 0, 0), x=(0, -1, 0), y=(1, 0, 0)), Radius=division_2)
X = UnitX(Factor=multiplication)
divide = DivideCurve(Curve=cir, Count=20, Kinks=False)  # -> Points, Tangents, Parameters
dup = DuplicateData(Data=cir, Number=16, Order=True)
pt_2 = ConstructPoint(XCoordinate=0, YCoordinate=0, ZCoordinate=Z)
cull = CullPattern(List=divide.Points, CullPattern=True)
cull_2 = CullPattern(
    List=divide.Points,
    CullPattern=[True, False, False, False, False, False, False, False, False, False, False, False, False, False, False, False, False, False, False, False])
pline = PolyLine(Vertices=cull_2, Closed=True)
boundary = BoundarySurfaces(Edges=cir)
cull_3 = CullPattern(List=cull, CullPattern=[True, False, False, False, False])
extr = ExtrudePoint(Base=boundary, Point=pt_2)
scale_nu = ScaleNU(Geometry=cull_3, Plane=PlaneXY(0, 0, 0), ScaleX=1.5, ScaleY=1, ScaleZ=1)  # -> Geometry, Transform
scale_nu_2 = ScaleNU(Geometry=cull, Plane=PlaneXY(0, 0, 0), ScaleX=1.5, ScaleY=1, ScaleZ=1)  # -> Geometry, Transform
scale_nu_3 = ScaleNU(Geometry=cir, Plane=PlaneXY(0, 0, 0), ScaleX=1.5, ScaleY=1, ScaleZ=1)  # -> Geometry, Transform
scale_nu_4 = ScaleNU(Geometry=extr, Plane=PlaneXY(0, 0, 0), ScaleX=1.5, ScaleY=1, ScaleZ=1)  # -> Geometry, Transform
G = ClusterOutput(scale_nu.Geometry)
G_2 = ClusterOutput(scale_nu_2.Geometry)
G_3 = ClusterOutput(scale_nu_3.Geometry)
V = ClusterOutput(X)
G_4 = ClusterOutput(scale_nu_4.Geometry)

# ==== cluster SupportIDs: Form vertices (= force cells) carrying the 20 reactions, in wall order along each side
pfoam = ClusterInput()
P = ClusterInput()
explode_pfoam = ExplodePFoam(PFoam=pfoam)  # -> PFVertices, PFEdges, PFFaces, PFCells
inspect_pfcell = InspectPFCell(PFCell=explode_pfoam.PFCells)  # -> ID, Mesh, Centroid, External, PFVertices, PFEdges, PFFaces, Dual
cps = ClosestPoints(Point=P, Cloud=inspect_pfcell.Centroid, Count=1)  # -> ClosestPoint, CPIndex, Distance
item = ListItem(List=inspect_pfcell.ID, Index=flatten(cps.CPIndex), Wrap=True)
i = ClusterOutput(item)

# ==== cluster ColourByForce: Blue = low compression, red = high (PFPipe force magnitude)
N = ClusterInput()
bnd = Bounds(Numbers=N)
remap = RemapNumbers(Value=N, Source=bnd, Target=Domain(0, 1))  # -> Mapped, Clipped
gradient = Gradient(
    LowerLimit=0,
    UpperLimit=1,
    Parameter=remap.Mapped,
    stops=[0: RGB(40, 90, 220), 0.5: RGB(150, 90, 200), 1: RGB(220, 40, 40)])
C = ClusterOutput(gradient)

# ==== cluster Check: Bar force range (+ = compression), deviation of bars from their force faces, distance of the 20 feet to the wall line
pfoam = ClusterInput()
M = ClusterInput()
C = ClusterInput()
explode_pfoam = ExplodePFoam(PFoam=pfoam)  # -> PFVertices, PFEdges, PFFaces, PFCells
inspect_pfvertex = InspectPFVertex(PFVertex=explode_pfoam.PFVertices)  # -> ID, Point, External, PFEdges, PFFaces, Dual
separate_pfedges_by_type = SeparatePFEdgesByType(PFEdge=explode_pfoam.PFEdges)  # -> Internal, Force, External
inspect_pfedge = InspectPFEdge(PFEdge=separate_pfedges_by_type.Internal)  # -> ID, Line, External, Force, PFVertices, PPFFaces, Dual, Pair
mindex = MemberIndex(Set=inspect_pfvertex.ID, Member=M)  # -> Index, Count
inspect_pfface = InspectPFFace(PFFace=inspect_pfedge.Dual)  # -> ID, Mesh, External, Area, Plane, PFVertices, PFEdges, PFCell, Dual, Pair
item = ListItem(List=inspect_pfvertex.Point, Index=flatten(mindex.Index), Wrap=True)
bnd = Bounds(Numbers=inspect_pfedge.Force)
end = EndPoints(Curve=inspect_pfedge.Line)  # -> Start, End
vec2pt = Vector2Pt(PointA=end.Start, PointB=end.End, Unitize=False)  # -> Vector, Length
crv_cp = CurveClosestPoint(Point=item, Curve=C)  # -> Point, Parameter, Distance
deplane = DeconstructPlane(Plane=inspect_pfface.Plane)  # -> Origin, XAxis, YAxis, ZAxis
bnd_2 = Bounds(Numbers=crv_cp.Distance)
angle = Angle(VectorA=vec2pt.Vector, VectorB=deplane.ZAxis)  # -> Angle, Reflex
avr = Average(Input=crv_cp.Distance)
deg = Degrees(Radians=angle.Angle)
subtraction = Subtraction(A=deg, B=90)
abs = Absolute(Value=subtraction)
subtraction_2 = Subtraction(A=90, B=abs)
bnd_3 = Bounds(Numbers=subtraction_2)
avr_2 = Average(Input=subtraction_2)
I = ClusterOutput(bnd)
I_2 = ClusterOutput(bnd_3)
am = ClusterOutput(avr_2)
I_3 = ClusterOutput(bnd_2)
am_2 = ClusterOutput(avr)
