# Grasshopper definition friend-20-feet-round-base-square-crown-opentop.gh (Grasshopper 1.0.8)
# plug-ins: PolyFrame 2

# ---- group: 1 Play here
branching_preset_guess = ValueList({"Nervi test on a CIRCULAR plan (r = 5 m, 20 feet every 18 deg): 20 feet as Y-buttresses, then a regular diamond net of 40 per ring, 8 rings with geometric spacing (cells shrink toward the crown, like the Palazzetto), no even-load re-spacing (Scale Z 0.289; bottom force level 0.90 so the grid starts 0.58 m up); all 20 feet pinned in stage A; stage B pulls the 40 crown nodes onto a level SQUARE (4.4 x 4.4 m, same area as the 2.5 m circle); about 37 deg off balance with sharp corners, less if you round them": 0}, selected="Nervi test on a CIRCULAR plan (r = 5 m, 20 feet every 18 deg): 20 feet as Y-buttresses, then a regular diamond net of 40 per ring, 8 rings with geometric spacing (cells shrink toward the crown, like the Palazzetto), no even-load re-spacing (Scale Z 0.289; bottom force level 0.90 so the grid starts 0.58 m up); all 20 feet pinned in stage A; stage B pulls the 40 crown nodes onto a level SQUARE (4.4 x 4.4 m, same area as the 2.5 m circle); about 37 deg off balance with sharp corners, less if you round them")
force_depth_scale_z = Slider(0.289, range=0.2..1.5)
plan_diameter_mm = Slider(10000, range=4000..16000)
ref_apex_mm = Slider(6670, range=1000..12000)

# ---- group: 2 Force diagram - GUESS diagrid, mirror-symmetric (PolyFrame build)
force_diagram_presets_guess = ForceDiagramPresetsGUESS(P=branching_preset_guess, Z=force_depth_scale_z)  # -> G, G_2
plan_wall_reference = PlanWallReference(A=plan_diameter_mm, Z=ref_apex_mm)  # -> L, L_2, C, V, E
pfbuild = PFBuild(Brep=flatten(force_diagram_presets_guess.G), AbsoluteTolerance=0.1, PlanarityTolerance=0.1)  # -> ForcePFoam, FormPFoam
support_ids = SupportIDs(pfoam=pfbuild.ForcePFoam, P=force_diagram_presets_guess.G_2)

# ---- group: 3 Stage A - exact algebraic, ALL 20 feet pinned (exact, 0 deg) (shown left)
algebraic_dual = AlgebraicDual(ForcePFoam=pfbuild.ForcePFoam, Scale=1, Flip=False, displayIndex=False, rcond=9.999999747e-06)  # -> AlgebraicForm, AlgebraicForce, FormPFoam
cull = CullPattern(List=flatten(support_ids), CullPattern=True)
algebraic_vertex_constraints = AlgebraicVertexConstraints(
    AlgebraicForm=algebraic_dual.AlgebraicForm,
    PFVertexIDs=cull,
    Constraints=plan_wall_reference.L_2,
    Scale=1,
    rcond=9.999999747e-06)  # -> AlgebraicForm, PFoam
check = Check(pfoam=algebraic_vertex_constraints.PFoam, M=support_ids, C=plan_wall_reference.C)  # -> I, I_2, am, I_3, am_2
pfpipe = PFPipe(PFoam=algebraic_vertex_constraints.PFoam, MinR=40, MaxR=120)  # -> Axes, Radius, Color, Pipe, Force
colour_by_force = ColourByForce(N=pfpipe.Force)
move = Move(Geometry=pfpipe.Pipe, Motion=plan_wall_reference.V)  # -> Geometry, Transform
stage_a_forces_dev_range_mean_dev_feet_t = Panel([check.I, check.I_2, check.am, check.I_3, check.am_2])  # "Stage A: forces | dev range | mean dev | feet-to-wall range | mean"
preview = CustomPreview(Geometry=move.Geometry, Material=colour_by_force)

# ---- group: 4 Stage B - pull the 20 feet onto their points AND the 40 crown nodes (PF ids 301-340) onto a level square (the thin line at the top), PFPerp
pfperp_iterations = Slider(1500, range=0..3000)
pull_strength = Slider(10, range=0..100)
crown_square_side_mm = Slider(4430, range=2000..7000)
crown_pull_strength = Slider(10, range=0..100)
crown_corner_rounding_mm = Slider(0, range=0..2000)
series = Series(Start=301, Step=1, Count=40)
pt = ConstructPoint(XCoordinate=0, YCoordinate=0, ZCoordinate=ref_apex_mm)
pfvertex_constraints = PFVertexConstraints(
    PFoam=algebraic_vertex_constraints.PFoam,
    PFVertexID=support_ids,
    Constraint=plan_wall_reference.L_2,
    Coefficient=pull_strength,
    On=True)
pl = ConstructPlane(Origin=pt, XAxis=Vector(1, 1, 0), YAxis=Vector(-1, 1, 0))
multiplication = Multiplication(A=crown_square_side_mm, B=0.70710678)
polygon = Polygon(Plane=pl, Radius=multiplication, Segments=4, FilletRadius=crown_corner_rounding_mm)  # -> Polygon, Length
dup = DuplicateData(Data=polygon.Polygon, Number=40, Order=True)
pfvertex_constraints_2 = PFVertexConstraints(PFoam=pfvertex_constraints, PFVertexID=series, Constraint=dup, Coefficient=crown_pull_strength, On=True)
pfperp = PFPerp(PFoam=pfvertex_constraints_2, MaxIteration=pfperp_iterations, Deviation=0.1, MinimumEdgeLength=10)  # -> PFoam, Deviation
check_2 = Check(pfoam=pfperp.PFoam, M=support_ids, C=plan_wall_reference.C)  # -> I, I_2, am, I_3, am_2
pfpipe_2 = PFPipe(PFoam=pfperp.PFoam, MinR=40, MaxR=120)  # -> Axes, Radius, Color, Pipe, Force
colour_by_force_2 = ColourByForce(N=pfpipe_2.Force)
stage_b_forces_dev_range_mean_dev_feet_t = Panel([check_2.I, check_2.I_2, check_2.am, check_2.I_3, check_2.am_2])  # "Stage B: forces | dev range | mean dev | feet-to-wall range | mean"
preview_2 = CustomPreview(Geometry=pfpipe_2.Pipe, Material=colour_by_force_2)
preview_3 = CustomPreview(Geometry=plan_wall_reference.E, Material=ColourSwatch(SwatchColor=RGBA(150, 150, 150, 70)))

# ==== cluster ForceDiagramPresetsGUESS: Force diagram built as the plan dual of the graded #16c topology (ring counts 20,40 x8; cap ring radii in geometric progression 0.60 -> 0.94, ratio 1.066 per level): one cap cell per form node, cap points on 7 levels re-spaced for an even casing load, outer polygon edges aimed at the 20 feet, crown hole -> centre point; joined to one apex. Scale Z = cone depth.
cells_presets = Brep([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])
reaction_cell_centroids = Point([Point(0, -716.0740469, -250), Point(221.2790497, -681.0268885, -250), Point(420.8977643, -579.3160732, -250), Point(579.3160732, -420.8977643, -250), Point(681.0268885, -221.2790497, -250), Point(716.0740469, 0, -250)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])
P = ClusterInput()
Z = ClusterInput()
branch = TreeBranch(Tree=cells_presets, Path=P, MaintainPaths=True)
branch_2 = TreeBranch(Tree=reaction_cell_centroids, Path=P, MaintainPaths=True)
scale_nu = ScaleNU(Geometry=branch, Plane=PlaneXY(0, 0, 0), ScaleX=1, ScaleY=1, ScaleZ=Z)  # -> Geometry, Transform
scale_nu_2 = ScaleNU(Geometry=branch_2, Plane=PlaneXY(0, 0, 0), ScaleX=1, ScaleY=1, ScaleZ=Z)  # -> Geometry, Transform
G = ClusterOutput(scale_nu.Geometry)
G_2 = ClusterOutput(scale_nu_2.Geometry)

# ==== cluster PlanWallReference: Circular plan: circle of diameter = Plan side, 20 foot targets every 18 deg starting at -Y, 4 of them (at -Y,+X,+Y,-X) pinned in stage A, grey reference cone
A = ClusterInput()
Z = ClusterInput()
division = Division(A=A, B=-2)
pt = ConstructPoint(XCoordinate=division, YCoordinate=division, ZCoordinate=0)
division_2 = Division(A=A, B=2)
cir = Circle(Plane=Plane(origin=(0, 0, 0), x=(0, -1, 0), y=(1, 0, 0)), Radius=division_2)
divide = DivideCurve(Curve=cir, Count=20, Kinks=False)  # -> Points, Tangents, Parameters
cull = CullPattern(
    List=divide.Points,
    CullPattern=[True, False, False, False, False, False, False, False, False, False, False, False, False, False, False, False, False, False, False, False])
cull_2 = CullPattern(List=divide.Points, CullPattern=True)
cull_3 = CullPattern(List=cull_2, CullPattern=[True, False, False, False, False])
dup = DuplicateData(Data=cir, Number=16, Order=True)
multiplication = Multiplication(A=A, B=-1.4)
X = UnitX(Factor=multiplication)
pline = PolyLine(Vertices=cull, Closed=True)
boundary = BoundarySurfaces(Edges=cir)
pt_2 = ConstructPoint(XCoordinate=0, YCoordinate=0, ZCoordinate=Z)
extr = ExtrudePoint(Base=boundary, Point=pt_2)
L = ClusterOutput(cull_3)
L_2 = ClusterOutput(cull_2)
C = ClusterOutput(cir)
V = ClusterOutput(X)
E = ClusterOutput(extr)

# ==== cluster SupportIDs: Form vertices (= force cells) carrying the 20 reactions, in wall order along each side
pfoam = ClusterInput()
P = ClusterInput()
explode_pfoam = ExplodePFoam(PFoam=pfoam)  # -> PFVertices, PFEdges, PFFaces, PFCells
inspect_pfcell = InspectPFCell(PFCell=explode_pfoam.PFCells)  # -> ID, Mesh, Centroid, External, PFVertices, PFEdges, PFFaces, Dual
cps = ClosestPoints(Point=P, Cloud=inspect_pfcell.Centroid, Count=1)  # -> ClosestPoint, CPIndex, Distance
item = ListItem(List=inspect_pfcell.ID, Index=flatten(cps.CPIndex), Wrap=True)
i = ClusterOutput(item)

# ==== cluster ColourByForce: Blue = low compression, red = high (PFPipe force magnitude)
N = ClusterInput()
bnd = Bounds(Numbers=N)
remap = RemapNumbers(Value=N, Source=bnd, Target=Domain(0, 1))  # -> Mapped, Clipped
gradient = Gradient(
    LowerLimit=0,
    UpperLimit=1,
    Parameter=remap.Mapped,
    stops=[0: RGB(40, 90, 220), 0.5: RGB(150, 90, 200), 1: RGB(220, 40, 40)])
C = ClusterOutput(gradient)

# ==== cluster Check: Bar force range (+ = compression), deviation of bars from their force faces, distance of the 20 feet to the wall line
pfoam = ClusterInput()
M = ClusterInput()
C = ClusterInput()
explode_pfoam = ExplodePFoam(PFoam=pfoam)  # -> PFVertices, PFEdges, PFFaces, PFCells
separate_pfedges_by_type = SeparatePFEdgesByType(PFEdge=explode_pfoam.PFEdges)  # -> Internal, Force, External
inspect_pfedge = InspectPFEdge(PFEdge=separate_pfedges_by_type.Internal)  # -> ID, Line, External, Force, PFVertices, PPFFaces, Dual, Pair
bnd = Bounds(Numbers=inspect_pfedge.Force)
end = EndPoints(Curve=inspect_pfedge.Line)  # -> Start, End
vec2pt = Vector2Pt(PointA=end.Start, PointB=end.End, Unitize=False)  # -> Vector, Length
inspect_pfface = InspectPFFace(PFFace=inspect_pfedge.Dual)  # -> ID, Mesh, External, Area, Plane, PFVertices, PFEdges, PFCell, Dual, Pair
deplane = DeconstructPlane(Plane=inspect_pfface.Plane)  # -> Origin, XAxis, YAxis, ZAxis
angle = Angle(VectorA=vec2pt.Vector, VectorB=deplane.ZAxis)  # -> Angle, Reflex
deg = Degrees(Radians=angle.Angle)
subtraction = Subtraction(A=deg, B=90)
abs = Absolute(Value=subtraction)
subtraction_2 = Subtraction(A=90, B=abs)
bnd_2 = Bounds(Numbers=subtraction_2)
avr = Average(Input=subtraction_2)
inspect_pfvertex = InspectPFVertex(PFVertex=explode_pfoam.PFVertices)  # -> ID, Point, External, PFEdges, PFFaces, Dual
mindex = MemberIndex(Set=inspect_pfvertex.ID, Member=M)  # -> Index, Count
item = ListItem(List=inspect_pfvertex.Point, Index=flatten(mindex.Index), Wrap=True)
crv_cp = CurveClosestPoint(Point=item, Curve=C)  # -> Point, Parameter, Distance
bnd_3 = Bounds(Numbers=crv_cp.Distance)
avr_2 = Average(Input=crv_cp.Distance)
I = ClusterOutput(bnd)
I_2 = ClusterOutput(bnd_2)
am = ClusterOutput(avr)
I_3 = ClusterOutput(bnd_3)
am_2 = ClusterOutput(avr_2)
