# Grasshopper definition friend-24-feet-corners-graded-gradual-crown3m-onerib-karamba.gh (Grasshopper 1.0.8)
# plug-ins: Karamba3D

# ---- group: KARAMBA one rib of 19 (trial-size, 8 beams): rib cut from the solved PolyFrame form; at each node the forces of the rest of the roof (own load share of self-weight + 7 kN/m2 casing, plus the cut bars' compression, from PolyFrame); pinned at the foot and at the crown ring
rib_bars_from_solved_polyframe_19 = Line([Line((0, -4996.8, -0.4), (124, -4729.9, 693)), Line((124, -4729.9, 693), (0, -4339.2, 1709.8)), Line((0, -4339.2, 1709.8), (-266.5, -3895.5, 2804.2)), Line((-266.5, -3895.5, 2804.2), (-563.9, -3367.9, 3975)), Line((-563.9, -3367.9, 3975), (-914.3, -2959.6, 4635.8)), Line((-914.3, -2959.6, 4635.8), (-1090.5, -2639.1, 5072.7)), Line((-1090.5, -2639.1, 5072.7), (-799, -1982.2, 6051.9)), Line((-799, -1982.2, 6051.9), (-690.7, -1354.2, 6685.3))])
rib_node_positions = Point([Point(124, -4729.9, 693), Point(0, -4339.2, 1709.8), Point(-266.5, -3895.5, 2804.2), Point(-563.9, -3367.9, 3975), Point(-914.3, -2959.6, 4635.8), Point(-1090.5, -2639.1, 5072.7), Point(-799, -1982.2, 6051.9)])
forces_from_the_rest_of_the_roof_kn = Vector([Vector(-10.45292722, -6.732858998, -20.97368884), Vector(-1.883317801, 0.1300662701, -1.207218125), Vector(0.1091997542, -0.5007787735, -2.029420765), Vector(-3.045674987, -2.631858116, -0.8569149782), Vector(3.094944317, 3.087814241, -1.783083062), Vector(9.59115748, 3.787285757, 6.953760254), Vector(-4.523303861, -1.679152083, -1.719858086)])
unused_supports_list = Point([Point(0, -4996.8, -0.4), Point(-690.7, -1354.2, 6685.3)])
crown_ring_node_pinned = Point(Point(-690.7, -1354.2, 6685.3))
foot_pinned_no_spin_about_the_rib_axis = Point(Point(0, -4996.8, -0.4))
rib_height_h_cm = Slider(25, range=10..60)
rib_width_b_cm = Slider(15, range=8..40)
isotrop = MaterialPropertiesKaramba3D(
    FamilyOfMaterial="Concrete",
    Name="C30/37 cast",
    YoungsModulus_kN_cm²=3280,
    InPlaneShearModulus_kN_cm²=1366.666667,
    TransverseShearModulus_kN_cm²=1366.666667,
    SpecificWeight_kN_m³=24,
    CoefficientOfThermalExpansion_1=1.2e-05,
    TensileStrength_kN_cm²=0.29,
    CompressiveStrength_kN_cm²=-2,
    StrengthHypothesis="MISES",
    mode="Isotrop")
trapezoid = CrossSectionKaramba3D(
    FamilyNameOfCrossSection="DefaultCroSec",
    NameOfCrossSection="rib",
    Material=isotrop,
    Height_cm=rib_height_h_cm,
    UpperFlangeWidth_cm=rib_width_b_cm,
    LowerFlangeWidth_cm=rib_width_b_cm,
    mode="Trapezoid")
linetobeam = CreateLinearElementKaramba3D(
    Line=rib_bars_from_solved_polyframe_19,
    Identifier="rib",
    CrossSection=trapezoid,
    LimitDistance_m=0.005,
    BucklingLengthY_m=-1,
    BucklingLengthZ_m=-1,
    BucklingLengthLT_m=-1,
    Bending=True,
    ToPolylineMaxAngle=0.25,
    ToPolylineTolerance=0.1,
    ToPolylineMaxEdgeLength=0.25,
    New=True,
    Remove=True,
    mode="LineToBeam",
    GuidGeneratorSeed=41170416)  # -> Element, Points, Info
supp = SupportKaramba3D(
    PosInd=crown_ring_node_pinned,
    Ct_kN_m=Vector(0, 0, 0),
    Cr_kNm_rad=Vector(0, 0, 0),
    menu=[buttons(on, on, on, off, off, off)])
supp_2 = SupportKaramba3D(
    PosInd=foot_pinned_no_spin_about_the_rib_axis,
    PlaneOfReference=Plane(origin=(0, -4996.8, -0.4), x=(-0.0903480534, 0.4764757772, 0.8745330543), y=(-0.9824933344, -0.1862977396, 0)),
    Ct_kN_m=Vector(0, 0, 0),
    Cr_kNm_rad=Vector(0, 0, 0),
    Dofs=3,
    menu=[buttons(on, on, on, off, off, off)])
pointload = LoadsKaramba3D(ForceVector=forces_from_the_rest_of_the_roof_kn, Local=False, PosInd=rib_node_positions, LCase="G", mode="Point")
assemble = AssembleModelKaramba3D(Elem=flatten(linetobeam.Element), Support=flatten([supp_2, supp_2]), Load=flatten(pointload), LimitDistance_mm=0.005)  # -> Model, Info, Mass_kg, CentreOfGravity, LoadCaseNames
analyse = AnalyseKaramba3D(Model=assemble.Model)  # -> AnalysedModel, MaximumDisplacement_cm, ResultingForce_kN, ChangeOfElasticEnergy_kNm
react = ReactionForcesKaramba3D(AnalysedModel=analyse.AnalysedModel, LoadCase="G")  # -> Model, ReactionForces_kN, ReactionMoments_kNm, SupportPosition, SumOfReactionForces_kN, SumOfReactionMoments_kNm, GoverningLoadCaseIndex
b_forces = BeamForcesKaramba3D(AnalysedModel=analyse.AnalysedModel, LoadCase="G", Ts=[0, 0.25, 0.5, 0.75, 1])  # -> Model, NormalForce_kN, ShearForceVz_kN, ShearForceVy_kN, TorsionalMomentMt_kNm, BendingMomentMy_kNm, BendingMomentMz_kNm, LoadCaseIndex
modelview = ModelViewKaramba3D(Model=analyse.AnalysedModel)  # -> Model, DeformedMesh, DeformedAxes, DeformedModel, MaximumDeformation
beamview = BeamViewKaramba3D(Model=modelview.Model)  # -> Model, MeshesOfRenderedBeams, DeformedBeamAxes, LegendColours, LegendTags
