# Grasshopper definition friend-24-feet-corners-graded-gradual-crown3m-opentop-karamba.gh (Grasshopper 1.0.8)
# plug-ins: Karamba3D, PolyFrame 2

# ---- group: 1 Play here
branching_preset_guess = ValueList({"19 GRADUAL: 24 feet (corners + 5 per side), lines per ring 48-48-40-40-32-32-24-24 (8 lines merge every second ring, 3-way joints, symmetric), crown nodes pulled onto a level 3 m circle (Scale Z 0.300)": 0}, selected="19 GRADUAL: 24 feet (corners + 5 per side), lines per ring 48-48-40-40-32-32-24-24 (8 lines merge every second ring, 3-way joints, symmetric), crown nodes pulled onto a level 3 m circle (Scale Z 0.300)")
force_depth_scale_z = Slider(0.3, range=0.2..1.5)
plan_side_mm = Slider(10000, range=4000..16000)
ref_apex_mm = Slider(6670, range=1000..12000)

# ---- group: 2 Force diagram - GUESS diagrid, mirror-symmetric (PolyFrame build)
force_diagram_presets_guess = ForceDiagramPresetsGUESS(P=branching_preset_guess, Z=force_depth_scale_z)  # -> G, G_2
plan_wall_reference = PlanWallReference(A=plan_side_mm, Z=ref_apex_mm)  # -> L, L_2, R, V, E
pfbuild = PFBuild(Brep=flatten(force_diagram_presets_guess.G), AbsoluteTolerance=0.1, PlanarityTolerance=0.1)  # -> ForcePFoam, FormPFoam
support_ids = SupportIDs(pfoam=pfbuild.ForcePFoam, P=force_diagram_presets_guess.G_2)

# ---- group: 3 Stage A - exact algebraic, 4 mid-side feet pinned (shown left)
algebraic_dual = AlgebraicDual(ForcePFoam=pfbuild.ForcePFoam, Scale=1, Flip=False, displayIndex=False, rcond=9.999999747e-06)  # -> AlgebraicForm, AlgebraicForce, FormPFoam
cull = CullPattern(List=flatten(support_ids), CullPattern=[False, False, False, True, False, False])
algebraic_vertex_constraints = AlgebraicVertexConstraints(
    AlgebraicForm=algebraic_dual.AlgebraicForm,
    PFVertexIDs=cull,
    Constraints=plan_wall_reference.L,
    Scale=1,
    rcond=9.999999747e-06)  # -> AlgebraicForm, PFoam
check = Check(pfoam=algebraic_vertex_constraints.PFoam, M=support_ids, C=plan_wall_reference.R)  # -> I, I_2, am, I_3, am_2
pfpipe = PFPipe(PFoam=algebraic_vertex_constraints.PFoam, MinR=40, MaxR=120)  # -> Axes, Radius, Color, Pipe, Force
colour_by_force = ColourByForce(N=pfpipe.Force)
move = Move(Geometry=pfpipe.Pipe, Motion=plan_wall_reference.V)  # -> Geometry, Transform
stage_a_forces_dev_range_mean_dev_feet_t = Panel([check.I, check.I_2, check.am, check.I_3, check.am_2])  # "Stage A: forces | dev range | mean dev | feet-to-wall range | mean"
preview = CustomPreview(Geometry=move.Geometry, Material=colour_by_force)

# ---- group: 4 Stage B - pull the 24 feet onto their points AND the 24 crown nodes onto a level 3 m circle, PFPerp
pfperp_iterations = Slider(300, range=0..3000)
pull_strength = Slider(10, range=0..100)
crown_radius_mm = Slider(1500, range=500..4000)
crown_pull_strength = Slider(10, range=0..100)
crown_node_ids = Integer([289, 290, 291, 292, 293, 294, 295, 296, 297, 298, 299, 300, 301, 302, 303, 304, 305, 306, 307, 308, 309, 310, 311, 312])
pt = ConstructPoint(XCoordinate=0, YCoordinate=0, ZCoordinate=ref_apex_mm)
pfvertex_constraints = PFVertexConstraints(
    PFoam=algebraic_vertex_constraints.PFoam,
    PFVertexID=support_ids,
    Constraint=plan_wall_reference.L_2,
    Coefficient=pull_strength,
    On=True)
xy = XYPlane(Origin=pt)
cir = Circle(Plane=xy, Radius=crown_radius_mm)
dup = DuplicateData(Data=cir, Number=24, Order=True)
pfvertex_constraints_2 = PFVertexConstraints(PFoam=pfvertex_constraints, PFVertexID=crown_node_ids, Constraint=dup, Coefficient=crown_pull_strength, On=True)
pfperp = PFPerp(PFoam=pfvertex_constraints_2, MaxIteration=pfperp_iterations, Deviation=0.1, MinimumEdgeLength=10)  # -> PFoam, Deviation
check_2 = Check(pfoam=pfperp.PFoam, M=support_ids, C=plan_wall_reference.R)  # -> I, I_2, am, I_3, am_2
pfpipe_2 = PFPipe(PFoam=pfperp.PFoam, MinR=40, MaxR=120)  # -> Axes, Radius, Color, Pipe, Force
colour_by_force_2 = ColourByForce(N=pfpipe_2.Force)
stage_b_forces_dev_range_mean_dev_feet_t = Panel([check_2.I, check_2.I_2, check_2.am, check_2.I_3, check_2.am_2])  # "Stage B: forces | dev range | mean dev | feet-to-wall range | mean"
preview_2 = CustomPreview(Geometry=pfpipe_2.Pipe, Material=colour_by_force_2)
preview_3 = CustomPreview(Geometry=plan_wall_reference.E, Material=ColourSwatch(SwatchColor=RGBA(150, 150, 150, 70)))

# ---- group: 5 FINAL force diagram: PolyFrame Switch Form Force on the solved form (PFPerp), external cell removed, scaled 4x, shown green at y = +14 m
switch_form_force = SwitchFormForce(PFoam=pfperp.PFoam)
explode_pfoam = ExplodePFoam(PFoam=switch_form_force)  # -> PFVertices, PFEdges, PFFaces, PFCells
inspect_pfcell = InspectPFCell(PFCell=explode_pfoam.PFCells)  # -> ID, Mesh, Centroid, External, PFVertices, PFEdges, PFFaces, Dual
not = GateNot(A=inspect_pfcell.External)
cull_2 = CullPattern(List=explode_pfoam.PFCells, CullPattern=not)
pfcell_to_brep = PFCellToBrep(PFCell=cull_2)
bbox = BoundingBox(Content=pfcell_to_brep, Plane=PlaneXY(0, 0, 0))  # -> Box, Box_2
pt_2 = ConstructPoint(XCoordinate=0, YCoordinate=14000, ZCoordinate=0)
boxprop = BoxProperties(Box=bbox.Box)  # -> Center, Diagonal, Area, Volume, Degeneracy
scale = Scale(Geometry=pfcell_to_brep, Center=boxprop.Center, Factor=4)  # -> Geometry, Transform
vec2pt = Vector2Pt(PointA=boxprop.Center, PointB=pt_2, Unitize=False)  # -> Vector, Length
move_2 = Move(Geometry=scale.Geometry, Motion=vec2pt.Vector)  # -> Geometry, Transform
preview_4 = CustomPreview(Geometry=move_2.Geometry, Material=ColourSwatch(SwatchColor=RGBA(120, 190, 120, 150)))

# ---- group: 6 KARAMBA check: solved PolyFrame form -> beams (rib b x h), pinned feet, self-weight + casing load on the reference surface (LCase G); stresses vs 20 MPa compression and 2.9 MPa tension, as in the October model
explode_pfoam_2 = ExplodePFoam(PFoam=pfperp.PFoam)  # -> PFVertices, PFEdges, PFFaces, PFCells
rib_height_h_cm = Slider(25, range=10..60)
rib_width_b_cm = Slider(15, range=8..40)
casing_load_kn_m2_on_the_reference_surfa = Slider(3, range=0..15)  # "Casing load (kN/m2, on the reference surface)"
separate_half_edges = SeparateHalfEdges(PFEdge=explode_pfoam_2.PFEdges)  # -> Positive, Negative
separate_pfedges_by_type = SeparatePFEdgesByType(PFEdge=separate_half_edges.Positive)  # -> Internal, Force, External
debrep = DeconstructBrep(Brep=plan_wall_reference.E)  # -> Faces, Edges, Vertices
inspect_pfedge = InspectPFEdge(PFEdge=separate_pfedges_by_type.Internal)  # -> ID, Line, External, Force, PFVertices, PPFFaces, Dual, Pair
area = Area(Geometry=debrep.Faces)  # -> Area, Centroid
isotrop = MaterialPropertiesKaramba3D(
    FamilyOfMaterial="Concrete",
    Name="C30/37 cast",
    YoungsModulus_kN_cm²=3280,
    InPlaneShearModulus_kN_cm²=1366.666667,
    TransverseShearModulus_kN_cm²=1366.666667,
    SpecificWeight_kN_m³=24,
    CoefficientOfThermalExpansion_1=1.2e-05,
    TensileStrength_kN_cm²=0.29,
    CompressiveStrength_kN_cm²=-2,
    StrengthHypothesis="MISES",
    mode="Isotrop")
end = EndPoints(Curve=inspect_pfedge.Line)  # -> Start, End
pdecon = Deconstruct(Point=area.Centroid)  # -> XComponent, YComponent, ZComponent
expr = Panel("-x")
trapezoid = CrossSectionKaramba3D(
    FamilyNameOfCrossSection="DefaultCroSec",
    NameOfCrossSection="rib",
    Material=isotrop,
    Height_cm=rib_height_h_cm,
    UpperFlangeWidth_cm=rib_width_b_cm,
    LowerFlangeWidth_cm=rib_width_b_cm,
    mode="Trapezoid")
cp = ClosestPoint(Point=plan_wall_reference.L_2, Cloud=flatten([end.Start, end.End]))  # -> ClosestPoint, CPIndex, Distance
larger = LargerThan(FirstNumber=pdecon.ZComponent, SecondNumber=500)  # -> LargerThan, OrEqualTo
eval = Evaluate(E=expr, x=casing_load_kn_m2_on_the_reference_surfa)
supp = SupportKaramba3D(PosInd=cp.ClosestPoint, Ct_kN_m=Vector(0, 0, 0), Cr_kNm_rad=Vector(0, 0, 0), menu=[buttons(on, on, on, off, off, off)])
gravity = LoadsKaramba3D(Vector=Vector(0, 0, -1), LCase="G", mode="Gravity")
linetobeam = CreateLinearElementKaramba3D(
    Line=inspect_pfedge.Line,
    Identifier="rib",
    CrossSection=trapezoid,
    LimitDistance_m=0.005,
    BucklingLengthY_m=-1,
    BucklingLengthZ_m=-1,
    BucklingLengthLT_m=-1,
    Bending=True,
    ToPolylineMaxAngle=0.25,
    ToPolylineTolerance=0.1,
    ToPolylineMaxEdgeLength=0.25,
    New=True,
    Remove=True,
    mode="LineToBeam",
    GuidGeneratorSeed=554899982)  # -> Element, Points, Info
vec = VectorXYZ(XComponent=0, YComponent=0, ZComponent=eval)  # -> Vector, Length
casing_faces_only = CullPattern(List=debrep.Faces, CullPattern=larger.LargerThan)
mesh = MeshBrep(
    Brep=casing_faces_only,
    Settings={GridMaxCount=0, GridMinCount=16, JaggedSeams=False, MaxEdgeLength=0, MinEdgeLength=0.0001, MinTolerance=0, Refine=True, RefineAngle=0, RelativeTolerance=0.65, SimplePlanes=True, Tolerance=0})
meshload_const = LoadsKaramba3D(
    Vector=vec.Vector,
    Mesh=mesh,
    LCase="G",
    MinimumLineLoadLength_m=0.5,
    mode="MeshLoad -Const.",
    menu=[buttons(off, on, off), buttons(on, off)])
expr_2 = Panel("x*y")
expr_3 = Panel("x*y*y/6")
expr_4 = Panel("y*x*x/6")
eval_2 = Evaluate(E=expr_2, x=rib_width_b_cm, y=rib_height_h_cm)
eval_3 = Evaluate(E=expr_3, x=rib_width_b_cm, y=rib_height_h_cm)
eval_4 = Evaluate(E=expr_4, x=rib_width_b_cm, y=rib_height_h_cm)
expr_5 = Panel("x/y")
expr_6 = Panel("abs(x)*100/y")
expr_7 = Panel("abs(x)*100/y")
expr_8 = Panel("x-y")
expr_9 = Panel("x+y")
expr_10 = Panel("x-y")
expr_11 = Panel("x+y")
expr_12 = Panel("-x/2.0")
expr_13 = Panel("x/0.29")

# ---- group: 7 TYPHOON (SHORT = 1.0 weight + 1.0 wind): qp on the 4 sloped casing faces, normal to each face, cpe as in the October model; type G or SHORT in the load-case panel
typhoon_peak_pressure_qp_kn_m2_assumed_v = Slider(2.6, range=0..5)  # "Typhoon peak pressure qp (kN/m2) - assumed, V0 46 m/s"
wind_blows_toward_deg_from_x = Slider(0, range=0..360)
load_case_to_show_g_long_weight_short_we = Panel("SHORT")  # "Load case to show (G = LONG weight, SHORT = weight + typhoon)"
area_2 = Area(Geometry=casing_faces_only)  # -> Area, Centroid
srf_cp = SurfaceClosestPoint(Point=area_2.Centroid, Surface=casing_faces_only)  # -> Point, UVPoint, Distance
pdecon_2 = Deconstruct(Point=area_2.Centroid)  # -> XComponent, YComponent, ZComponent
expr_14 = Panel("cos(x*Pi/180)")
expr_15 = Panel("sin(x*Pi/180)")
evalsrf = EvaluateSurface(Surface=casing_faces_only, Point=srf_cp.UVPoint)  # -> Point, Normal, UDirection, VDirection, Frame
vec_2 = VectorXYZ(XComponent=pdecon_2.XComponent, YComponent=pdecon_2.YComponent, ZComponent=0)  # -> Vector, Length
eval_5 = Evaluate(E=expr_14, x=wind_blows_toward_deg_from_x)
eval_6 = Evaluate(E=expr_15, x=wind_blows_toward_deg_from_x)
dprod = DotProduct(VectorA=evalsrf.Normal, VectorB=vec_2.Vector, Unitize=True)
vec_3 = VectorXYZ(XComponent=eval_5, YComponent=eval_6, ZComponent=0)  # -> Vector, Length
expr_16 = Panel("If(x < 0, -1, 1)")
eval_7 = Evaluate(E=expr_16, x=dprod)
multiplication = Multiplication(A=evalsrf.Normal, B=eval_7)
unit = UnitVector(Vector=multiplication)
devec = DeconstructVector(Vector=unit)  # -> XComponent, YComponent, ZComponent
mesh_2 = MeshBrep(
    Brep=casing_faces_only,
    Settings={GridMaxCount=0, GridMinCount=16, JaggedSeams=False, MaxEdgeLength=0, MinEdgeLength=0.0001, MinTolerance=0, Refine=True, RefineAngle=0, RelativeTolerance=0.65, SimplePlanes=True, Tolerance=0})
vec_4 = VectorXYZ(XComponent=devec.XComponent, YComponent=devec.YComponent, ZComponent=0)  # -> Vector, Length
dprod_2 = DotProduct(VectorA=vec_4.Vector, VectorB=vec_3.Vector, Unitize=True)
expr_17 = Panel("If(x < -0.7, 0.7, If(x > 0.7, -0.6, -0.7))")
cpe_windward_0_7_leeward_0_6_sides_0_7_o = Evaluate(E=expr_17, x=dprod_2)  # "cpe: windward +0.7, leeward -0.6, sides -0.7 (October model)"
expr_18 = Panel("-x*y")
eval_8 = Evaluate(E=expr_18, x=cpe_windward_0_7_leeward_0_6_sides_0_7_o, y=typhoon_peak_pressure_qp_kn_m2_assumed_v)
multiplication_2 = Multiplication(A=unit, B=eval_8)
wind_on_casing = LoadsKaramba3D(
    Vector=multiplication_2,
    Mesh=mesh_2,
    LCase="SHORT",
    MinimumLineLoadLength_m=0.5,
    mode="MeshLoad -Const.",
    menu=[buttons(off, on, off), buttons(on, off)])
meshload_const_2 = LoadsKaramba3D(
    Vector=vec.Vector,
    Mesh=mesh,
    LCase="SHORT",
    MinimumLineLoadLength_m=0.5,
    mode="MeshLoad -Const.",
    menu=[buttons(off, on, off), buttons(on, off)])
gravity_2 = LoadsKaramba3D(Vector=Vector(0, 0, -1), LCase="SHORT", mode="Gravity")

# ---- group: 6 KARAMBA check: solved PolyFrame form -> beams (rib b x h), pinned feet, self-weight + casing load on the reference surface (LCase G); stresses vs 20 MPa compression and 2.9 MPa tension, as in the October model (continued)
assemble = AssembleModelKaramba3D(
    Elem=flatten(linetobeam.Element),
    Support=flatten(supp),
    Load=flatten([gravity, meshload_const, wind_on_casing, gravity_2, meshload_const_2]),
    LimitDistance_mm=0.005)  # -> Model, Info, Mass_kg, CentreOfGravity, LoadCaseNames
analysethii = AnalyseThIIKaramba3D(
    Model=assemble.Model,
    LoadCases="G",
    UseInitialNII=True,
    NIIFromCombination=True,
    NoTensionalNII=False,
    NoCompressiveNII=False,
    RTolerance=1e-07,
    MaxIterations=50)  # -> AnalysedModel, MaximumDisplacement_cm, ResultingForce_kN, ChangeOfElasticEnergy_kNm
analyse = AnalyseKaramba3D(Model=assemble.Model)  # -> AnalysedModel, MaximumDisplacement_cm, ResultingForce_kN, ChangeOfElasticEnergy_kNm
mass_kg = Panel(assemble.Mass_kg)
b_forces = BeamForcesKaramba3D(AnalysedModel=analyse.AnalysedModel, LoadCase=load_case_to_show_g_long_weight_short_we, Ts=[0, 0.5, 1])  # -> Model, NormalForce_kN, ShearForceVz_kN, ShearForceVy_kN, TorsionalMomentMt_kNm, BendingMomentMy_kNm, BendingMomentMz_kNm, LoadCaseIndex
buckling_modes = BucklingModesKaramba3D(Model=analysethii.AnalysedModel, FromIndex=1, NumberOfModes=1, MaximumNumberOfIterations=300, Epsilon=1e-07)  # -> ModelWithBucklingModes, BucklingLoadFactors
react = ReactionForcesKaramba3D(AnalysedModel=analyse.AnalysedModel, LoadCase=load_case_to_show_g_long_weight_short_we)  # -> Model, ReactionForces_kN, ReactionMoments_kNm, SupportPosition, SumOfReactionForces_kN, SumOfReactionMoments_kNm, GoverningLoadCaseIndex
max_displacement_cm = Panel(analyse.MaximumDisplacement_cm)
modelview = ModelViewKaramba3D(Model=analyse.AnalysedModel, LoadCase=load_case_to_show_g_long_weight_short_we)  # -> Model, DeformedMesh, DeformedAxes, DeformedModel, MaximumDeformation
bnd = Bounds(Numbers=b_forces.NormalForce_kN)
sum_of_reactions_kn = Panel(react.SumOfReactionForces_kN)
buckling_load_factor = Panel(buckling_modes.BucklingLoadFactors)
beamview = BeamViewKaramba3D(Model=modelview.Model)  # -> Model, MeshesOfRenderedBeams, DeformedBeamAxes, LegendColours, LegendTags
eval_9 = Evaluate(E=expr_5, x=b_forces.NormalForce_kN, y=eval_2)
eval_10 = Evaluate(E=expr_6, x=b_forces.BendingMomentMy_kNm, y=eval_3)
eval_11 = Evaluate(E=expr_7, x=b_forces.BendingMomentMz_kNm, y=eval_4)
axial_force_n_range_kn_compression = Panel(bnd)
eval_12 = Evaluate(E=expr_8, x=eval_9, y=eval_10)
eval_13 = Evaluate(E=expr_9, x=eval_9, y=eval_10)
eval_14 = Evaluate(E=expr_10, x=eval_12, y=eval_11)
eval_15 = Evaluate(E=expr_11, x=eval_13, y=eval_11)
eval_16 = Evaluate(E=expr_12, x=eval_14)
eval_17 = Evaluate(E=expr_13, x=eval_15)
bnd_2 = Bounds(Numbers=eval_16)
bnd_3 = Bounds(Numbers=eval_17)
compression_use_stress_20_mpa_min_max = Panel(bnd_2)
tension_stress_2_9_mpa_min_max = Panel(bnd_3)

# ==== cluster ForceDiagramPresetsGUESS: Force diagram built as the plan dual of the graded #16c topology (ring counts 24,48,48,48,48,48,24,24 with corner feet; odd number of 48-rings so the split and the merge are both mirror-symmetric): one cap cell per form node, cap points on 7 levels re-spaced for an even casing load, outer polygon edges aimed at the 20 feet, crown hole -> centre point; joined to one apex. Scale Z = cone depth.
P = ClusterInput()
Z = ClusterInput()
reaction_cell_centroids = Point([Point(-508.2666039, -508.2666039, -250), Point(-370.2460931, -616.1044792, -250), Point(-201.3957505, -690.0279219, -250), Point(0, -718.7975245, -250), Point(201.3957505, -690.0279219, -250), Point(370.2460931, -616.1044792, -250)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])
cells_presets = Brep([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])
branch = TreeBranch(Tree=cells_presets, Path=P, MaintainPaths=True)
branch_2 = TreeBranch(Tree=reaction_cell_centroids, Path=P, MaintainPaths=True)
scale_nu = ScaleNU(Geometry=branch, Plane=PlaneXY(0, 0, 0), ScaleX=1, ScaleY=1, ScaleZ=Z)  # -> Geometry, Transform
scale_nu_2 = ScaleNU(Geometry=branch_2, Plane=PlaneXY(0, 0, 0), ScaleX=1, ScaleY=1, ScaleZ=Z)  # -> Geometry, Transform
G = ClusterOutput(scale_nu.Geometry)
G_2 = ClusterOutput(scale_nu_2.Geometry)

# ==== cluster PlanWallReference: Square plan: 20 foot targets (5 per side, side/5 from each corner, 0.15 x side apart), 4 mid-side points, wall line, grey reference pyramid
A = ClusterInput()
Z = ClusterInput()
division = Division(A=A, B=-2)
pt = ConstructPoint(XCoordinate=division, YCoordinate=division, ZCoordinate=0)
multiplication = Multiplication(A=A, B=-1.4)
rectangle = Rectangle(Plane=pt, XSize=A, YSize=A, Radius=0)  # -> Rectangle, Length
X = UnitX(Factor=multiplication)
divide = DivideCurve(Curve=rectangle.Rectangle, Count=80, Kinks=False)  # -> Points, Tangents, Parameters
dup = DuplicateData(Data=rectangle.Rectangle, Number=16, Order=True)
pt_2 = ConstructPoint(XCoordinate=0, YCoordinate=0, ZCoordinate=Z)
cull = CullPattern(
    List=divide.Points,
    CullPattern=[True, False, False, False, True, False, False, True, False, False, True, False, False, True, False, False, True, False, False, False])
cull_2 = CullPattern(
    List=divide.Points,
    CullPattern=[True, False, False, False, False, False, False, False, False, False, False, False, False, False, False, False, False, False, False, False])
pline = PolyLine(Vertices=cull_2, Closed=True)
boundary = BoundarySurfaces(Edges=pline)
cull_3 = CullPattern(List=cull, CullPattern=[False, False, False, True, False, False])
extr = ExtrudePoint(Base=boundary, Point=pt_2)
L = ClusterOutput(cull_3)
L_2 = ClusterOutput(cull)
R = ClusterOutput(rectangle.Rectangle)
V = ClusterOutput(X)
E = ClusterOutput(extr)

# ==== cluster SupportIDs: Form vertices (= force cells) carrying the 20 reactions, in wall order along each side
pfoam = ClusterInput()
P = ClusterInput()
explode_pfoam = ExplodePFoam(PFoam=pfoam)  # -> PFVertices, PFEdges, PFFaces, PFCells
inspect_pfcell = InspectPFCell(PFCell=explode_pfoam.PFCells)  # -> ID, Mesh, Centroid, External, PFVertices, PFEdges, PFFaces, Dual
cps = ClosestPoints(Point=P, Cloud=inspect_pfcell.Centroid, Count=1)  # -> ClosestPoint, CPIndex, Distance
item = ListItem(List=inspect_pfcell.ID, Index=flatten(cps.CPIndex), Wrap=True)
i = ClusterOutput(item)

# ==== cluster ColourByForce: Blue = low compression, red = high (PFPipe force magnitude)
N = ClusterInput()
bnd = Bounds(Numbers=N)
remap = RemapNumbers(Value=N, Source=bnd, Target=Domain(0, 1))  # -> Mapped, Clipped
gradient = Gradient(
    LowerLimit=0,
    UpperLimit=1,
    Parameter=remap.Mapped,
    stops=[0: RGB(40, 90, 220), 0.5: RGB(150, 90, 200), 1: RGB(220, 40, 40)])
C = ClusterOutput(gradient)

# ==== cluster Check: Bar force range (+ = compression), deviation of bars from their force faces, distance of the 20 feet to the wall line
pfoam = ClusterInput()
M = ClusterInput()
C = ClusterInput()
explode_pfoam = ExplodePFoam(PFoam=pfoam)  # -> PFVertices, PFEdges, PFFaces, PFCells
inspect_pfvertex = InspectPFVertex(PFVertex=explode_pfoam.PFVertices)  # -> ID, Point, External, PFEdges, PFFaces, Dual
separate_pfedges_by_type = SeparatePFEdgesByType(PFEdge=explode_pfoam.PFEdges)  # -> Internal, Force, External
inspect_pfedge = InspectPFEdge(PFEdge=separate_pfedges_by_type.Internal)  # -> ID, Line, External, Force, PFVertices, PPFFaces, Dual, Pair
mindex = MemberIndex(Set=inspect_pfvertex.ID, Member=M)  # -> Index, Count
inspect_pfface = InspectPFFace(PFFace=inspect_pfedge.Dual)  # -> ID, Mesh, External, Area, Plane, PFVertices, PFEdges, PFCell, Dual, Pair
item = ListItem(List=inspect_pfvertex.Point, Index=flatten(mindex.Index), Wrap=True)
bnd = Bounds(Numbers=inspect_pfedge.Force)
end = EndPoints(Curve=inspect_pfedge.Line)  # -> Start, End
vec2pt = Vector2Pt(PointA=end.Start, PointB=end.End, Unitize=False)  # -> Vector, Length
crv_cp = CurveClosestPoint(Point=item, Curve=C)  # -> Point, Parameter, Distance
deplane = DeconstructPlane(Plane=inspect_pfface.Plane)  # -> Origin, XAxis, YAxis, ZAxis
bnd_2 = Bounds(Numbers=crv_cp.Distance)
angle = Angle(VectorA=vec2pt.Vector, VectorB=deplane.ZAxis)  # -> Angle, Reflex
avr = Average(Input=crv_cp.Distance)
deg = Degrees(Radians=angle.Angle)
subtraction = Subtraction(A=deg, B=90)
abs = Absolute(Value=subtraction)
subtraction_2 = Subtraction(A=90, B=abs)
bnd_3 = Bounds(Numbers=subtraction_2)
avr_2 = Average(Input=subtraction_2)
I = ClusterOutput(bnd)
I_2 = ClusterOutput(bnd_3)
am = ClusterOutput(avr_2)
I_3 = ClusterOutput(bnd_2)
am_2 = ClusterOutput(avr)
