# Grasshopper definition friend-A-4corners.gh (Grasshopper 1.0.8)
# plug-ins: PolyFrame 2

# ---- group: 1 Sliders - play here
density_n = Slider(1.2, range=0.8..3)
cone_depth_mm = Slider(375, range=200..1000)
plan_side_mm = Slider(10000, range=4000..16000)
ref_apex_mm = Slider(6670, range=1000..12000)

# ---- group: 2 Force diagram (PolyFrame build)
pyramid_force_diagram = PyramidForceDiagram(B=density_n, x=cone_depth_mm, R=plan_side_mm, Z=ref_apex_mm)  # -> cells_2, C, P, E
pfbuild = PFBuild(Brep=flatten(pyramid_force_diagram.cells_2), AbsoluteTolerance=0.1, PlanarityTolerance=0.1)  # -> ForcePFoam, FormPFoam
support_ids = SupportIDs(pfoam=pfbuild.ForcePFoam, P=pyramid_force_diagram.C)

# ---- group: 3 Exact algebraic form, 4 corners pinned
algebraic_dual = AlgebraicDual(ForcePFoam=pfbuild.ForcePFoam, Scale=1, Flip=False, displayIndex=False, rcond=9.999999747e-06)  # -> AlgebraicForm, AlgebraicForce, FormPFoam
algebraic_vertex_constraints = AlgebraicVertexConstraints(
    AlgebraicForm=algebraic_dual.AlgebraicForm,
    PFVertexIDs=support_ids,
    Constraints=pyramid_force_diagram.P,
    Scale=1,
    rcond=9.999999747e-06)  # -> AlgebraicForm, PFoam

# ---- group: 4 Display + check
bar_force_check = BarForceCheck(pfoam=algebraic_vertex_constraints.PFoam)
pfpipe = PFPipe(PFoam=algebraic_vertex_constraints.PFoam, MinR=40, MaxR=120)  # -> Axes, Radius, Color, Pipe, Force
colour_by_force = ColourByForce(N=pfpipe.Force)
bar_force_range = Panel(bar_force_check)
preview = CustomPreview(Geometry=pfpipe.Pipe, Material=colour_by_force)
preview_2 = CustomPreview(Geometry=pyramid_force_diagram.E, Material=ColourSwatch(SwatchColor=RGBA(150, 150, 150, 70)))

# ==== cluster PyramidForceDiagram: Square cone force diagram: hex lattice inside a 45-deg square, Delaunay, each triangle joined to a point below. Cap faces = vertical loads, the 4 side faces = the 4 support reactions.
B = ClusterInput()
x = ClusterInput()
R = ClusterInput()
Z = ClusterInput()
division = Division(A=333.3333333, B=B)
hexgrid = Hexagonal(Plane=PlaneXY(0, 0, 0), Size=division, ExtentX=41, ExtentY=41)  # -> Cells, Points
item = ListItem(List=flatten(hexgrid.Points), Index=840, Wrap=True)
polygon = Polygon(Plane=item, Radius=1000, Segments=4, FilletRadius=0)  # -> Polygon, Length
incurve = PointInCurve(Point=flatten(hexgrid.Points), Curve=polygon.Polygon)  # -> Relationship, Point
larger = LargerThan(FirstNumber=incurve.Relationship, SecondNumber=1)  # -> LargerThan, OrEqualTo
cull = CullPattern(List=incurve.Point, CullPattern=larger.LargerThan)
disc = Discontinuity(Curve=polygon.Polygon, Level=1)  # -> Points, Parameters
merge = Merge(Data1=disc.Points, Data2=cull)
del = DelaunayMesh(Points=flatten(merge), Plane=PlaneXY(0, 0, 0))
faceb = FaceBoundaries(Mesh=del)
boundary = BoundarySurfaces(Edges=graft(faceb))
neg = Negative(Value=x)
Z_2 = UnitZ(Factor=neg)
move = Move(Geometry=item, Motion=Z_2)  # -> Geometry, Transform
extr = ExtrudePoint(Base=boundary, Point=move.Geometry)
cells = Brep(flatten(extr))
eval = EvaluateLength(Curve=polygon.Polygon, Length=[0.125, 0.375, 0.625, 0.875], Normalized=True)  # -> Point, Tangent, Parameter
meshcp = MeshClosestPoint(Point=eval.Point, Mesh=del)  # -> Point, Index, Parameter
item_2 = ListItem(List=cells, Index=meshcp.Index, Wrap=True)
volume = Volume(Geometry=item_2)  # -> Volume, Centroid
polygon_2 = Polygon(Plane=PlaneXY(0, 0, 0), Radius=R, Segments=4, FilletRadius=0)  # -> Polygon, Length
eval_2 = EvaluateLength(Curve=polygon_2.Polygon, Length=[0.125, 0.375, 0.625, 0.875], Normalized=True)  # -> Point, Tangent, Parameter
pline = PolyLine(Vertices=eval_2.Point, Closed=True)
boundary_2 = BoundarySurfaces(Edges=pline)
pt = ConstructPoint(XCoordinate=0, YCoordinate=0, ZCoordinate=Z)
extr_2 = ExtrudePoint(Base=boundary_2, Point=pt)
cells_2 = ClusterOutput(cells)
C = ClusterOutput(volume.Centroid)
P = ClusterOutput(eval_2.Point)
E = ClusterOutput(extr_2)

# ==== cluster SupportIDs: Finds the form vertices (= force cells) that carry the 4 reactions
pfoam = ClusterInput()
P = ClusterInput()
explode_pfoam = ExplodePFoam(PFoam=pfoam)  # -> PFVertices, PFEdges, PFFaces, PFCells
inspect_pfcell = InspectPFCell(PFCell=explode_pfoam.PFCells)  # -> ID, Mesh, Centroid, External, PFVertices, PFEdges, PFFaces, Dual
cps = ClosestPoints(Point=P, Cloud=inspect_pfcell.Centroid, Count=1)  # -> ClosestPoint, CPIndex, Distance
item = ListItem(List=inspect_pfcell.ID, Index=flatten(cps.CPIndex), Wrap=True)
i = ClusterOutput(item)

# ==== cluster ColourByForce: Blue = low compression, red = high (PFPipe force magnitude)
N = ClusterInput()
bnd = Bounds(Numbers=N)
remap = RemapNumbers(Value=N, Source=bnd, Target=Domain(0, 1))  # -> Mapped, Clipped
gradient = Gradient(
    LowerLimit=0,
    UpperLimit=1,
    Parameter=remap.Mapped,
    stops=[0: RGB(40, 90, 220), 0.5: RGB(150, 90, 200), 1: RGB(220, 40, 40)])
C = ClusterOutput(gradient)

# ==== cluster BarForceCheck: Signed force range of all bars (+ = compression, a negative minimum = tension somewhere)
pfoam = ClusterInput()
explode_pfoam = ExplodePFoam(PFoam=pfoam)  # -> PFVertices, PFEdges, PFFaces, PFCells
separate_pfedges_by_type = SeparatePFEdgesByType(PFEdge=explode_pfoam.PFEdges)  # -> Internal, Force, External
inspect_pfedge = InspectPFEdge(PFEdge=separate_pfedges_by_type.Internal)  # -> ID, Line, External, Force, PFVertices, PPFFaces, Dual, Pair
bnd = Bounds(Numbers=inspect_pfedge.Force)
I = ClusterOutput(bnd)
