# Grasshopper definition friend-A-shell.gh (Grasshopper 1.0.8)
# plug-ins: PolyFrame 2

# ---- group: 1 Force diagram = PF example 3(7) (play: Force depth)
brep = Brep([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])
force_depth_scale_z = Slider(0.66, range=0.3..2)
scale_nu = ScaleNU(Geometry=brep, Plane=PlaneXY(0, 0, 0), ScaleX=1, ScaleY=1, ScaleZ=force_depth_scale_z)  # -> Geometry, Transform
pfbuild = PFBuild(Brep=flatten(scale_nu.Geometry), AbsoluteTolerance=0.1, PlanarityTolerance=0.1)  # -> Force, Form
dual_scale = Slider(100, range=0..100)
algebraic_dual = AlgebraicDual(Force=pfbuild.Force, Scale=dual_scale, Flip=False, displayIndex=False, rcond=0)  # -> AlgebraicForm, AlgebraicForce, PFoam

# ---- group: 2 Supports: 4 plan corners (play: Plan side)
plan_side_mm = Slider(10000, range=4000..16000)
# Notes: PolyFrame example 3(7) 'single-layer shell', adapted: same force diagram, supports moved to the 4 corners of the 10x10 plan, force depth (Scale Z) tuned for apex ~6.67 m. Two short bars on the free-edge arches (IDs 113, 126) flip to tension when the shell gets taller; Algebraic Edge Constraints keeps them at a positive length (exact algebraic, 0 deg). Edge IDs are only valid for this force diagram.
ref_apex_mm = Slider(6670, range=1000..12000)
plan_reference = PlanReference(R=plan_side_mm, Z=ref_apex_mm)  # -> P, E
support_vertex_ids_from_the_example = Panel("""92
91
89
90""")
constraint_scale = Slider(0, range=-1000..1000)
algebraic_vertex_constraints = AlgebraicVertexConstraints(
    AlgebraicSolution=algebraic_dual.AlgebraicForm,
    VertexIndices=support_vertex_ids_from_the_example,
    Points=plan_reference.P,
    Scale=constraint_scale,
    rcond=9.999999747e-06)  # -> AlgebraicSolution, PFoam

# ---- group: 3 Keep the 2 arch edges in compression
arch_edge_length_mm = Slider(300, range=50..1500)
arch_edge_ids = Panel("""113
126""")
dup = DuplicateData(Data=arch_edge_length_mm, Number=2, Order=True)
algebraic_edge_constraints = AlgebraicEdgeConstraints(
    AlgebraicPFoam=algebraic_vertex_constraints.AlgebraicSolution,
    PFEdgeIndices=arch_edge_ids,
    Length=dup,
    Scale=1,
    rcond=9.999999747e-06)  # -> AlgebraicPFoam, PFoam

# ---- group: 4 Display + check
bar_force_check = BarForceCheck(pfoam=algebraic_edge_constraints.PFoam)
pfpipe = PFPipe(PFoam=algebraic_edge_constraints.PFoam, MinR=40, MaxR=120)  # -> Axes, Radius, Color, Pipe, Force
colour_by_force = ColourByForce(N=pfpipe.Force)
bar_force_range = Panel(bar_force_check)
preview = CustomPreview(Geometry=pfpipe.Pipe, Material=colour_by_force)
preview_2 = CustomPreview(Geometry=plan_reference.E, Material=ColourSwatch(SwatchColor=RGBA(150, 150, 150, 70)))

# ==== cluster PlanReference: 4 corner points of the square plan (order (-,+),(-,-),(+,-),(+,+) = example's vertex IDs) and the grey 53.1 deg reference pyramid
R = ClusterInput()
Z = ClusterInput()
polygon = Polygon(Plane=PlaneXY(0, 0, 0), Radius=R, Segments=4, FilletRadius=0)  # -> Polygon, Length
eval = EvaluateLength(Curve=polygon.Polygon, Length=[0.375, 0.625, 0.875, 0.125], Normalized=True)  # -> Point, Tangent, Parameter
pline = PolyLine(Vertices=eval.Point, Closed=True)
pt = ConstructPoint(XCoordinate=0, YCoordinate=0, ZCoordinate=Z)
boundary = BoundarySurfaces(Edges=pline)
extr = ExtrudePoint(Base=boundary, Point=pt)
P = ClusterOutput(eval.Point)
E = ClusterOutput(extr)

# ==== cluster ColourByForce: Blue = low compression, red = high (PFPipe force magnitude)
N = ClusterInput()
bnd = Bounds(Numbers=N)
remap = RemapNumbers(Value=N, Source=bnd, Target=Domain(0, 1))  # -> Mapped, Clipped
gradient = Gradient(
    LowerLimit=0,
    UpperLimit=1,
    Parameter=remap.Mapped,
    stops=[0: RGB(40, 90, 220), 0.5: RGB(150, 90, 200), 1: RGB(220, 40, 40)])
C = ClusterOutput(gradient)

# ==== cluster BarForceCheck: Signed force range of all bars (+ = compression; a negative minimum = tension somewhere)
pfoam = ClusterInput()
explode_pfoam = ExplodePFoam(PFoam=pfoam)  # -> PFVertices, PFEdges, PFFaces, PFCells
separate_pfedges_by_type = SeparatePFEdgesByType(PFEdge=explode_pfoam.PFEdges)  # -> Internal, Force, External
inspect_pfedge = InspectPFEdge(PFEdge=separate_pfedges_by_type.Internal)  # -> ID, Line, External, Force, PFVertices, PPFFaces, Dual, Pair
bnd = Bounds(Numbers=inspect_pfedge.Force)
I = ClusterOutput(bnd)
