# Grasshopper definition friend-AP8-buttresses.gh (Grasshopper 1.0.8)
# plug-ins: PolyFrame 2

# ---- group: 1 Sliders - play here
density_n = Slider(1.2, range=0.8..2.5)
octagon_proportion = Slider(0.8, range=0.6..1.3)
cone_depth_mm = Slider(280, range=150..800)
plan_side_mm = Slider(10000, range=4000..16000)
ref_apex_mm = Slider(6670, range=1000..12000)

# ---- group: 2 Force diagram (PolyFrame build)
octagon_force_diagram = OctagonForceDiagram(B=density_n, A=octagon_proportion, x=cone_depth_mm, A_2=plan_side_mm, Z=ref_apex_mm)  # -> cells_2, C, P, D, R, V, E
pfbuild = PFBuild(Brep=flatten(octagon_force_diagram.cells_2), AbsoluteTolerance=0.1, PlanarityTolerance=0.1)  # -> ForcePFoam, FormPFoam
support_ids = SupportIDs(pfoam=pfbuild.ForcePFoam, P=octagon_force_diagram.C)

# ---- group: 3 Stage A - algebraic, 8 feet pinned (over-constrained = best fit, not exact; shown left)
algebraic_dual = AlgebraicDual(ForcePFoam=pfbuild.ForcePFoam, Scale=1, Flip=False, displayIndex=False, rcond=9.999999747e-06)  # -> AlgebraicForm, AlgebraicForce, FormPFoam
algebraic_vertex_constraints = AlgebraicVertexConstraints(
    AlgebraicForm=algebraic_dual.AlgebraicForm,
    PFVertexIDs=support_ids,
    Constraints=octagon_force_diagram.P,
    Scale=1,
    rcond=9.999999747e-06)  # -> AlgebraicForm, PFoam
check = Check(pfoam=algebraic_vertex_constraints.PFoam, M=support_ids, C=octagon_force_diagram.R)  # -> I, I_2, am, I_3, am_2
pfpipe = PFPipe(PFoam=algebraic_vertex_constraints.PFoam, MinR=40, MaxR=120)  # -> Axes, Radius, Color, Pipe, Force
colour_by_force = ColourByForce(N=pfpipe.Force)
move = Move(Geometry=pfpipe.Pipe, Motion=octagon_force_diagram.V)  # -> Geometry, Transform
stage_a_forces_dev_range_mean_dev_feet_t = Panel([check.I, check.I_2, check.am, check.I_3, check.am_2])  # "Stage A: forces | dev range | mean dev | feet-to-wall range | mean"
preview = CustomPreview(Geometry=move.Geometry, Material=colour_by_force)

# ---- group: 4 Stage B - pull 8 feet onto wall line, PFPerp
pfperp_iterations = Slider(1000, range=0..3000)
pull_strength = Slider(10, range=0..100)
pfvertex_constraints = PFVertexConstraints(
    PFoam=algebraic_vertex_constraints.PFoam,
    PFVertexID=support_ids,
    Constraint=octagon_force_diagram.D,
    Coefficient=pull_strength,
    On=True)
pfperp = PFPerp(PFoam=pfvertex_constraints, MaxIteration=pfperp_iterations, Deviation=0.1, MinimumEdgeLength=10)  # -> PFoam, Deviation
check_2 = Check(pfoam=pfperp.PFoam, M=support_ids, C=octagon_force_diagram.R)  # -> I, I_2, am, I_3, am_2
pfpipe_2 = PFPipe(PFoam=pfperp.PFoam, MinR=40, MaxR=120)  # -> Axes, Radius, Color, Pipe, Force
colour_by_force_2 = ColourByForce(N=pfpipe_2.Force)
stage_b_forces_dev_range_mean_dev_feet_t = Panel([check_2.I, check_2.I_2, check_2.am, check_2.I_3, check_2.am_2])  # "Stage B: forces | dev range | mean dev | feet-to-wall range | mean"
preview_2 = CustomPreview(Geometry=pfpipe_2.Pipe, Material=colour_by_force_2)
preview_3 = CustomPreview(Geometry=octagon_force_diagram.E, Material=ColourSwatch(SwatchColor=RGBA(150, 150, 150, 70)))

# ==== cluster OctagonForceDiagram: Cone force diagram on an octagon cap: hex lattice inside a square with cut corners, Delaunay, each triangle joined to a point below. Cap faces = vertical loads; the 8 side faces = 8 reactions (diagonal edges -> corner buttresses, straight edges -> mid-side buttresses). Octagon proportion < 1 makes the mid-side reactions smaller.
B = ClusterInput()
A = ClusterInput()
x = ClusterInput()
A_2 = ClusterInput()
Z = ClusterInput()
division = Division(A=333.3333333, B=B)
hexgrid = Hexagonal(Plane=PlaneXY(0, 0, 0), Size=division, ExtentX=41, ExtentY=41)  # -> Cells, Points
item = ListItem(List=flatten(hexgrid.Points), Index=840, Wrap=True)
multiplication = Multiplication(A=A, B=-0.1767767)
division_2 = Division(A=A_2, B=-2)
rectangle = Rectangle(Plane=item, XSize=Domain(-923.8795, 923.8795), YSize=Domain(-923.8795, 923.8795), Radius=0)  # -> Rectangle, Length
addition = Addition(A=multiplication, B=0.25)
pt = ConstructPoint(XCoordinate=division_2, YCoordinate=division_2, ZCoordinate=0)
multiplication_2 = Multiplication(A=A_2, B=-1.4)
multiplication_3 = Multiplication(A=addition, B=[-1, 1, -1, 1, -1, 1, -1, 1])
rectangle_2 = Rectangle(Plane=pt, XSize=A_2, YSize=A_2, Radius=0)  # -> Rectangle, Length
neg = Negative(Value=x)
X = UnitX(Factor=multiplication_2)
divide = DivideCurve(Curve=rectangle_2.Rectangle, Count=8, Kinks=False)  # -> Points, Tangents, Parameters
addition_2 = Addition(A=multiplication_3, B=[1, 0, 0.25, 0.25, 0.5, 0.5, 0.75, 0.75])
Z_2 = UnitZ(Factor=neg)
eval = EvaluateLength(Curve=rectangle.Rectangle, Length=addition_2, Normalized=True)  # -> Point, Tangent, Parameter
move = Move(Geometry=item, Motion=Z_2)  # -> Geometry, Transform
dup = DuplicateData(Data=rectangle_2.Rectangle, Number=8, Order=True)
pline = PolyLine(Vertices=eval.Point, Closed=True)
pline_2 = PolyLine(Vertices=divide.Points, Closed=True)
incurve = PointInCurve(Point=flatten(hexgrid.Points), Curve=pline)  # -> Relationship, Point
explode = Explode(Curve=pline, Recursive=True)  # -> Segments, Vertices
pt_2 = ConstructPoint(XCoordinate=0, YCoordinate=0, ZCoordinate=Z)
boundary = BoundarySurfaces(Edges=pline_2)
larger = LargerThan(FirstNumber=incurve.Relationship, SecondNumber=1)  # -> LargerThan, OrEqualTo
midpt = CurveMiddle(Curve=explode.Segments)
extr = ExtrudePoint(Base=boundary, Point=pt_2)
cull = CullPattern(List=incurve.Point, CullPattern=larger.LargerThan)
merge = Merge(Data1=eval.Point, Data2=cull)
del = DelaunayMesh(Points=flatten(merge), Plane=PlaneXY(0, 0, 0))
faceb = FaceBoundaries(Mesh=del)
meshcp = MeshClosestPoint(Point=midpt, Mesh=del)  # -> Point, Index, Parameter
boundary_2 = BoundarySurfaces(Edges=graft(faceb))
extr_2 = ExtrudePoint(Base=boundary_2, Point=move.Geometry)
P = ClusterOutput(divide.Points)
D = ClusterOutput(dup)
R = ClusterOutput(rectangle_2.Rectangle)
V = ClusterOutput(X)
E = ClusterOutput(extr)
cells = Brep(flatten(extr_2))
cells_2 = ClusterOutput(cells)
item_2 = ListItem(List=cells, Index=meshcp.Index, Wrap=True)
volume = Volume(Geometry=item_2)  # -> Volume, Centroid
C = ClusterOutput(volume.Centroid)

# ==== cluster SupportIDs: Form vertices (= force cells) carrying the 8 reactions, in wall order: corner, mid, corner, ...
pfoam = ClusterInput()
P = ClusterInput()
explode_pfoam = ExplodePFoam(PFoam=pfoam)  # -> PFVertices, PFEdges, PFFaces, PFCells
inspect_pfcell = InspectPFCell(PFCell=explode_pfoam.PFCells)  # -> ID, Mesh, Centroid, External, PFVertices, PFEdges, PFFaces, Dual
cps = ClosestPoints(Point=P, Cloud=inspect_pfcell.Centroid, Count=1)  # -> ClosestPoint, CPIndex, Distance
item = ListItem(List=inspect_pfcell.ID, Index=flatten(cps.CPIndex), Wrap=True)
i = ClusterOutput(item)

# ==== cluster ColourByForce: Blue = low compression, red = high (PFPipe force magnitude)
N = ClusterInput()
bnd = Bounds(Numbers=N)
remap = RemapNumbers(Value=N, Source=bnd, Target=Domain(0, 1))  # -> Mapped, Clipped
gradient = Gradient(
    LowerLimit=0,
    UpperLimit=1,
    Parameter=remap.Mapped,
    stops=[0: RGB(40, 90, 220), 0.5: RGB(150, 90, 200), 1: RGB(220, 40, 40)])
C = ClusterOutput(gradient)

# ==== cluster Check: Bar force range (+ = compression), deviation of bars from their force faces, distance of the 8 feet to the wall line
pfoam = ClusterInput()
M = ClusterInput()
C = ClusterInput()
explode_pfoam = ExplodePFoam(PFoam=pfoam)  # -> PFVertices, PFEdges, PFFaces, PFCells
inspect_pfvertex = InspectPFVertex(PFVertex=explode_pfoam.PFVertices)  # -> ID, Point, External, PFEdges, PFFaces, Dual
separate_pfedges_by_type = SeparatePFEdgesByType(PFEdge=explode_pfoam.PFEdges)  # -> Internal, Force, External
inspect_pfedge = InspectPFEdge(PFEdge=separate_pfedges_by_type.Internal)  # -> ID, Line, External, Force, PFVertices, PPFFaces, Dual, Pair
mindex = MemberIndex(Set=inspect_pfvertex.ID, Member=M)  # -> Index, Count
inspect_pfface = InspectPFFace(PFFace=inspect_pfedge.Dual)  # -> ID, Mesh, External, Area, Plane, PFVertices, PFEdges, PFCell, Dual, Pair
item = ListItem(List=inspect_pfvertex.Point, Index=flatten(mindex.Index), Wrap=True)
bnd = Bounds(Numbers=inspect_pfedge.Force)
end = EndPoints(Curve=inspect_pfedge.Line)  # -> Start, End
vec2pt = Vector2Pt(PointA=end.Start, PointB=end.End, Unitize=False)  # -> Vector, Length
crv_cp = CurveClosestPoint(Point=item, Curve=C)  # -> Point, Parameter, Distance
deplane = DeconstructPlane(Plane=inspect_pfface.Plane)  # -> Origin, XAxis, YAxis, ZAxis
bnd_2 = Bounds(Numbers=crv_cp.Distance)
angle = Angle(VectorA=vec2pt.Vector, VectorB=deplane.ZAxis)  # -> Angle, Reflex
avr = Average(Input=crv_cp.Distance)
deg = Degrees(Radians=angle.Angle)
subtraction = Subtraction(A=deg, B=90)
abs = Absolute(Value=subtraction)
subtraction_2 = Subtraction(A=90, B=abs)
bnd_3 = Bounds(Numbers=subtraction_2)
avr_2 = Average(Input=subtraction_2)
I = ClusterOutput(bnd)
I_2 = ClusterOutput(bnd_3)
am = ClusterOutput(avr_2)
I_3 = ClusterOutput(bnd_2)
am_2 = ClusterOutput(avr)
