# Grasshopper definition friend-AP8-shell-GUESS.gh (Grasshopper 1.0.8)
# plug-ins: PolyFrame 2

# ---- group: 1 Sliders - play here
rings_guess = Slider(3, range=1..6)
octagon_proportion = Slider(1, range=0.6..1.3)
cone_depth_mm = Slider(480, range=150..900)
plan_side_mm = Slider(10000, range=4000..16000)
# GUESS - read me: THIS IS A GUESS, not the friend's file. Force diagram = octagon cap triangulated from points on 8 spokes (centre -> the 8 edge midpoints = feet), joined to one point below (same idea as PF example 3(7)'s diamond cone). Defaults Rings 3 / depth 480 look closest to the sheet (crown rosette, rib pairs, long narrow cells, zig-zag base) but stage A has 4 short tension bars. Rings 2 / depth 330 = all compression in A and B but coarser. Replace with the friend's force diagram when we get it.
ref_apex_mm = Slider(6670, range=1000..12000)

# ---- group: 2 Force diagram - GUESS (spokes toward the 8 feet), not the friend's file
guess_octagon_force_diagram = GUESSOctagonForceDiagram(A=rings_guess, A_2=octagon_proportion, x=cone_depth_mm, A_3=plan_side_mm, Z=ref_apex_mm)  # -> cells_2, C, P, D, R, V, E
pfbuild = PFBuild(Brep=flatten(guess_octagon_force_diagram.cells_2), AbsoluteTolerance=0.1, PlanarityTolerance=0.1)  # -> ForcePFoam, FormPFoam
support_ids = SupportIDs(pfoam=pfbuild.ForcePFoam, P=guess_octagon_force_diagram.C)

# ---- group: 3 Stage A - algebraic, 8 feet pinned (over-constrained = best fit; shown left)
algebraic_dual = AlgebraicDual(ForcePFoam=pfbuild.ForcePFoam, Scale=1, Flip=False, displayIndex=False, rcond=9.999999747e-06)  # -> AlgebraicForm, AlgebraicForce, FormPFoam
algebraic_vertex_constraints = AlgebraicVertexConstraints(
    AlgebraicForm=algebraic_dual.AlgebraicForm,
    PFVertexIDs=support_ids,
    Constraints=guess_octagon_force_diagram.P,
    Scale=1,
    rcond=9.999999747e-06)  # -> AlgebraicForm, PFoam
check = Check(pfoam=algebraic_vertex_constraints.PFoam, M=support_ids, C=guess_octagon_force_diagram.R)  # -> I, I_2, am, I_3, am_2
pfpipe = PFPipe(PFoam=algebraic_vertex_constraints.PFoam, MinR=40, MaxR=120)  # -> Axes, Radius, Color, Pipe, Force
colour_by_force = ColourByForce(N=pfpipe.Force)
move = Move(Geometry=pfpipe.Pipe, Motion=guess_octagon_force_diagram.V)  # -> Geometry, Transform
stage_a_forces_dev_range_mean_dev_feet_t = Panel([check.I, check.I_2, check.am, check.I_3, check.am_2])  # "Stage A: forces | dev range | mean dev | feet-to-wall range | mean"
preview = CustomPreview(Geometry=move.Geometry, Material=colour_by_force)

# ---- group: 4 Stage B - pull 8 feet onto wall line, PFPerp
pfperp_iterations = Slider(1000, range=0..3000)
pull_strength = Slider(10, range=0..100)
pfvertex_constraints = PFVertexConstraints(
    PFoam=algebraic_vertex_constraints.PFoam,
    PFVertexID=support_ids,
    Constraint=guess_octagon_force_diagram.D,
    Coefficient=pull_strength,
    On=True)
pfperp = PFPerp(PFoam=pfvertex_constraints, MaxIteration=pfperp_iterations, Deviation=0.1, MinimumEdgeLength=10)  # -> PFoam, Deviation
check_2 = Check(pfoam=pfperp.PFoam, M=support_ids, C=guess_octagon_force_diagram.R)  # -> I, I_2, am, I_3, am_2
pfpipe_2 = PFPipe(PFoam=pfperp.PFoam, MinR=40, MaxR=120)  # -> Axes, Radius, Color, Pipe, Force
colour_by_force_2 = ColourByForce(N=pfpipe_2.Force)
stage_b_forces_dev_range_mean_dev_feet_t = Panel([check_2.I, check_2.I_2, check_2.am, check_2.I_3, check_2.am_2])  # "Stage B: forces | dev range | mean dev | feet-to-wall range | mean"
preview_2 = CustomPreview(Geometry=pfpipe_2.Pipe, Material=colour_by_force_2)
preview_3 = CustomPreview(Geometry=guess_octagon_force_diagram.E, Material=ColourSwatch(SwatchColor=RGBA(150, 150, 150, 70)))

# ==== cluster GUESSOctagonForceDiagram: GUESSED force diagram (not the friend's): octagon cap triangulated from points on 8 spokes (centre -> edge midpoints), Delaunay, Delaunay, each triangle joined to a point below. Cap faces = vertical loads; the 8 side faces = 8 reactions (diagonal edges -> corner buttresses, straight edges -> mid-side buttresses). Octagon proportion < 1 makes the mid-side reactions smaller.
A = ClusterInput()
A_2 = ClusterInput()
x = ClusterInput()
A_3 = ClusterInput()
Z = ClusterInput()
addition = Addition(A=A, B=1)
multiplication = Multiplication(A=A_2, B=-0.1767767)
pt = ConstructPoint(XCoordinate=8333.333333, YCoordinate=9622.504486, ZCoordinate=0)
division = Division(A=A_3, B=-2)
division_2 = Division(A=1, B=addition)
rectangle = Rectangle(Plane=pt, XSize=Domain(-923.8795, 923.8795), YSize=Domain(-923.8795, 923.8795), Radius=0)  # -> Rectangle, Length
addition_2 = Addition(A=multiplication, B=0.25)
pt_2 = ConstructPoint(XCoordinate=division, YCoordinate=division, ZCoordinate=0)
multiplication_2 = Multiplication(A=A_3, B=-1.4)
series = Series(Start=0, Step=division_2, Count=addition)
multiplication_3 = Multiplication(A=addition_2, B=[-1, 1, -1, 1, -1, 1, -1, 1])
rectangle_2 = Rectangle(Plane=pt_2, XSize=A_3, YSize=A_3, Radius=0)  # -> Rectangle, Length
neg = Negative(Value=x)
X = UnitX(Factor=multiplication_2)
divide = DivideCurve(Curve=rectangle_2.Rectangle, Count=8, Kinks=False)  # -> Points, Tangents, Parameters
addition_3 = Addition(A=multiplication_3, B=[1, 0, 0.25, 0.25, 0.5, 0.5, 0.75, 0.75])
Z_2 = UnitZ(Factor=neg)
eval = EvaluateLength(Curve=rectangle.Rectangle, Length=addition_3, Normalized=True)  # -> Point, Tangent, Parameter
move = Move(Geometry=pt, Motion=Z_2)  # -> Geometry, Transform
dup = DuplicateData(Data=rectangle_2.Rectangle, Number=8, Order=True)
pline = PolyLine(Vertices=eval.Point, Closed=True)
pline_2 = PolyLine(Vertices=divide.Points, Closed=True)
explode = Explode(Curve=pline, Recursive=True)  # -> Segments, Vertices
pt_3 = ConstructPoint(XCoordinate=0, YCoordinate=0, ZCoordinate=Z)
boundary = BoundarySurfaces(Edges=pline_2)
midpt = CurveMiddle(Curve=explode.Segments)
extr = ExtrudePoint(Base=boundary, Point=pt_3)
vec2pt = Vector2Pt(PointA=pt, PointB=midpt, Unitize=False)  # -> Vector, Length
multiplication_4 = Multiplication(A=graft(vec2pt.Vector), B=series)
move_2 = Move(Geometry=pt, Motion=multiplication_4)  # -> Geometry, Transform
cullpt = CullDuplicates(Points=flatten(move_2.Geometry), Tolerance=1, CullMode=3)  # -> Points, Indices, Valence
merge = Merge(Data1=eval.Point, Data2=cullpt.Points)
del = DelaunayMesh(Points=flatten(merge), Plane=PlaneXY(0, 0, 0))
faceb = FaceBoundaries(Mesh=del)
meshcp = MeshClosestPoint(Point=midpt, Mesh=del)  # -> Point, Index, Parameter
boundary_2 = BoundarySurfaces(Edges=graft(faceb))
extr_2 = ExtrudePoint(Base=boundary_2, Point=move.Geometry)
P = ClusterOutput(divide.Points)
D = ClusterOutput(dup)
R = ClusterOutput(rectangle_2.Rectangle)
V = ClusterOutput(X)
E = ClusterOutput(extr)
cells = Brep(flatten(extr_2))
cells_2 = ClusterOutput(cells)
item = ListItem(List=cells, Index=meshcp.Index, Wrap=True)
volume = Volume(Geometry=item)  # -> Volume, Centroid
C = ClusterOutput(volume.Centroid)

# ==== cluster SupportIDs: Form vertices (= force cells) carrying the 8 reactions, in wall order: corner, mid, corner, ...
pfoam = ClusterInput()
P = ClusterInput()
explode_pfoam = ExplodePFoam(PFoam=pfoam)  # -> PFVertices, PFEdges, PFFaces, PFCells
inspect_pfcell = InspectPFCell(PFCell=explode_pfoam.PFCells)  # -> ID, Mesh, Centroid, External, PFVertices, PFEdges, PFFaces, Dual
cps = ClosestPoints(Point=P, Cloud=inspect_pfcell.Centroid, Count=1)  # -> ClosestPoint, CPIndex, Distance
item = ListItem(List=inspect_pfcell.ID, Index=flatten(cps.CPIndex), Wrap=True)
i = ClusterOutput(item)

# ==== cluster ColourByForce: Blue = low compression, red = high (PFPipe force magnitude)
N = ClusterInput()
bnd = Bounds(Numbers=N)
remap = RemapNumbers(Value=N, Source=bnd, Target=Domain(0, 1))  # -> Mapped, Clipped
gradient = Gradient(
    LowerLimit=0,
    UpperLimit=1,
    Parameter=remap.Mapped,
    stops=[0: RGB(40, 90, 220), 0.5: RGB(150, 90, 200), 1: RGB(220, 40, 40)])
C = ClusterOutput(gradient)

# ==== cluster Check: Bar force range (+ = compression), deviation of bars from their force faces, distance of the 8 feet to the wall line
pfoam = ClusterInput()
M = ClusterInput()
C = ClusterInput()
explode_pfoam = ExplodePFoam(PFoam=pfoam)  # -> PFVertices, PFEdges, PFFaces, PFCells
inspect_pfvertex = InspectPFVertex(PFVertex=explode_pfoam.PFVertices)  # -> ID, Point, External, PFEdges, PFFaces, Dual
separate_pfedges_by_type = SeparatePFEdgesByType(PFEdge=explode_pfoam.PFEdges)  # -> Internal, Force, External
inspect_pfedge = InspectPFEdge(PFEdge=separate_pfedges_by_type.Internal)  # -> ID, Line, External, Force, PFVertices, PPFFaces, Dual, Pair
mindex = MemberIndex(Set=inspect_pfvertex.ID, Member=M)  # -> Index, Count
inspect_pfface = InspectPFFace(PFFace=inspect_pfedge.Dual)  # -> ID, Mesh, External, Area, Plane, PFVertices, PFEdges, PFCell, Dual, Pair
item = ListItem(List=inspect_pfvertex.Point, Index=flatten(mindex.Index), Wrap=True)
bnd = Bounds(Numbers=inspect_pfedge.Force)
end = EndPoints(Curve=inspect_pfedge.Line)  # -> Start, End
vec2pt = Vector2Pt(PointA=end.Start, PointB=end.End, Unitize=False)  # -> Vector, Length
crv_cp = CurveClosestPoint(Point=item, Curve=C)  # -> Point, Parameter, Distance
deplane = DeconstructPlane(Plane=inspect_pfface.Plane)  # -> Origin, XAxis, YAxis, ZAxis
bnd_2 = Bounds(Numbers=crv_cp.Distance)
angle = Angle(VectorA=vec2pt.Vector, VectorB=deplane.ZAxis)  # -> Angle, Reflex
avr = Average(Input=crv_cp.Distance)
deg = Degrees(Radians=angle.Angle)
subtraction = Subtraction(A=deg, B=90)
abs = Absolute(Value=subtraction)
subtraction_2 = Subtraction(A=90, B=abs)
bnd_3 = Bounds(Numbers=subtraction_2)
avr_2 = Average(Input=subtraction_2)
I = ClusterOutput(bnd)
I_2 = ClusterOutput(bnd_3)
am = ClusterOutput(avr_2)
I_3 = ClusterOutput(bnd_2)
am_2 = ClusterOutput(avr)
