# Grasshopper definition friend-AP8-shell-v2-printcast.gh (Grasshopper 1.0.8)
# plug-ins: PolyFrame 2

# ---- group: 1 Play here
branching_preset_guess = ValueList({"3 rings": 0, "4 rings": 1, "5 rings": 2, "6 rings": 3, "5 rings, 2x spokes (stage A has tension)": 4}, selected="5 rings")
force_depth_scale_z = Slider(0.41, range=0.15..1.5)
plan_side_mm = Slider(10000, range=4000..16000)
# GUESS - read me: GUESSED force diagram (not the friend's file). Octagon cap, proportion 0.85 (mid-side reactions smaller than corners), triangulated explicitly with 8-fold mirror symmetry (no Delaunay ties) from rings x spokes toward the 8 feet; one point below = cone depth (Scale Z). Stored as internalized Breps like PF example 3(7). Stage A pins the 4 corners only (exact); the mid-side feet land where the algebra puts them. Stage B pulls all 8 feet onto the wall line and runs PFPerp.
ref_apex_mm = Slider(6670, range=1000..12000)

# ---- group: 2 Force diagram - GUESS, 8-fold symmetric (PolyFrame build)
force_diagram_presets_guess = ForceDiagramPresetsGUESS(P=branching_preset_guess, Z=force_depth_scale_z)  # -> G, G_2
plan_wall_reference = PlanWallReference(A=plan_side_mm, Z=ref_apex_mm)  # -> L, D, R, V, E
pfbuild = PFBuild(Brep=flatten(force_diagram_presets_guess.G), AbsoluteTolerance=0.1, PlanarityTolerance=0.1)  # -> ForcePFoam, FormPFoam
support_ids = SupportIDs(pfoam=pfbuild.ForcePFoam, P=force_diagram_presets_guess.G_2)

# ---- group: 3 Stage A - exact algebraic, 4 corners pinned (shown left)
algebraic_dual = AlgebraicDual(ForcePFoam=pfbuild.ForcePFoam, Scale=1, Flip=False, displayIndex=False, rcond=9.999999747e-06)  # -> AlgebraicForm, AlgebraicForce, FormPFoam
cull = CullPattern(List=flatten(support_ids), CullPattern=[True, False])
algebraic_vertex_constraints = AlgebraicVertexConstraints(
    AlgebraicForm=algebraic_dual.AlgebraicForm,
    PFVertexIDs=cull,
    Constraints=plan_wall_reference.L,
    Scale=1,
    rcond=9.999999747e-06)  # -> AlgebraicForm, PFoam
check = Check(pfoam=algebraic_vertex_constraints.PFoam, M=support_ids, C=plan_wall_reference.R)  # -> I, I_2, am, I_3, am_2
pfpipe = PFPipe(PFoam=algebraic_vertex_constraints.PFoam, MinR=40, MaxR=120)  # -> Axes, Radius, Color, Pipe, Force
colour_by_force = ColourByForce(N=pfpipe.Force)
move = Move(Geometry=pfpipe.Pipe, Motion=plan_wall_reference.V)  # -> Geometry, Transform
stage_a_forces_dev_range_mean_dev_feet_t = Panel([check.I, check.I_2, check.am, check.I_3, check.am_2])  # "Stage A: forces | dev range | mean dev | feet-to-wall range | mean"
preview = CustomPreview(Geometry=move.Geometry, Material=colour_by_force)

# ---- group: 4 Stage B - pull 8 feet onto wall line, PFPerp
pfperp_iterations = Slider(1000, range=0..3000)
pull_strength = Slider(10, range=0..100)
pfvertex_constraints = PFVertexConstraints(
    PFoam=algebraic_vertex_constraints.PFoam,
    PFVertexID=support_ids,
    Constraint=plan_wall_reference.D,
    Coefficient=pull_strength,
    On=True)
pfperp = PFPerp(PFoam=pfvertex_constraints, MaxIteration=pfperp_iterations, Deviation=0.1, MinimumEdgeLength=10)  # -> PFoam, Deviation
check_2 = Check(pfoam=pfperp.PFoam, M=support_ids, C=plan_wall_reference.R)  # -> I, I_2, am, I_3, am_2
pfpipe_2 = PFPipe(PFoam=pfperp.PFoam, MinR=40, MaxR=120)  # -> Axes, Radius, Color, Pipe, Force
colour_by_force_2 = ColourByForce(N=pfpipe_2.Force)
stage_b_forces_dev_range_mean_dev_feet_t = Panel([check_2.I, check_2.I_2, check_2.am, check_2.I_3, check_2.am_2])  # "Stage B: forces | dev range | mean dev | feet-to-wall range | mean"
preview_2 = CustomPreview(Geometry=pfpipe_2.Pipe, Material=colour_by_force_2)
preview_3 = CustomPreview(Geometry=plan_wall_reference.E, Material=ColourSwatch(SwatchColor=RGBA(150, 150, 150, 70)))

# ---- group: 5 Print (green, <=35 deg from vertical) / cast (orange) - stage B
print_cast_split = PrintCastSplit(C=pfpipe_2.Axes, L=pfpipe_2.Pipe)  # -> A, B, L_2, L_3, R
stage_b_printed_count_cast_count_cast_le = Panel([print_cast_split.L_2, print_cast_split.L_3, print_cast_split.R])  # "Stage B: printed count | cast count | cast length (m)"
preview_4 = CustomPreview(Geometry=print_cast_split.A, Material=ColourSwatch(SwatchColor=RGB(40, 170, 60)))
preview_5 = CustomPreview(Geometry=print_cast_split.B, Material=ColourSwatch(SwatchColor=RGB(240, 140, 30)))

# ==== cluster ForceDiagramPresetsGUESS: GUESSED force diagrams (not the friend's): octagon cap (proportion 0.85), explicit 8-fold symmetric triangulation from rings x spokes toward the 8 feet, joined to one point below; internalized like PF example 3(7). Scale Z = cone depth.
P = ClusterInput()
Z = ClusterInput()
reaction_cell_centroids = Point(Tree({0}: [Point(-381.7613663, -381.7613663, -250), Point(0, -635.1671786, -250), Point(381.7613663, -381.7613663, -250), Point(635.1671786, 0, -250), Point(381.7613663, 381.7613663, -250), Point(0, 635.1671786, -250), Point(-381.7613663, 381.7613663, -250), Point(-635.1671786, 0, -250)], {1}: [Point(-388.7024821, -388.7024821, -250), Point(0, -646.7156728, -250), Point(388.7024821, -388.7024821, -250), Point(646.7156728, 0, -250), Point(388.7024821, 388.7024821, -250), Point(0, 646.7156728, -250), Point(-388.7024821, 388.7024821, -250), Point(-646.7156728, 0, -250)], {2}: [Point(-393.3298926, -393.3298926, -250), Point(0, -654.4146689, -250), Point(393.3298926, -393.3298926, -250), Point(654.4146689, 0, -250), Point(393.3298926, 393.3298926, -250), Point(0, 654.4146689, -250), Point(-393.3298926, 393.3298926, -250), Point(-654.4146689, 0, -250)], {3}: [Point(-396.6351858, -396.6351858, -250), Point(0, -659.9139518, -250), Point(396.6351858, -396.6351858, -250), Point(659.9139518, 0, -250), Point(396.6351858, 396.6351858, -250), Point(0, 659.9139518, -250), Point(-396.6351858, 396.6351858, -250), Point(-659.9139518, 0, -250)], {4}: [Point(-393.3298926, -393.3298926, -250), Point(0, -654.4146689, -250), Point(393.3298926, -393.3298926, -250), Point(654.4146689, 0, -250), Point(393.3298926, 393.3298926, -250), Point(0, 654.4146689, -250), Point(-393.3298926, 393.3298926, -250), Point(-654.4146689, 0, -250)]))
cells_presets = Brep(Tree({0}: [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], {1}: [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], {2}: [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], {3}: [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], {4}: [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]))
branch = TreeBranch(Tree=cells_presets, Path=P, MaintainPaths=True)
branch_2 = TreeBranch(Tree=reaction_cell_centroids, Path=P, MaintainPaths=True)
scale_nu = ScaleNU(Geometry=branch, Plane=PlaneXY(0, 0, 0), ScaleX=1, ScaleY=1, ScaleZ=Z)  # -> Geometry, Transform
scale_nu_2 = ScaleNU(Geometry=branch_2, Plane=PlaneXY(0, 0, 0), ScaleX=1, ScaleY=1, ScaleZ=Z)  # -> Geometry, Transform
G = ClusterOutput(scale_nu.Geometry)
G_2 = ClusterOutput(scale_nu_2.Geometry)

# ==== cluster PlanWallReference: Wall points/line of the square plan, 4 corner points, grey 53.1 deg reference pyramid
A = ClusterInput()
Z = ClusterInput()
division = Division(A=A, B=-2)
pt = ConstructPoint(XCoordinate=division, YCoordinate=division, ZCoordinate=0)
multiplication = Multiplication(A=A, B=-1.4)
rectangle = Rectangle(Plane=pt, XSize=A, YSize=A, Radius=0)  # -> Rectangle, Length
X = UnitX(Factor=multiplication)
divide = DivideCurve(Curve=rectangle.Rectangle, Count=8, Kinks=False)  # -> Points, Tangents, Parameters
dup = DuplicateData(Data=rectangle.Rectangle, Number=8, Order=True)
pt_2 = ConstructPoint(XCoordinate=0, YCoordinate=0, ZCoordinate=Z)
cull = CullPattern(List=divide.Points, CullPattern=[True, False])
pline = PolyLine(Vertices=cull, Closed=True)
boundary = BoundarySurfaces(Edges=pline)
extr = ExtrudePoint(Base=boundary, Point=pt_2)
L = ClusterOutput(cull)
D = ClusterOutput(dup)
R = ClusterOutput(rectangle.Rectangle)
V = ClusterOutput(X)
E = ClusterOutput(extr)

# ==== cluster SupportIDs: Form vertices (= force cells) carrying the 8 reactions, in wall order: corner, mid, corner, ...
pfoam = ClusterInput()
P = ClusterInput()
explode_pfoam = ExplodePFoam(PFoam=pfoam)  # -> PFVertices, PFEdges, PFFaces, PFCells
inspect_pfcell = InspectPFCell(PFCell=explode_pfoam.PFCells)  # -> ID, Mesh, Centroid, External, PFVertices, PFEdges, PFFaces, Dual
cps = ClosestPoints(Point=P, Cloud=inspect_pfcell.Centroid, Count=1)  # -> ClosestPoint, CPIndex, Distance
item = ListItem(List=inspect_pfcell.ID, Index=flatten(cps.CPIndex), Wrap=True)
i = ClusterOutput(item)

# ==== cluster ColourByForce: Blue = low compression, red = high (PFPipe force magnitude)
N = ClusterInput()
bnd = Bounds(Numbers=N)
remap = RemapNumbers(Value=N, Source=bnd, Target=Domain(0, 1))  # -> Mapped, Clipped
gradient = Gradient(
    LowerLimit=0,
    UpperLimit=1,
    Parameter=remap.Mapped,
    stops=[0: RGB(40, 90, 220), 0.5: RGB(150, 90, 200), 1: RGB(220, 40, 40)])
C = ClusterOutput(gradient)

# ==== cluster Check: Bar force range (+ = compression), deviation of bars from their force faces, distance of the 8 feet to the wall line
pfoam = ClusterInput()
M = ClusterInput()
C = ClusterInput()
explode_pfoam = ExplodePFoam(PFoam=pfoam)  # -> PFVertices, PFEdges, PFFaces, PFCells
inspect_pfvertex = InspectPFVertex(PFVertex=explode_pfoam.PFVertices)  # -> ID, Point, External, PFEdges, PFFaces, Dual
separate_pfedges_by_type = SeparatePFEdgesByType(PFEdge=explode_pfoam.PFEdges)  # -> Internal, Force, External
inspect_pfedge = InspectPFEdge(PFEdge=separate_pfedges_by_type.Internal)  # -> ID, Line, External, Force, PFVertices, PPFFaces, Dual, Pair
mindex = MemberIndex(Set=inspect_pfvertex.ID, Member=M)  # -> Index, Count
inspect_pfface = InspectPFFace(PFFace=inspect_pfedge.Dual)  # -> ID, Mesh, External, Area, Plane, PFVertices, PFEdges, PFCell, Dual, Pair
item = ListItem(List=inspect_pfvertex.Point, Index=flatten(mindex.Index), Wrap=True)
bnd = Bounds(Numbers=inspect_pfedge.Force)
end = EndPoints(Curve=inspect_pfedge.Line)  # -> Start, End
vec2pt = Vector2Pt(PointA=end.Start, PointB=end.End, Unitize=False)  # -> Vector, Length
crv_cp = CurveClosestPoint(Point=item, Curve=C)  # -> Point, Parameter, Distance
deplane = DeconstructPlane(Plane=inspect_pfface.Plane)  # -> Origin, XAxis, YAxis, ZAxis
bnd_2 = Bounds(Numbers=crv_cp.Distance)
angle = Angle(VectorA=vec2pt.Vector, VectorB=deplane.ZAxis)  # -> Angle, Reflex
avr = Average(Input=crv_cp.Distance)
deg = Degrees(Radians=angle.Angle)
subtraction = Subtraction(A=deg, B=90)
abs = Absolute(Value=subtraction)
subtraction_2 = Subtraction(A=90, B=abs)
bnd_3 = Bounds(Numbers=subtraction_2)
avr_2 = Average(Input=subtraction_2)
I = ClusterOutput(bnd)
I_2 = ClusterOutput(bnd_3)
am = ClusterOutput(avr_2)
I_3 = ClusterOutput(bnd_2)
am_2 = ClusterOutput(avr)

# ==== cluster PrintCastSplit: Bars within 35 deg of true vertical = printed (green); over 35 deg = cast (orange): ring bars and flat crown bars
C = ClusterInput()
L = ClusterInput()
end = EndPoints(Curve=C)  # -> Start, End
vec2pt = Vector2Pt(PointA=end.Start, PointB=end.End, Unitize=False)  # -> Vector, Length
Z = UnitZ(Factor=1)
angle = Angle(VectorA=vec2pt.Vector, VectorB=Z)  # -> Angle, Reflex
deg = Degrees(Radians=angle.Angle)
subtraction = Subtraction(A=deg, B=90)
abs = Absolute(Value=subtraction)
subtraction_2 = Subtraction(A=90, B=abs)
smaller = SmallerThan(FirstNumber=subtraction_2, SecondNumber=35)  # -> SmallerThan, OrEqualTo
dispatch = Dispatch(List=L, DispatchPattern=smaller.OrEqualTo)  # -> ListA, ListB
dispatch_2 = Dispatch(List=C, DispatchPattern=smaller.OrEqualTo)  # -> ListA, ListB
lng = ListLength(List=dispatch_2.ListA)
lng_2 = ListLength(List=dispatch_2.ListB)
len = Length(Curve=dispatch_2.ListB)
ma = MassAddition(Input=len)  # -> Result, PartialResults
division = Division(A=ma.Result, B=1000)
A = ClusterOutput(dispatch.ListA)
B = ClusterOutput(dispatch.ListB)
L_2 = ClusterOutput(lng)
L_3 = ClusterOutput(lng_2)
R = ClusterOutput(division)
