# Grasshopper definition friend-compare-nervi-square-vs-round-lowstart.gh (Grasshopper 1.0.8)
# plug-ins: PolyFrame 2

# ---- group: 1 Play here
branching_preset_guess = ValueList({"Nervi test: 20 feet as Y-buttresses, then a regular diamond net of 40 per ring, 8 rings with geometric spacing (cells shrink toward the crown, like the Palazzetto), no even-load re-spacing (Scale Z 0.350; bottom force level 0.90 so the grid starts low); crown ring pulled onto a circle r 2.5 m at the Ref apex height": 0}, selected="Nervi test: 20 feet as Y-buttresses, then a regular diamond net of 40 per ring, 8 rings with geometric spacing (cells shrink toward the crown, like the Palazzetto), no even-load re-spacing (Scale Z 0.350; bottom force level 0.90 so the grid starts low); crown ring pulled onto a circle r 2.5 m at the Ref apex height")
force_depth_scale_z = Slider(0.35, range=0.2..1.5)
plan_side_mm = Slider(10000, range=4000..16000)
ref_apex_mm = Slider(6670, range=1000..12000)

branching_preset_guess_2 = ValueList({"Nervi test on a CIRCULAR plan (r = 5 m, 20 feet every 18 deg): 20 feet as Y-buttresses, then a regular diamond net of 40 per ring, 8 rings with geometric spacing (cells shrink toward the crown, like the Palazzetto), no even-load re-spacing (Scale Z 0.289; bottom force level 0.90 so the grid starts 0.58 m up); all 20 feet pinned in stage A so every ring comes out a level circle": 0}, selected="Nervi test on a CIRCULAR plan (r = 5 m, 20 feet every 18 deg): 20 feet as Y-buttresses, then a regular diamond net of 40 per ring, 8 rings with geometric spacing (cells shrink toward the crown, like the Palazzetto), no even-load re-spacing (Scale Z 0.289; bottom force level 0.90 so the grid starts 0.58 m up); all 20 feet pinned in stage A so every ring comes out a level circle")
force_depth_scale_z_2 = Slider(0.289, range=0.2..1.5)
plan_diameter_mm = Slider(10000, range=4000..16000)
ref_apex_mm_2 = Slider(6670, range=1000..12000)

# ----
# System: OPTION 1 (front, at the origin): Nervi-like grid, square 10x10 base (20 supports, 5 per side), circular crown r 2.5 m at 6.67 m. Form at x=0, its stage A at x=-14 m, its force diagram (green, 4x) at y=+14 m.
# System: OPTION 2 (behind, y = +36 m): Nervi-like grid, circular base r 5 m (20 supports), circular crown r 2.49 m at 6.68 m, exact; grid starts 0.58 m up. Form at y=+36 m, its stage A at x=-14 m y=+36 m, its force diagram (green, 4x) at y=+50 m.
swatch = ColourSwatch(SwatchColor=RGBA(120, 190, 120, 150))

# ---- group: 2 Force diagram - GUESS diagrid, mirror-symmetric (PolyFrame build)
force_diagram_presets_guess = ForceDiagramPresetsGUESS(P=branching_preset_guess, Z=force_depth_scale_z)  # -> G, G_2
plan_wall_reference = PlanWallReference(A=plan_side_mm, Z=ref_apex_mm)  # -> L, L_2, R, V, E
pfbuild = PFBuild(Brep=flatten(force_diagram_presets_guess.G), AbsoluteTolerance=0.1, PlanarityTolerance=0.1)  # -> ForcePFoam, FormPFoam
support_ids = SupportIDs(pfoam=pfbuild.ForcePFoam, P=force_diagram_presets_guess.G_2)

# ----
scale = Scale(Geometry=force_diagram_presets_guess.G, Center=Point(0, 0, 0), Factor=4)  # -> Geometry, Transform
move = Move(Geometry=scale.Geometry, Motion=Vector(0, 14000, 0))  # -> Geometry, Transform
preview = CustomPreview(Geometry=move.Geometry, Material=swatch)

# ---- group: 2 Force diagram - GUESS diagrid, mirror-symmetric (PolyFrame build)
force_diagram_presets_guess_2 = ForceDiagramPresetsGUESS_2(P=branching_preset_guess_2, Z=force_depth_scale_z_2)  # -> G, G_2
plan_wall_reference_2 = PlanWallReference_2(A=plan_diameter_mm, Z=ref_apex_mm_2)  # -> L, L_2, C, V, E
pfbuild_2 = PFBuild(Brep=flatten(force_diagram_presets_guess_2.G), AbsoluteTolerance=0.1, PlanarityTolerance=0.1)  # -> ForcePFoam, FormPFoam
support_ids_2 = SupportIDs(pfoam=pfbuild_2.ForcePFoam, P=force_diagram_presets_guess_2.G_2)

# ----
scale_2 = Scale(Geometry=force_diagram_presets_guess_2.G, Center=Point(0, 0, 0), Factor=4)  # -> Geometry, Transform
move_2 = Move(Geometry=scale_2.Geometry, Motion=Vector(0, 14000, 0))  # -> Geometry, Transform
move_3 = Move(Geometry=plan_wall_reference_2.E, Motion=Vector(0, 36000, 0))  # -> Geometry, Transform
move_4 = Move(Geometry=move_2.Geometry, Motion=Vector(0, 36000, 0))  # -> Geometry, Transform
preview_2 = CustomPreview(Geometry=move_4.Geometry, Material=ColourSwatch(SwatchColor=RGBA(120, 190, 120, 150)))

# ---- group: 3 Stage A - exact algebraic, 4 mid-side feet pinned (shown left)
algebraic_dual = AlgebraicDual(ForcePFoam=pfbuild.ForcePFoam, Scale=1, Flip=False, displayIndex=False, rcond=9.999999747e-06)  # -> AlgebraicForm, AlgebraicForce, FormPFoam
cull = CullPattern(List=flatten(support_ids), CullPattern=[False, False, True, False, False])
algebraic_vertex_constraints = AlgebraicVertexConstraints(
    AlgebraicForm=algebraic_dual.AlgebraicForm,
    PFVertexIDs=cull,
    Constraints=plan_wall_reference.L,
    Scale=1,
    rcond=9.999999747e-06)  # -> AlgebraicForm, PFoam
check = Check(pfoam=algebraic_vertex_constraints.PFoam, M=support_ids, C=plan_wall_reference.R)  # -> I, I_2, am, I_3, am_2
pfpipe = PFPipe(PFoam=algebraic_vertex_constraints.PFoam, MinR=40, MaxR=120)  # -> Axes, Radius, Color, Pipe, Force
colour_by_force = ColourByForce(N=pfpipe.Force)
move_5 = Move(Geometry=pfpipe.Pipe, Motion=plan_wall_reference.V)  # -> Geometry, Transform
stage_a_forces_dev_range_mean_dev_feet_t = Panel([check.I, check.I_2, check.am, check.I_3, check.am_2])  # "Stage A: forces | dev range | mean dev | feet-to-wall range | mean"
preview_3 = CustomPreview(Geometry=move_5.Geometry, Material=colour_by_force)

# ---- group: 4 Stage B - pull the 20 feet onto their points AND the 40 crown nodes (PF ids 301-340) onto a level circle, PFPerp
pfperp_iterations = Slider(300, range=0..3000)
pull_strength = Slider(10, range=0..100)
crown_radius_mm = Slider(2500, range=1000..4000)
crown_pull_strength = Slider(10, range=0..100)
series = Series(Start=301, Step=1, Count=40)
pt = ConstructPoint(XCoordinate=0, YCoordinate=0, ZCoordinate=ref_apex_mm)
pfvertex_constraints = PFVertexConstraints(
    PFoam=algebraic_vertex_constraints.PFoam,
    PFVertexID=support_ids,
    Constraint=plan_wall_reference.L_2,
    Coefficient=pull_strength,
    On=True)
xy = XYPlane(Origin=pt)
cir = Circle(Plane=xy, Radius=crown_radius_mm)
dup = DuplicateData(Data=cir, Number=40, Order=True)
pfvertex_constraints_2 = PFVertexConstraints(PFoam=pfvertex_constraints, PFVertexID=series, Constraint=dup, Coefficient=crown_pull_strength, On=True)
pfperp = PFPerp(PFoam=pfvertex_constraints_2, MaxIteration=pfperp_iterations, Deviation=0.1, MinimumEdgeLength=10)  # -> PFoam, Deviation
check_2 = Check(pfoam=pfperp.PFoam, M=support_ids, C=plan_wall_reference.R)  # -> I, I_2, am, I_3, am_2
pfpipe_2 = PFPipe(PFoam=pfperp.PFoam, MinR=40, MaxR=120)  # -> Axes, Radius, Color, Pipe, Force
colour_by_force_2 = ColourByForce(N=pfpipe_2.Force)
stage_b_forces_dev_range_mean_dev_feet_t = Panel([check_2.I, check_2.I_2, check_2.am, check_2.I_3, check_2.am_2])  # "Stage B: forces | dev range | mean dev | feet-to-wall range | mean"
preview_4 = CustomPreview(Geometry=pfpipe_2.Pipe, Material=colour_by_force_2)
preview_5 = CustomPreview(Geometry=plan_wall_reference.E, Material=ColourSwatch(SwatchColor=RGBA(150, 150, 150, 70)))

# ---- group: 3 Stage A - exact algebraic, ALL 20 feet pinned (exact, 0 deg) (shown left)
algebraic_dual_2 = AlgebraicDual(ForcePFoam=pfbuild_2.ForcePFoam, Scale=1, Flip=False, displayIndex=False, rcond=9.999999747e-06)  # -> AlgebraicForm, AlgebraicForce, FormPFoam
cull_2 = CullPattern(List=flatten(support_ids_2), CullPattern=True)
algebraic_vertex_constraints_2 = AlgebraicVertexConstraints(
    AlgebraicForm=algebraic_dual_2.AlgebraicForm,
    PFVertexIDs=cull_2,
    Constraints=plan_wall_reference_2.L_2,
    Scale=1,
    rcond=9.999999747e-06)  # -> AlgebraicForm, PFoam
check_3 = Check(pfoam=algebraic_vertex_constraints_2.PFoam, M=support_ids_2, C=plan_wall_reference_2.C)  # -> I, I_2, am, I_3, am_2
pfpipe_3 = PFPipe(PFoam=algebraic_vertex_constraints_2.PFoam, MinR=40, MaxR=120)  # -> Axes, Radius, Color, Pipe, Force
colour_by_force_3 = ColourByForce(N=pfpipe_3.Force)
move_6 = Move(Geometry=pfpipe_3.Pipe, Motion=plan_wall_reference_2.V)  # -> Geometry, Transform
stage_a_forces_dev_range_mean_dev_feet_t_2 = Panel([check_3.I, check_3.I_2, check_3.am, check_3.I_3, check_3.am_2])  # "Stage A: forces | dev range | mean dev | feet-to-wall range | mean"

# ----
move_7 = Move(Geometry=move_6.Geometry, Motion=Vector(0, 36000, 0))  # -> Geometry, Transform

# ---- group: 3 Stage A - exact algebraic, ALL 20 feet pinned (exact, 0 deg) (shown left) (continued)
preview_6 = CustomPreview(Geometry=move_7.Geometry, Material=colour_by_force_3)

# ---- group: 4 Stage B - pull all 20 feet onto their target points, PFPerp
pfperp_iterations_2 = Slider(300, range=0..3000)
pull_strength_2 = Slider(10, range=0..100)
pfvertex_constraints_3 = PFVertexConstraints(
    PFoam=algebraic_vertex_constraints_2.PFoam,
    PFVertexID=support_ids_2,
    Constraint=plan_wall_reference_2.L_2,
    Coefficient=pull_strength_2,
    On=True)
pfperp_2 = PFPerp(PFoam=pfvertex_constraints_3, MaxIteration=pfperp_iterations_2, Deviation=0.1, MinimumEdgeLength=10)  # -> PFoam, Deviation
check_4 = Check(pfoam=pfperp_2.PFoam, M=support_ids_2, C=plan_wall_reference_2.C)  # -> I, I_2, am, I_3, am_2
pfpipe_4 = PFPipe(PFoam=pfperp_2.PFoam, MinR=40, MaxR=120)  # -> Axes, Radius, Color, Pipe, Force
colour_by_force_4 = ColourByForce(N=pfpipe_4.Force)
stage_b_forces_dev_range_mean_dev_feet_t_2 = Panel([check_4.I, check_4.I_2, check_4.am, check_4.I_3, check_4.am_2])  # "Stage B: forces | dev range | mean dev | feet-to-wall range | mean"
preview_7 = CustomPreview(Geometry=move_3.Geometry, Material=ColourSwatch(SwatchColor=RGBA(150, 150, 150, 70)))

# ----
move_8 = Move(Geometry=pfpipe_4.Pipe, Motion=Vector(0, 36000, 0))  # -> Geometry, Transform

# ---- group: 4 Stage B - pull all 20 feet onto their target points, PFPerp (continued)
preview_8 = CustomPreview(Geometry=move_8.Geometry, Material=colour_by_force_4)

# ==== cluster ForceDiagramPresetsGUESS: Force diagram built as the plan dual of the graded #16c topology (ring counts 20,40 x8; cap ring radii in geometric progression 0.60 -> 0.94, ratio 1.066 per level): one cap cell per form node, cap points on 7 levels re-spaced for an even casing load, outer polygon edges aimed at the 20 feet, crown hole -> centre point; joined to one apex. Scale Z = cone depth.
P = ClusterInput()
Z = ClusterInput()
reaction_cell_centroids = Point([Point(-397.8624965, -596.3286138, -250), Point(-200.632675, -687.4134505, -250), Point(0, -716.0740469, -250), Point(200.632675, -687.4134505, -250), Point(397.8624965, -596.3286138, -250), Point(596.3286138, -397.8624965, -250)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])
cells_presets = Brep([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])
branch = TreeBranch(Tree=cells_presets, Path=P, MaintainPaths=True)
branch_2 = TreeBranch(Tree=reaction_cell_centroids, Path=P, MaintainPaths=True)
scale_nu = ScaleNU(Geometry=branch, Plane=PlaneXY(0, 0, 0), ScaleX=1, ScaleY=1, ScaleZ=Z)  # -> Geometry, Transform
scale_nu_2 = ScaleNU(Geometry=branch_2, Plane=PlaneXY(0, 0, 0), ScaleX=1, ScaleY=1, ScaleZ=Z)  # -> Geometry, Transform
G = ClusterOutput(scale_nu.Geometry)
G_2 = ClusterOutput(scale_nu_2.Geometry)

# ==== cluster PlanWallReference: Square plan: 20 foot targets (5 per side, side/5 from each corner, 0.15 x side apart), 4 mid-side points, wall line, grey reference pyramid
A = ClusterInput()
Z = ClusterInput()
division = Division(A=A, B=-2)
pt = ConstructPoint(XCoordinate=division, YCoordinate=division, ZCoordinate=0)
multiplication = Multiplication(A=A, B=-1.4)
rectangle = Rectangle(Plane=pt, XSize=A, YSize=A, Radius=0)  # -> Rectangle, Length
X = UnitX(Factor=multiplication)
divide = DivideCurve(Curve=rectangle.Rectangle, Count=80, Kinks=False)  # -> Points, Tangents, Parameters
dup = DuplicateData(Data=rectangle.Rectangle, Number=16, Order=True)
pt_2 = ConstructPoint(XCoordinate=0, YCoordinate=0, ZCoordinate=Z)
cull = CullPattern(
    List=divide.Points,
    CullPattern=[False, False, False, False, True, False, False, True, False, False, True, False, False, True, False, False, True, False, False, False])
cull_2 = CullPattern(
    List=divide.Points,
    CullPattern=[True, False, False, False, False, False, False, False, False, False, False, False, False, False, False, False, False, False, False, False])
pline = PolyLine(Vertices=cull_2, Closed=True)
boundary = BoundarySurfaces(Edges=pline)
cull_3 = CullPattern(List=cull, CullPattern=[False, False, True, False, False])
extr = ExtrudePoint(Base=boundary, Point=pt_2)
L = ClusterOutput(cull_3)
L_2 = ClusterOutput(cull)
R = ClusterOutput(rectangle.Rectangle)
V = ClusterOutput(X)
E = ClusterOutput(extr)

# ==== cluster SupportIDs: Form vertices (= force cells) carrying the 20 reactions, in wall order along each side
pfoam = ClusterInput()
P = ClusterInput()
explode_pfoam = ExplodePFoam(PFoam=pfoam)  # -> PFVertices, PFEdges, PFFaces, PFCells
inspect_pfcell = InspectPFCell(PFCell=explode_pfoam.PFCells)  # -> ID, Mesh, Centroid, External, PFVertices, PFEdges, PFFaces, Dual
cps = ClosestPoints(Point=P, Cloud=inspect_pfcell.Centroid, Count=1)  # -> ClosestPoint, CPIndex, Distance
item = ListItem(List=inspect_pfcell.ID, Index=flatten(cps.CPIndex), Wrap=True)
i = ClusterOutput(item)

# ==== cluster ColourByForce: Blue = low compression, red = high (PFPipe force magnitude)
N = ClusterInput()
bnd = Bounds(Numbers=N)
remap = RemapNumbers(Value=N, Source=bnd, Target=Domain(0, 1))  # -> Mapped, Clipped
gradient = Gradient(
    LowerLimit=0,
    UpperLimit=1,
    Parameter=remap.Mapped,
    stops=[0: RGB(40, 90, 220), 0.5: RGB(150, 90, 200), 1: RGB(220, 40, 40)])
C = ClusterOutput(gradient)

# ==== cluster Check: Bar force range (+ = compression), deviation of bars from their force faces, distance of the 20 feet to the wall line
pfoam = ClusterInput()
M = ClusterInput()
C = ClusterInput()
explode_pfoam = ExplodePFoam(PFoam=pfoam)  # -> PFVertices, PFEdges, PFFaces, PFCells
inspect_pfvertex = InspectPFVertex(PFVertex=explode_pfoam.PFVertices)  # -> ID, Point, External, PFEdges, PFFaces, Dual
separate_pfedges_by_type = SeparatePFEdgesByType(PFEdge=explode_pfoam.PFEdges)  # -> Internal, Force, External
inspect_pfedge = InspectPFEdge(PFEdge=separate_pfedges_by_type.Internal)  # -> ID, Line, External, Force, PFVertices, PPFFaces, Dual, Pair
mindex = MemberIndex(Set=inspect_pfvertex.ID, Member=M)  # -> Index, Count
inspect_pfface = InspectPFFace(PFFace=inspect_pfedge.Dual)  # -> ID, Mesh, External, Area, Plane, PFVertices, PFEdges, PFCell, Dual, Pair
item = ListItem(List=inspect_pfvertex.Point, Index=flatten(mindex.Index), Wrap=True)
bnd = Bounds(Numbers=inspect_pfedge.Force)
end = EndPoints(Curve=inspect_pfedge.Line)  # -> Start, End
vec2pt = Vector2Pt(PointA=end.Start, PointB=end.End, Unitize=False)  # -> Vector, Length
crv_cp = CurveClosestPoint(Point=item, Curve=C)  # -> Point, Parameter, Distance
deplane = DeconstructPlane(Plane=inspect_pfface.Plane)  # -> Origin, XAxis, YAxis, ZAxis
bnd_2 = Bounds(Numbers=crv_cp.Distance)
angle = Angle(VectorA=vec2pt.Vector, VectorB=deplane.ZAxis)  # -> Angle, Reflex
avr = Average(Input=crv_cp.Distance)
deg = Degrees(Radians=angle.Angle)
subtraction = Subtraction(A=deg, B=90)
abs = Absolute(Value=subtraction)
subtraction_2 = Subtraction(A=90, B=abs)
bnd_3 = Bounds(Numbers=subtraction_2)
avr_2 = Average(Input=subtraction_2)
I = ClusterOutput(bnd)
I_2 = ClusterOutput(bnd_3)
am = ClusterOutput(avr_2)
I_3 = ClusterOutput(bnd_2)
am_2 = ClusterOutput(avr)

# ==== cluster ForceDiagramPresetsGUESS_2: Force diagram built as the plan dual of the graded #16c topology (ring counts 20,40 x8; cap ring radii in geometric progression 0.60 -> 0.94, ratio 1.066 per level): one cap cell per form node, cap points on 7 levels re-spaced for an even casing load, outer polygon edges aimed at the 20 feet, crown hole -> centre point; joined to one apex. Scale Z = cone depth.
P = ClusterInput()
Z = ClusterInput()
reaction_cell_centroids = Point([Point(0, -716.0740469, -250), Point(221.2790497, -681.0268885, -250), Point(420.8977643, -579.3160732, -250), Point(579.3160732, -420.8977643, -250), Point(681.0268885, -221.2790497, -250), Point(716.0740469, 0, -250)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])
cells_presets = Brep([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])
branch = TreeBranch(Tree=cells_presets, Path=P, MaintainPaths=True)
branch_2 = TreeBranch(Tree=reaction_cell_centroids, Path=P, MaintainPaths=True)
scale_nu = ScaleNU(Geometry=branch, Plane=PlaneXY(0, 0, 0), ScaleX=1, ScaleY=1, ScaleZ=Z)  # -> Geometry, Transform
scale_nu_2 = ScaleNU(Geometry=branch_2, Plane=PlaneXY(0, 0, 0), ScaleX=1, ScaleY=1, ScaleZ=Z)  # -> Geometry, Transform
G = ClusterOutput(scale_nu.Geometry)
G_2 = ClusterOutput(scale_nu_2.Geometry)

# ==== cluster PlanWallReference_2: Circular plan: circle of diameter = Plan side, 20 foot targets every 18 deg starting at -Y, 4 of them (at -Y,+X,+Y,-X) pinned in stage A, grey reference cone
A = ClusterInput()
Z = ClusterInput()
division = Division(A=A, B=-2)
pt = ConstructPoint(XCoordinate=division, YCoordinate=division, ZCoordinate=0)
division_2 = Division(A=A, B=2)
multiplication = Multiplication(A=A, B=-1.4)
cir = Circle(Plane=Plane(origin=(0, 0, 0), x=(0, -1, 0), y=(1, 0, 0)), Radius=division_2)
X = UnitX(Factor=multiplication)
divide = DivideCurve(Curve=cir, Count=20, Kinks=False)  # -> Points, Tangents, Parameters
dup = DuplicateData(Data=cir, Number=16, Order=True)
pt_2 = ConstructPoint(XCoordinate=0, YCoordinate=0, ZCoordinate=Z)
cull = CullPattern(List=divide.Points, CullPattern=True)
cull_2 = CullPattern(
    List=divide.Points,
    CullPattern=[True, False, False, False, False, False, False, False, False, False, False, False, False, False, False, False, False, False, False, False])
pline = PolyLine(Vertices=cull_2, Closed=True)
boundary = BoundarySurfaces(Edges=cir)
cull_3 = CullPattern(List=cull, CullPattern=[True, False, False, False, False])
extr = ExtrudePoint(Base=boundary, Point=pt_2)
L = ClusterOutput(cull_3)
L_2 = ClusterOutput(cull)
C = ClusterOutput(cir)
V = ClusterOutput(X)
E = ClusterOutput(extr)
