# Grasshopper definition friend-diagrid-karamba.gh (Grasshopper 1.0.8)
# plug-ins: Karamba3D

# ---- group: friend-AP8-diagrid (stage B) - ribs 150x250 C30/37, rigid joints, feet pinned, LC G = self-weight + 7 kN/m2 on the 167 m2 pyramid surface
# read me: Karamba components copied from grasshopper/Pyramide Karamba 10_14_2026.gh (same cast C30/37 material, Trapezoid section, supports, Gravity, MeshLoad Const). Ribs 150x250 cm-inputs 25/15. Load case G = self-weight + 7 kN/m2 (ASSUMED casing/insulation/finish) applied by MeshLoad on the full 10x10 / 6.67 m pyramid surface (166.7 m2) -> distributed to nearest nodes. Geometry = PolyFrame stage B of friend-AP8-diagrid (left) and friend-16-diagrid (offset +14 m). Karamba geometry input unit must be mm (karamba.ini UnitLength). Stress check (|N|/A + |My|/Wy + |Mz|/Wz vs fcd 20 MPa / fctm 2.9 MPa) was done outside this file; see the report.
isotrop = MaterialPropertiesKaramba3D(
    FamilyOfMaterial="Concrete",
    Name="C30/37 cast",
    YoungsModulus_kN_cm²=3280,
    InPlaneShearModulus_kN_cm²=1366.666667,
    TransverseShearModulus_kN_cm²=1366.666667,
    SpecificWeight_kN_m³=24,
    CoefficientOfThermalExpansion_1=1.2e-05,
    TensileStrength_kN_cm²=0.29,
    CompressiveStrength_kN_cm²=-2,
    StrengthHypothesis="MISES",
    mode="Isotrop")
trapezoid = CrossSectionKaramba3D(
    FamilyNameOfCrossSection="DefaultCroSec",
    NameOfCrossSection="rib 150x250",
    Material=isotrop,
    Height_cm=25,
    UpperFlangeWidth_cm=15,
    LowerFlangeWidth_cm=15,
    mode="Trapezoid")
linetobeam = CreateLinearElementKaramba3D(
    Line=[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],
    Identifier="rib",
    CrossSection=trapezoid,
    LimitDistance_m=0.005,
    BucklingLengthY_m=-1,
    BucklingLengthZ_m=-1,
    BucklingLengthLT_m=-1,
    Bending=True,
    ToPolylineMaxAngle=0.25,
    ToPolylineTolerance=0.1,
    ToPolylineMaxEdgeLength=0.25,
    New=True,
    Remove=True,
    mode="LineToBeam",
    GuidGeneratorSeed=-2127697100)  # -> Element, Points, Info
supp = SupportKaramba3D(
    PosInd=[Point(-4979.714209, -4979.714209, -22.10216891), Point(-5042.025881, 4.424303516e-12, 29.42150499), Point(4979.714209, -4979.714209, -22.10216891), Point(0, -5042.025881, 29.42150499), Point(4979.714209, 4979.714209, -22.10216891), Point(5042.025881, -4.42904972e-12, 29.42150499), Point(-4979.714209, 4979.714209, -22.10216891), Point(0, 5042.025881, 29.42150499)],
    Ct_kN_m=Vector(0, 0, 0),
    Cr_kNm_rad=Vector(0, 0, 0),
    menu=[buttons(on, on, on, off, off, off)])
gravity = LoadsKaramba3D(Vector=Vector(0, 0, -1), LCase="G", mode="Gravity")
meshload_const = LoadsKaramba3D(
    Vector=Vector(0, 0, -7),
    Mesh=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,
    LCase="G",
    MinimumLineLoadLength_m=0.5,
    mode="MeshLoad -Const.",
    menu=[buttons(off, on, off), buttons(on, off)])
assemble = AssembleModelKaramba3D(Elem=flatten(linetobeam.Element), Support=flatten(supp), Load=flatten([gravity, meshload_const]), LimitDistance_mm=0.005)  # -> Model, Info, Mass_kg, CentreOfGravity, LoadCaseNames
analysethii = AnalyseThIIKaramba3D(
    Model=assemble.Model,
    LoadCases="G",
    UseInitialNII=True,
    NIIFromCombination=True,
    NoTensionalNII=False,
    NoCompressiveNII=False,
    RTolerance=1e-07,
    MaxIterations=50)  # -> AnalysedModel, MaximumDisplacement_cm, ResultingForce_kN, ChangeOfElasticEnergy_kNm
buckling_modes = BucklingModesKaramba3D(Model=analysethii.AnalysedModel, FromIndex=1, NumberOfModes=1, MaximumNumberOfIterations=300, Epsilon=1e-07)  # -> ModelWithBucklingModes, BucklingLoadFactors
analyse = AnalyseKaramba3D(Model=assemble.Model)  # -> AnalysedModel, MaximumDisplacement_cm, ResultingForce_kN, ChangeOfElasticEnergy_kNm
react = ReactionForcesKaramba3D(AnalysedModel=analyse.AnalysedModel, LoadCase="G")  # -> Model, ReactionForces_kN, ReactionMoments_kNm, SupportPosition, SumOfReactionForces_kN, SumOfReactionMoments_kNm, GoverningLoadCaseIndex
b_forces = BeamForcesKaramba3D(AnalysedModel=analyse.AnalysedModel, LoadCase="G", Ts=[0, 0.5, 1])  # -> Model, NormalForce_kN, ShearForceVz_kN, ShearForceVy_kN, TorsionalMomentMt_kNm, BendingMomentMy_kNm, BendingMomentMz_kNm, LoadCaseIndex

# ---- group: friend-16-diagrid (stage B) - ribs 150x250 C30/37, rigid joints, feet pinned, LC G = self-weight + 7 kN/m2 on the 167 m2 pyramid surface
isotrop_2 = MaterialPropertiesKaramba3D(
    FamilyOfMaterial="Concrete",
    Name="C30/37 cast",
    YoungsModulus_kN_cm²=3280,
    InPlaneShearModulus_kN_cm²=1366.666667,
    TransverseShearModulus_kN_cm²=1366.666667,
    SpecificWeight_kN_m³=24,
    CoefficientOfThermalExpansion_1=1.2e-05,
    TensileStrength_kN_cm²=0.29,
    CompressiveStrength_kN_cm²=-2,
    StrengthHypothesis="MISES",
    mode="Isotrop")
trapezoid_2 = CrossSectionKaramba3D(
    FamilyNameOfCrossSection="DefaultCroSec",
    NameOfCrossSection="rib 150x250",
    Material=isotrop_2,
    Height_cm=25,
    UpperFlangeWidth_cm=15,
    LowerFlangeWidth_cm=15,
    mode="Trapezoid")
linetobeam_2 = CreateLinearElementKaramba3D(
    Line=[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],
    Identifier="rib",
    CrossSection=trapezoid_2,
    LimitDistance_m=0.005,
    BucklingLengthY_m=-1,
    BucklingLengthZ_m=-1,
    BucklingLengthLT_m=-1,
    Bending=True,
    ToPolylineMaxAngle=0.25,
    ToPolylineTolerance=0.1,
    ToPolylineMaxEdgeLength=0.25,
    New=True,
    Remove=True,
    mode="LineToBeam",
    GuidGeneratorSeed=-895926511)  # -> Element, Points, Info
supp_2 = SupportKaramba3D(
    PosInd=[Point(18976.28614, -4976.286141, -27.5785764), Point(19016.34309, -2843.073486, 11.45586611), Point(16843.07349, -5016.343088, 11.45586611), Point(14000, -5029.342894, 23.18641508), Point(11156.92651, -5016.343088, 11.45586611), Point(19029.34289, 1.794357255e-11, 23.18641508), Point(18976.28614, 4976.286141, -27.5785764), Point(16843.07349, 5016.343088, 11.45586611), Point(19016.34309, 2843.073486, 11.45586611), Point(14000, 5029.342894, 23.18641508), Point(9023.713859, 4976.286141, -27.5785764), Point(8983.656912, 2843.073486, 11.45586611), Point(11156.92651, 5016.343088, 11.45586611), Point(8970.657106, 0, 23.18641508), Point(9023.713859, -4976.286141, -27.5785764), Point(8983.656912, -2843.073486, 11.45586611)],
    Ct_kN_m=Vector(0, 0, 0),
    Cr_kNm_rad=Vector(0, 0, 0),
    menu=[buttons(on, on, on, off, off, off)])
gravity_2 = LoadsKaramba3D(Vector=Vector(0, 0, -1), LCase="G", mode="Gravity")
meshload_const_2 = LoadsKaramba3D(
    Vector=Vector(0, 0, -7),
    Mesh=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,
    LCase="G",
    MinimumLineLoadLength_m=0.5,
    mode="MeshLoad -Const.",
    menu=[buttons(off, on, off), buttons(on, off)])
assemble_2 = AssembleModelKaramba3D(
    Elem=flatten(linetobeam_2.Element),
    Support=flatten(supp_2),
    Load=flatten([gravity_2, meshload_const_2]),
    LimitDistance_mm=0.005)  # -> Model, Info, Mass_kg, CentreOfGravity, LoadCaseNames
analysethii_2 = AnalyseThIIKaramba3D(
    Model=assemble_2.Model,
    LoadCases="G",
    UseInitialNII=True,
    NIIFromCombination=True,
    NoTensionalNII=False,
    NoCompressiveNII=False,
    RTolerance=1e-07,
    MaxIterations=50)  # -> AnalysedModel, MaximumDisplacement_cm, ResultingForce_kN, ChangeOfElasticEnergy_kNm
buckling_modes_2 = BucklingModesKaramba3D(Model=analysethii_2.AnalysedModel, FromIndex=1, NumberOfModes=1, MaximumNumberOfIterations=300, Epsilon=1e-07)  # -> ModelWithBucklingModes, BucklingLoadFactors
analyse_2 = AnalyseKaramba3D(Model=assemble_2.Model)  # -> AnalysedModel, MaximumDisplacement_cm, ResultingForce_kN, ChangeOfElasticEnergy_kNm
react_2 = ReactionForcesKaramba3D(AnalysedModel=analyse_2.AnalysedModel, LoadCase="G")  # -> Model, ReactionForces_kN, ReactionMoments_kNm, SupportPosition, SumOfReactionForces_kN, SumOfReactionMoments_kNm, GoverningLoadCaseIndex
b_forces_2 = BeamForcesKaramba3D(AnalysedModel=analyse_2.AnalysedModel, LoadCase="G", Ts=[0, 0.5, 1])  # -> Model, NormalForce_kN, ShearForceVz_kN, ShearForceVy_kN, TorsionalMomentMt_kNm, BendingMomentMy_kNm, BendingMomentMz_kNm, LoadCaseIndex

# ----
friend_ap8_diagrid_mass_kg_max_disp_cm_s = Panel([assemble.Mass_kg, analyse.MaximumDisplacement_cm, react.SumOfReactionForces_kN, buckling_modes.BucklingLoadFactors])  # "friend-AP8-diagrid: mass [kg] | max disp [cm] | sum reactions [kN] | buckling factor"
friend_16_diagrid_mass_kg_max_disp_cm_su = Panel([assemble_2.Mass_kg, analyse_2.MaximumDisplacement_cm, react_2.SumOfReactionForces_kN, buckling_modes_2.BucklingLoadFactors])  # "friend-16-diagrid: mass [kg] | max disp [cm] | sum reactions [kN] | buckling factor"
