# Grasshopper definition polyweave-square.gh (Grasshopper 1.0.8)
# plug-ins: PolyFrame 2

# ---- group: 1. Force cells (native GH: square n x n, union-jack triangles, lifted to cap z = H(1-2d^2/L^2), joined to apex P = (0,0,-D))
l_plan_side_m = Slider(4, range=1..10)
n_cells_per_side = Slider(2, range=2..4)
h_cap_height_m = Slider(0.6, range=-2..2)
d_apex_depth_m = Slider(1, range=-3..3)
_2 = Panel("2")
division = Division(A=l_plan_side_m, B=_2)
_2h = Multiplication(A=h_cap_height_m, B=_2)
multiplication = Multiplication(A=l_plan_side_m, B=l_plan_side_m)
l_2 = Negative(Value=division)
corner_l_2_l_2_0 = ConstructPoint(XCoordinate=l_2, YCoordinate=l_2, ZCoordinate=0)
cell_l_n = Division(A=l_plan_side_m, B=n_cells_per_side)
grid_plane = XYPlane(Origin=corner_l_2_l_2_0)
n_x_n_grid = Square(Plane=grid_plane, Size=cell_l_n, ExtentX=n_cells_per_side, ExtentY=n_cells_per_side)  # -> Cells, Points
flatten_cells = FlattenTree(Tree=n_x_n_grid.Cells, Path="{0}")
cell_centre = Area(Geometry=flatten_cells)  # -> Area, Centroid
cell_edges = Explode(Curve=flatten_cells, Recursive=True)  # -> Segments, Vertices
graft_centres = GraftTree(Tree=cell_centre.Centroid, IncludeEmptyLists=True, IncludeNullItems=True)
flat_triangles = ExtrudePoint(Base=cell_edges.Segments, Point=graft_centres)
origin = ConstructPoint(XCoordinate=0, YCoordinate=0, ZCoordinate=0)
triangle_vertices = DeconstructBrep(Brep=flat_triangles)  # -> Faces, Edges, Vertices
d = Distance(PointA=triangle_vertices.Vertices, PointB=origin)
multiplication_2 = Multiplication(A=d, B=d)
d_2_l_2 = Division(A=multiplication_2, B=multiplication)
_2h_d_2_l_2 = Multiplication(A=_2h, B=d_2_l_2)
z_h_1_2d_2_l_2 = Subtraction(A=h_cap_height_m, B=_2h_d_2_l_2)
lift_vector = UnitZ(Factor=z_h_1_2d_2_l_2)
lift_to_cap = Move(Geometry=triangle_vertices.Vertices, Motion=lift_vector)  # -> Geometry, Transform
closed = BooleanToggle(True)
lifted_triangle = PolyLine(Vertices=lift_to_cap.Geometry, Closed=closed)
negative = Negative(Value=d_apex_depth_m)
apex_p_0_0_d = ConstructPoint(XCoordinate=0, YCoordinate=0, ZCoordinate=negative)
cap_face = BoundarySurfaces(Edges=lifted_triangle)
triangle_to_p = ExtrudePoint(Base=cap_face, Point=apex_p_0_0_d)
close_tetra = CapHoles(Brep=triangle_to_p)
force_cells = FlattenTree(Tree=close_tetra, Path="{0}")

# ---- group: 2. PolyFrame (PFBuild > PFPerp > PFMove > PFPipe / Display PFEdge Force / Visualize Deviation)
tolerance = Slider(0.01, range=0.001..0.2)
planarity = Slider(0.1, range=0.001..0.5)
pfbuild = PFBuild(Brep=flatten(force_cells), AbsoluteTolerance=tolerance, PlanarityTolerance=planarity)  # -> ForcePFoam, FormPFoam
max_iteration = Slider(1000, range=0..5000)
deviation_deg = Slider(0.1, range=0.01..5)
min_length = Slider(0.1, range=0..1)
pfperp = PFPerp(PFoam=pfbuild.FormPFoam, MaxIteration=max_iteration, Deviation=deviation_deg, MinimumEdgeLength=min_length)  # -> PFoam, Deviation
form_offset_z_m = Slider(0, range=-20..20)
form_offset_x_m = Slider(6, range=0..40)
final_deviation_deg = Panel(pfperp.Deviation)
offset_vector = VectorXYZ(XComponent=form_offset_x_m, YComponent=0, ZComponent=form_offset_z_m)  # -> Vector, Length
move_form = PFMove(PFoam=pfperp.PFoam, Vector=offset_vector.Vector)
minr = Slider(0.03, range=0..0.5)
maxr = Slider(0.12, range=0..0.5)
text_size = Slider(12, range=1..40)
dev_high_deg = Slider(1, range=0.01..10)
pfpipe = PFPipe(PFoam=move_form, MinR=minr, MaxR=maxr)  # -> Axes, Radius, Color, Pipe, Force
display_pfedge_force = DisplayPFEdgeForce(PFoam=move_form, Size=text_size)
visualize_deviation = VisualizeDeviation(Form=move_form, High=dev_high_deg, showAngle=True)

# ---- group: 3. Check (internal members only; Inspect PFEdge Force: + = compression, - = tension)
explode_pfoam = ExplodePFoam(PFoam=move_form)  # -> PFVertices, PFEdges, PFFaces, PFCells
separate_half_edges = SeparateHalfEdges(PFEdge=explode_pfoam.PFEdges)  # -> Positive, Negative
count = ListLength(List=explode_pfoam.PFVertices)
form_vertices = Panel(count)
separate_pfedges_by_type = SeparatePFEdgesByType(PFEdge=separate_half_edges.Positive)  # -> Internal, Force, External
inspect_pfedge = InspectPFEdge(PFEdge=separate_pfedges_by_type.Internal)  # -> ID, Line, External, Force, PFVertices, PPFFaces, Dual, Pair
count_2 = ListLength(List=separate_pfedges_by_type.Internal)
members = Panel(count_2)
f_0_c = LargerThan(FirstNumber=inspect_pfedge.Force, SecondNumber=0)  # -> LargerThan, OrEqualTo
f_0_t = SmallerThan(FirstNumber=inspect_pfedge.Force, SecondNumber=0)  # -> SmallerThan, OrEqualTo
member_force_c_t = Panel(inspect_pfedge.Force)
count_c = MassAddition(Input=f_0_c.LargerThan)  # -> Result, PartialResults
count_t = MassAddition(Input=f_0_t.SmallerThan)  # -> Result, PartialResults
compression = Panel(count_c.Result)
tension = Panel(count_t.Result)
